# Grasshopper definition Custom material preview.gh (Grasshopper 1.0.7)
# Copyright: Co-de-iT

# NOTE: this definition needs the
# 
# Custom material preview.3dm
# 
# file as reference for materials and environments
# reference discussion: see:
# 
# https://discourse.mcneel.com/t/custom-preview-shinyness-when-using-create-material-bug/53513/8
geometry = ValueList({"one": 0, "two": 1}, selected="one")
mesh = Mesh(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)
mesh_2 = Mesh(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)
swatch = ColourSwatch(SwatchColor=RGB(0, 0, 0))
filter = StreamFilter(Gate=geometry, Stream0=mesh, Stream1=mesh_2)
# This component allows custom material creation (without textures).
# 
# These settings equal the Black Opaque Plastic material.
panel = Panel("0")
mesh_3 = Mesh(filter)
material = MaterialShiny(
    Color_Diffuse=swatch,
    Color_Ambient=swatch,
    Color_Emission=swatch,
    Color_Reflection=ColourSwatch(SwatchColor=RGB(255, 255, 255)),
    Reflectivity="1",
    ReflectionGlossiness="0.15",
    RefractionGlossiness="0.85",
    FresnelReflections=Toggle(True),
    IoR="1.5",
    Transparency=panel)  # -> Mat; inputs Color_Diffuse: Color, Color_Ambient: Color, Color_Emission: Color, Color_Reflection: Color, Reflectivity: Double, ReflectionGlossiness: Double, RefractionGlossiness: Double, FresnelReflections: Boolean, IoR: Double, Transparency: Double
# ---------- material: C# usings ----------
using System.Drawing;
# ---------- material: C# ----------
            /*
  Original code: David Rutten
  extended by Joseph Oster
  further expanded by Alessio Erioli
  see discussion at: https://discourse.mcneel.com/t/custom-preview-shinyness-when-using-create-material-bug/53513/8
  */

    Reflectivity = Math.Min(Math.Max(Reflectivity, 0), 1);
    ReflectionGlossiness = Math.Min(Math.Max(ReflectionGlossiness, 0), 1);
    Transparency = Math.Min(Math.Max(Transparency, 0), 1);
    Color_Reflection = Color_Reflection.IsEmpty ? Color_Diffuse : Color_Reflection;

    Rhino.DocObjects.Material material = new  Rhino.DocObjects.Material();
    //material.SetBitmapTexture(fileName);
    material.FresnelReflections = FresnelReflections;
    if (FresnelReflections)
      material.FresnelIndexOfRefraction = IoR;
    else material.IndexOfRefraction = IoR;
    material.DiffuseColor = Color_Diffuse;
    material.AmbientColor = Color_Ambient;
    material.EmissionColor = Color_Emission;
    material.ReflectionColor = Color_Reflection;
    material.Reflectivity = Reflectivity;
    material.RefractionGlossiness = RefractionGlossiness;
    material.ReflectionGlossiness = ReflectionGlossiness;
    material.Transparency = Transparency;

    var renderMaterial = Rhino.Render.RenderMaterial.CreateBasicMaterial(material);
    Mat = new GH_Material(renderMaterial);
# ---------- end material ----------
# Custom Material Preview
# 
# Using custom materials in Grasshopper for Rhino Rendered preview
# 
# © a3 _/TH.esis 2019 _ Creative Commons Attribution-NonCommercial-ShareAlike3.0 UnportedLicense.
bbox = BoundingBox(Content=mesh_3, Plane=PlaneXY(0, 0, 0))  # -> Box, Box_2

# ---- group: Black Opaque Plastic
M = Material({diffuse=RGB(0, 0, 0), emission=RGB(0, 0, 0), shine=0.85, specular=RGB(217, 217, 217), transparency=0})

# ---- group: Porcelain
# referenced from Rhino file
M_2 = Material({diffuse=RGB(255, 255, 255), emission=RGB(0, 0, 0), shine=0.8, specular=RGB(255, 255, 255), transparency=0})

# ----
material_2 = ValueList({"generated": 0, "referenced 1": 1, "referenced 2": 2}, selected="generated")
box = EvaluateBox(Box=bbox.Box_2, UParameter=0.5, VParameter=0.5, WParameter="0")  # -> Plane, Point, Include
Z = UnitZ(Factor=1)
edges = BrepEdges(Brep=bbox.Box)  # -> Naked, Interior, NonManifold
contour = Contour(Shape=mesh_3, Point=box.Plane, Direction=Z, Distance=Slider(0.5, range=0.2..10))  # -> simplify(Contours)
filter_2 = StreamFilter(Gate=material_2, Stream0=material, Stream1=M, Stream2=M_2)
# custom preview mesh vertices
panel_2 = Panel("1")
# Open the linked Rhino file (Custom material preview.3dm), then right click on the M input > Set one material and choose from the list of materials in the Rhino file
panel_3 = Panel("1")
panel_4 = Panel("custom preview curves")
c_script = CSharpScript(C=contour, col=ColourSwatch(SwatchColor=RGB(87, 87, 87)), W="1")  # inputs C: list of Curve, col: Color, W: Int32
# ---------- c_script: C# ----------
 
    foreach(Curve cur in C)
    {
      _clip = BoundingBox.Union(_clip, cur.GetBoundingBox(false));
      _curve.Add(cur);
      _color.Add(col);
      _width.Add(W);
    }
# ---------- c_script: C# additional code ----------
  private BoundingBox _clip;
  private List<Curve> _curve = new  List<Curve>();
  private List<Color> _color = new  List<Color>();
  private List<int> _width = new  List<int>();

  /// <summary>
  /// This method will be called once every solution, before any calls to RunScript.
  /// </summary>
  public override void BeforeRunScript()
  {
    _clip = BoundingBox.Empty;
    _curve.Clear();
    _color.Clear();
    _width.Clear();
  }
  /// <summary>
  /// This method will be called once every solution, after any calls to RunScript.
  /// </summary>
  public override void AfterRunScript()
  { }


  //Return a BoundingBox that contains all the geometry you are about to draw.
  public override BoundingBox ClippingBox
  {
    get {  return _clip;}
  }

  //Draw all meshes in this method.
  public override void DrawViewportMeshes(IGH_PreviewArgs args)
  {
  }

  //Draw all wires and points in this method.
  public override void DrawViewportWires(IGH_PreviewArgs args)
  {
    for(int i = 0; i < _curve.Count; i++)
      args.Display.DrawCurve(_curve[i], _color[i], _width[i]);
  }
# ---------- end c_script ----------
c_script_2 = CSharpScript(C=edges.Interior, col=ColourSwatch(SwatchColor=RGB(255, 0, 0)), W="2")  # inputs C: list of Curve, col: Color, W: Int32; same code as c_script
c_script_3 = CSharpScript(M=mesh_3, C=ColourSwatch(SwatchColor=RGB(82, 82, 82)), W=panel_3)  # inputs M: Mesh, C: Color, W: Int32
# ---------- c_script_3: C# ----------
    _clip = BoundingBox.Union(_clip, M.GetBoundingBox(false));
    _mesh = M;
    _points.AddRange(M.Vertices.ToPoint3dArray());
    _color = C;
    _width = W;
# ---------- c_script_3: C# additional code ----------
  private BoundingBox _clip;
  private Mesh _mesh = new Mesh();
  private List<Point3d> _points = new List<Point3d>();
  private  Color _color;// = Color.White;
  private  int _width;// = 1;

  /// <summary>
  /// This method will be called once every solution, before any calls to RunScript.
  /// </summary>
  public override void BeforeRunScript()
  {
    _clip = BoundingBox.Empty;
    _points.Clear();
    _mesh = null;
  }
  /// <summary>
  /// This method will be called once every solution, after any calls to RunScript.
  /// </summary>
  public override void AfterRunScript()
  { }


  //Return a BoundingBox that contains all the geometry you are about to draw.
  public override BoundingBox ClippingBox
  {
    get {  return _clip;}
  }

  //Draw all meshes in this method.
  public override void DrawViewportMeshes(IGH_PreviewArgs args)
  {
  }

  //Draw all wires and points in this method.
  public override void DrawViewportWires(IGH_PreviewArgs args)
  {
    //Rhino.Display.PointStyle.Square;
    args.Display.DrawPoints(_points, Rhino.Display.PointStyle.Square, _width, _color);
    //args.Display.DrawMeshVertices(_mesh, _color);
      //DrawMeshWires(_mesh, _color, _width);
  }
# ---------- end c_script_3 ----------
# custom preview mesh wires
c_script_4 = CSharpScript(M=mesh_3, C=ColourSwatch(SwatchColor=RGB(23, 23, 23)), W=panel_2)  # inputs M: Mesh, C: Color, W: Int32
# ---------- c_script_4: C# ----------
    _clip = BoundingBox.Union(_clip, M.GetBoundingBox(false));
    _mesh = M;
    _color = C;
    _width = W;
# ---------- c_script_4: C# additional code ----------
  private BoundingBox _clip;
  private Mesh _mesh = new Mesh();
  private  Color _color;// = Color.White;
  private  int _width;// = 1;

  /// <summary>
  /// This method will be called once every solution, before any calls to RunScript.
  /// </summary>
  public override void BeforeRunScript()
  {
    _clip = BoundingBox.Empty;
    _mesh = null;
  }
  /// <summary>
  /// This method will be called once every solution, after any calls to RunScript.
  /// </summary>
  public override void AfterRunScript()
  { }


  //Return a BoundingBox that contains all the geometry you are about to draw.
  public override BoundingBox ClippingBox
  {
    get {  return _clip;}
  }

  //Draw all meshes in this method.
  public override void DrawViewportMeshes(IGH_PreviewArgs args)
  {
  }

  //Draw all wires and points in this method.
  public override void DrawViewportWires(IGH_PreviewArgs args)
  {
    args.Display.DrawMeshWires(_mesh, _color, _width);
  }
# ---------- end c_script_4 ----------
preview = CustomPreview(Geometry=mesh_3, Material=filter_2)

# ---- group: clipping plane
Z_2 = UnitZ(Factor=1)
pt = Point(Point(20.81571711, 0, -0.9248043614))
rev = Reverse(Vector=Z_2)
c_script_5 = CSharpScript(P=pt, V=rev)  # inputs P: Point3d, V: Vector3d; disabled
# ---------- c_script_5: C# ----------
    _point = P;
    _vector = V;
# ---------- c_script_5: C# additional code ----------
  private BoundingBox _clip;
  private Point3d _point = new Point3d();
  private Vector3d _vector = Vector3d.Zero;


  /// <summary>
  /// This method will be called once every solution, before any calls to RunScript.
  /// </summary>
  public override void BeforeRunScript()
  {
    _clip = BoundingBox.Empty;
    // _points.Clear();
    // _mesh = null;
  }
  /// <summary>
  /// This method will be called once every solution, after any calls to RunScript.
  /// </summary>
  public override void AfterRunScript()
  { }


  //Return a BoundingBox that contains all the geometry you are about to draw.
  public override BoundingBox ClippingBox
  {
    get {  return _clip;}
  }

  //Draw all meshes in this method.
  public override void DrawViewportMeshes(IGH_PreviewArgs args)
  {

  }

  //Draw all wires and points in this method.
  public override void DrawViewportWires(IGH_PreviewArgs args)
  {

    args.Display.AddClippingPlane(_point, _vector);
    //Rhino.Display.PointStyle.Square;

    //args.Display.DrawPoints(_points, Rhino.Display.PointStyle.Square, _width, _color);
    //args.Display.DrawMeshVertices(_mesh, _color);
    //DrawMeshWires(_mesh, _color, _width);
  }
# ---------- end c_script_5 ----------
