# Grasshopper definition EXPL_00 - DataTrees.gh (Grasshopper 1.0.7)
# plug-ins: Bifocals

# OPTIONAL EXPLANATION
# They could check it at home !
# DATA TREE ANATOMY
# Data Trees represent the tool Grasshopper uses to organize complex data structures.
# They are a hierarchical, ordered and linear collection of nested lists.
data = Data([Point(0.5, 0.5, 0), Point(0.5, 1.5, 0), Point(0.5, 2.5, 0), Point(0.5, 3.5, 0)])
data_2 = Data(Tree({0;0;0}: [Point(0.5, 0.5, 0), Point(0.5, 1.5, 0), Point(0.5, 2.5, 0), Point(0.5, 3.5, 0)], {0;0;1}: [Point(1.5, 0.5, 0), Point(1.5, 1.5, 0), Point(1.5, 2.5, 0), Point(1.5, 3.5, 0)], {0;0;2}: [Point(2.5, 0.5, 0), Point(2.5, 1.5, 0), Point(2.5, 2.5, 0), Point(2.5, 3.5, 0)]))
# We can understand a data tree as a list of lists and visualize it by using the Panel
# branch {0;0;0}
# branch {0;0;1}
# data tree
panel = Panel(data_2)
# - DATA TREE -
# list with 4 items
# list with 4 items
# list with 4 items
panel_2 = Panel(data_2)
# Data Tree Explanation
# 
# Data Tree breakdown and explanation
# 
# code by Marco Palma
# 
# v 0.1
# 
# © Co-de-iT 2020 / Creative Commons Attribution-NonCommercial-ShareAlike 4.0 International License
# - LIST -
# indexes
# path
# items
panel_3 = Panel(data)
# item {0;0;2} [2]
# ... or by using the Parameter Viewer
# what's about trees?
viewer = ParamViewer(data_2)
# grumpy.jpg
# Cats
# Pictures
# UserName
# C:\
# C:\UserNamePictures\Cats\grumpy.jpg
# computers also call it "path"
# Select Second Centroid
# {0;0;1:0}[1]
# Centroid
# {0;0;1:0}
# {0;0;0}
# Dispatch (True)
# Dispatch (False)
# {0;1;0}
# Subdivide Surface
# {0;0}
# Surface
# {0}
image = ImageSampler(Filter="Colour", Interpolate=False, Umax=1, Umin=0, Vmax=1, Vmin=0, Wrap=1)
# branch {0;0;2}
viewer_2 = ParamViewer(data_2)
data_3 = Data(Tree({0;0;0}: [Point(0.5, 0.5, 0), Point(0.5, 1.5, 0), Point(0.5, 2.5, 0), Point(0.5, 3.5, 0)], {0;0;1}: [Point(1.5, 0.5, 0), Point(1.5, 1.5, 0), Point(1.5, 2.5, 0), Point(1.5, 3.5, 0)], {0;0;2}: [Point(2.5, 0.5, 0), Point(2.5, 1.5, 0), Point(2.5, 2.5, 0), Point(2.5, 3.5, 0)]))
data_4 = Data(Tree({0;0;0}: [Point(0.5, 0.5, 0), Point(0.5, 1.5, 0), Point(0.5, 2.5, 0), Point(0.5, 3.5, 0)], {0;0;1}: [Point(1.5, 0.5, 0), Point(1.5, 1.5, 0), Point(1.5, 2.5, 0), Point(1.5, 3.5, 0)], {0;0;2}: [Point(2.5, 0.5, 0), Point(2.5, 1.5, 0), Point(2.5, 2.5, 0), Point(2.5, 3.5, 0)]))
# DATA TREE OPERATIONS
# Tree Statistics
data_5 = Data(Tree({0;0;0}: [Point(0.5, 0.5, 0), Point(0.5, 1.5, 0), Point(0.5, 2.5, 0), Point(0.5, 3.5, 0)], {0;0;1}: [Point(1.5, 0.5, 0), Point(1.5, 1.5, 0), Point(1.5, 2.5, 0), Point(1.5, 3.5, 0)], {0;0;2}: [Point(2.5, 0.5, 0), Point(2.5, 1.5, 0), Point(2.5, 2.5, 0), Point(2.5, 3.5, 0)]))
data_6 = Data(simplify(Tree({0;0;0}: [Point(0.5, 0.5, 0), Point(0.5, 1.5, 0), Point(0.5, 2.5, 0), Point(0.5, 3.5, 0)], {0;0;1}: [Point(1.5, 0.5, 0), Point(1.5, 1.5, 0), Point(1.5, 2.5, 0), Point(1.5, 3.5, 0)], {0;0;2}: [Point(2.5, 0.5, 0), Point(2.5, 1.5, 0), Point(2.5, 2.5, 0), Point(2.5, 3.5, 0)])))

# ---- group: Flattened Data
# Unflatten
# 1
# 1 and 2 MUST have the same amount of items!
data_7 = Data(flatten(Tree({0;0;0}: [Point(0.5, 0.5, 0), Point(0.5, 1.5, 0), Point(0.5, 2.5, 0), Point(0.5, 3.5, 0)], {0;0;1}: [Point(1.5, 0.5, 0), Point(1.5, 1.5, 0), Point(1.5, 2.5, 0), Point(1.5, 3.5, 0)], {0;0;2}: [Point(2.5, 0.5, 0), Point(2.5, 1.5, 0), Point(2.5, 2.5, 0), Point(2.5, 3.5, 0)])))

# ----
# Flatten - Graft
points = PointList(Points=data_3, Size=0.25)
panel_4 = Panel(data_3)
viewer_3 = ParamViewer(data_3)
panel_5 = Panel(data_4)
# Simplify
viewer_4 = ParamViewer(data_4)
tstat = TreeStatistics(Tree=data_5)  # -> Paths, Length, Count
panel_6 = Panel(data_6)
# Flip Matrix
viewer_5 = ParamViewer(data_6)
panel_7 = Panel(tstat.Paths)
panel_8 = Panel(tstat.Length)
panel_9 = Panel(tstat.Count)
panel_10 = Panel(data_7)
viewer_6 = ParamViewer(data_7)
flatten = FlattenTree(Tree=data_3, Path="{0}")
simplify = SimplifyTree(Tree=data_4, Front=False)
flip = FlipMatrix(Data=data_6)
panel_11 = Panel(flatten)
viewer_7 = ParamViewer(flatten)
# Simplify removes overlapping path indices -i.e. the
# ones that are not useful in defining the data structure.
# For this reason, the data structure is mantained.
panel_12 = Panel(simplify)
viewer_8 = ParamViewer(simplify)

# ---- group: Structured Data
# 2
data_8 = Data(Tree({0;0;0}: [Point(0.5, 0.5, 0), Point(0.5, 1.5, 0), Point(0.5, 2.5, 0), Point(0.5, 3.5, 0)], {0;0;1}: [Point(1.5, 0.5, 0), Point(1.5, 1.5, 0), Point(1.5, 2.5, 0), Point(1.5, 3.5, 0)], {0;0;2}: [Point(2.5, 0.5, 0), Point(2.5, 1.5, 0), Point(2.5, 2.5, 0), Point(2.5, 3.5, 0)]))

# ----
panel_13 = Panel(flip)
viewer_9 = ParamViewer(flip)
unflatten = UnflattenTree(Tree=data_7, Guide=data_8)
panel_14 = Panel(unflatten)
viewer_10 = ParamViewer(unflatten)
graft = GraftTree(Tree=flatten, IncludeEmptyLists=True, IncludeNullItems=True)
panel_15 = Panel(graft)
viewer_11 = ParamViewer(graft)
data_9 = Data(Tree({0;0}: [Point(0.5, 0.5, 0), Point(0.5, 1.5, 0), Point(0.5, 3.5, 0), Point(1.5, 0.5, 0), Point(1.5, 1.5, 0), Point(1.5, 3.5, 0), Point(2.5, 0.5, 0), Point(2.5, 1.5, 0), Point(2.5, 3.5, 0)], {0;1}: [], {0;2}: [Point(0.5, 0.5, 0), Point(0.5, 1.5, 0), Point(0.5, 3.5, 0), Point(1.5, 0.5, 0), Point(1.5, 1.5, 0), Point(1.5, 3.5, 0), Point(2.5, 0.5, 0), Point(2.5, 1.5, 0), Point(2.5, 3.5, 0)]))
# Prune Tree
data_10 = Data(Tree({0;0;0}: [Point(0.5, 0.5, 0), Point(0.5, 1.5, 0), Point(0.5, 3.5, 0), Point(0.5, 2.5, 0)], {0;1;0}: [Point(1.5, 0.5, 0), Point(1.5, 1.5, 0)], {0;2;0}: [Point(2.5, 0.5, 0), Point(2.5, 1.5, 0), Point(2.5, 3.5, 0), Point(2.5, 2.5, 0)], {0;3;0}: [Point(3.5, 0.5, 0), Point(3.5, 1.5, 0), Point(3.5, 3.5, 0), Point(3.5, 2.5, 0), Point(3.5, 5.5, 0), Point(3.5, 4.5, 0)], {0;4;0}: [Point(4.5, 0.5, 0), Point(4.5, 1.5, 0), Point(4.5, 3.5, 0), Point(4.5, 2.5, 0)]))
viewer_12 = ParamViewer(data_10)
# Clean Tree
panel_16 = Panel(data_9)
prune = PruneTree(Tree=data_10, Minimum="3", Maximum="5")
clean = CleanTree(RemoveNulls=Toggle(True), RemoveInvalid=Toggle(False), RemoveEmpty=Toggle(True), Tree=data_9)
viewer_13 = ParamViewer(prune)
panel_17 = Panel(clean)

# ---- group: Flattened Lists
pt = Point([Point(0.5, 0.5, 0), Point(0.5, 1.5, 0), Point(0.5, 2.5, 0), Point(0.5, 3.5, 0)])
pt_2 = Point([Point(1.5, 0.5, 0), Point(1.5, 1.5, 0), Point(1.5, 2.5, 0), Point(1.5, 3.5, 0)])
pt_3 = Point([Point(2.5, 0.5, 0), Point(2.5, 1.5, 0), Point(2.5, 2.5, 0), Point(2.5, 3.5, 0)])

pt_4 = Point([Point(0.5, 0.5, 0), Point(0.5, 1.5, 0), Point(0.5, 2.5, 0), Point(0.5, 3.5, 0)])
pt_5 = Point([Point(1.5, 0.5, 0), Point(1.5, 1.5, 0), Point(1.5, 2.5, 0), Point(1.5, 3.5, 0)])
pt_6 = Point([Point(2.5, 0.5, 0), Point(2.5, 1.5, 0), Point(2.5, 2.5, 0), Point(2.5, 3.5, 0)])

# ----
# Entwine
panel_18 = Panel(pt_6)
panel_19 = Panel(pt_5)
# Merge
panel_20 = Panel(pt_4)
merge = Merge(Data1=pt_4, Data2=pt_5, Data3=pt_6)
panel_21 = Panel(merge)

# ---- group: Grafted Lists
pt_7 = Point(graft([Point(0.5, 0.5, 0), Point(0.5, 1.5, 0), Point(0.5, 2.5, 0), Point(0.5, 3.5, 0)]))
pt_8 = Point(graft([Point(1.5, 0.5, 0), Point(1.5, 1.5, 0), Point(1.5, 2.5, 0), Point(1.5, 3.5, 0)]))
pt_9 = Point(graft([Point(2.5, 0.5, 0), Point(2.5, 1.5, 0), Point(2.5, 2.5, 0), Point(2.5, 3.5, 0)]))

pt_10 = Point(graft([Point(1.5, 0.5, 0), Point(1.5, 1.5, 0), Point(1.5, 2.5, 0), Point(1.5, 3.5, 0)]))
pt_11 = Point(graft([Point(2.5, 0.5, 0), Point(2.5, 1.5, 0), Point(2.5, 2.5, 0), Point(2.5, 3.5, 0)]))
pt_12 = Point(graft([Point(0.5, 0.5, 0), Point(0.5, 1.5, 0), Point(0.5, 2.5, 0), Point(0.5, 3.5, 0)]))

# ----
panel_22 = Panel(pt_11)
panel_23 = Panel(pt_10)
panel_24 = Panel(pt_12)
merge_2 = Merge(Data1=pt_12, Data2=pt_10, Data3=pt_11)
panel_25 = Panel(merge_2)

# ---- group: Mixed Lists
pt_13 = Point(graft([Point(1.5, 0.5, 0), Point(1.5, 1.5, 0), Point(1.5, 2.5, 0), Point(1.5, 3.5, 0)]))
pt_14 = Point([Point(2.5, 0.5, 0), Point(2.5, 1.5, 0), Point(2.5, 2.5, 0), Point(2.5, 3.5, 0)])
pt_15 = Point([Point(0.5, 0.5, 0), Point(0.5, 1.5, 0), Point(0.5, 2.5, 0), Point(0.5, 3.5, 0)])

pt_16 = Point(graft([Point(1.5, 0.5, 0), Point(1.5, 1.5, 0), Point(1.5, 2.5, 0), Point(1.5, 3.5, 0)]))
pt_17 = Point([Point(0.5, 0.5, 0), Point(0.5, 1.5, 0), Point(0.5, 2.5, 0), Point(0.5, 3.5, 0)])
pt_18 = Point([Point(2.5, 0.5, 0), Point(2.5, 1.5, 0), Point(2.5, 2.5, 0), Point(2.5, 3.5, 0)])

# ----
entwine = Entwine(Branch00=pt, Branch01=pt_2, Branch02=pt_3, FlattenInputs=True)
panel_26 = Panel(entwine)
entwine_2 = Entwine(Branch0X=pt_7, Branch1X=pt_8, Branch2X=pt_9, FlattenInputs=False)
panel_27 = Panel(entwine_2)
entwine_3 = Entwine(Branch0X=pt_17, Branch1X=pt_16, Branch2X=pt_18, FlattenInputs=False)
panel_28 = Panel(entwine_3)

panel_29 = Panel(pt_15)
panel_30 = Panel(pt_13)
panel_31 = Panel(pt_14)
merge_3 = Merge(Data1=pt_15, Data2=pt_13, Data3=pt_14)
panel_32 = Panel(merge_3)
# Explode Tree
data_11 = Data(Tree({0;0;0}: [Point(0.5, 0.5, 0), Point(0.5, 1.5, 0), Point(0.5, 2.5, 0), Point(0.5, 3.5, 0)], {0;0;1}: [Point(1.5, 0.5, 0), Point(1.5, 1.5, 0), Point(1.5, 2.5, 0), Point(1.5, 3.5, 0)], {0;0;2}: [Point(2.5, 0.5, 0), Point(2.5, 1.5, 0), Point(2.5, 2.5, 0), Point(2.5, 3.5, 0)]))
# Tree Branch
data_12 = Data(Tree({0;0;0}: [Point(0.5, 0.5, 0), Point(0.5, 1.5, 0), Point(0.5, 2.5, 0), Point(0.5, 3.5, 0)], {0;0;1}: [Point(1.5, 0.5, 0), Point(1.5, 1.5, 0), Point(1.5, 2.5, 0), Point(1.5, 3.5, 0)], {0;0;2}: [Point(2.5, 0.5, 0), Point(2.5, 1.5, 0), Point(2.5, 2.5, 0), Point(2.5, 3.5, 0)]))
# Tree Item
data_13 = Data(Tree({0;0;0}: [Point(0.5, 0.5, 0), Point(0.5, 1.5, 0), Point(0.5, 2.5, 0), Point(0.5, 3.5, 0)], {0;0;1}: [Point(1.5, 0.5, 0), Point(1.5, 1.5, 0), Point(1.5, 2.5, 0), Point(1.5, 3.5, 0)], {0;0;2}: [Point(2.5, 0.5, 0), Point(2.5, 1.5, 0), Point(2.5, 2.5, 0), Point(2.5, 3.5, 0)]))
panel_33 = Panel(data_12)
panel_34 = Panel(data_11)
panel_35 = Panel(data_13)
bang = ExplodeTree(Data=data_11)  # -> Branch0, Branch1, Branch2
panel_36 = Panel("""{0;0;1}
{0;0;2}""")
branch = TreeBranch(Tree=data_12, Path=panel_36, MaintainPaths=True)
panel_37 = Panel(bang.Branch0)
panel_38 = Panel(bang.Branch1)
panel_39 = Panel(bang.Branch2)
item = TreeItem(Tree=data_13, Path="{0;0;1}", Index="3", Wrap=True)
panel_40 = Panel(branch)
panel_41 = Panel(item)

# ----
# Trim Tree
data_14 = Data(Tree({0;0}: [0], {0;1}: [1], {0;2}: [2], {0;3}: [3], {0;4}: [4], {0;5}: [5]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))
viewer_14 = ParamViewer(data_14)
trim = TrimTree(Tree=data_14, Depth="+1")
viewer_15 = ParamViewer(trim)

# ----
# Shift Path
data_15 = Data(Tree({0;0}: [0], {0;1}: [1], {0;2}: [2], {0;3}: [3], {0;4}: [4], {0;5}: [5]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))
viewer_16 = ParamViewer(data_15)
pshift = ShiftPaths(Data=data_15, Offset="+1")
pshift_2 = ShiftPaths(Data=data_15, Offset="-1")
viewer_17 = ParamViewer(pshift)
viewer_18 = ParamViewer(pshift_2)
# Deconstruct Path
data_16 = Data(Tree({0;0;0}: [Point(0.5, 0.5, 0), Point(0.5, 1.5, 0), Point(0.5, 2.5, 0), Point(0.5, 3.5, 0)], {0;0;1}: [Point(1.5, 0.5, 0), Point(1.5, 1.5, 0), Point(1.5, 2.5, 0), Point(1.5, 3.5, 0)], {0;0;2}: [Point(2.5, 0.5, 0), Point(2.5, 1.5, 0), Point(2.5, 2.5, 0), Point(2.5, 3.5, 0)]))

# ----
# Construct Path
data_17 = Data(simplify(Tree({0;0;0;0}: [0, 0, 0], {0;0;0;1}: [0, 0, 1], {0;0;0;2}: [0, 0, 2])))
panel_42 = Panel(data_17)
replace = ReplaceItems(List=data_17, Item="1", Indices="1", Wrap=False)
panel_43 = Panel(replace)
path = ConstructPath(Indices=replace)  # -> flatten(Branch)
panel_44 = Panel(path)

pt_19 = Point(Tree({0}: [Point(0, 0, 0), Point(0, 1, 0), Point(0, 2, 0), Point(0, 3, 0), Point(0, 4, 0), Point(0, 5, 0), Point(0, 6, 0), Point(0, 7, 0), Point(0, 8, 0), Point(0, 9, 0), Point(0, 10, 0), Point(0, 11, 0), Point(0, 12, 0)], {1}: [Point(1, 0, 0), Point(1, 1, 0), Point(1, 2, 0), Point(1, 3, 0), Point(1, 4, 0), Point(1, 5, 0), Point(1, 6, 0), Point(1, 7, 0), Point(1, 8, 0), Point(1, 9, 0), Point(1, 10, 0), Point(1, 11, 0), Point(1, 12, 0)], {2}: [Point(2, 0, 0), Point(2, 1, 0), Point(2, 2, 0), Point(2, 3, 0), Point(2, 4, 0), Point(2, 5, 0), Point(2, 6, 0), Point(2, 7, 0), Point(2, 8, 0), Point(2, 9, 0), Point(2, 10, 0), Point(2, 11, 0), Point(2, 12, 0)], {3}: [Point(3, 0, 0), Point(3, 1, 0), Point(3, 2, 0), Point(3, 3, 0), Point(3, 4, 0), Point(3, 5, 0), Point(3, 6, 0), Point(3, 7, 0), Point(3, 8, 0), Point(3, 9, 0), Point(3, 10, 0), Point(3, 11, 0), Point(3, 12, 0)], {4}: [Point(4, 0, 0), Point(4, 1, 0), Point(4, 2, 0), Point(4, 3, 0), Point(4, 4, 0), Point(4, 5, 0), Point(4, 6, 0), Point(4, 7, 0), Point(4, 8, 0), Point(4, 9, 0), Point(4, 10, 0), Point(4, 11, 0), Point(4, 12, 0)], {5}: [Point(5, 0, 0), Point(5, 1, 0), Point(5, 2, 0), Point(5, 3, 0), Point(5, 4, 0), Point(5, 5, 0), Point(5, 6, 0), Point(5, 7, 0), Point(5, 8, 0), Point(5, 9, 0), Point(5, 10, 0), Point(5, 11, 0), Point(5, 12, 0)], {6}: [Point(6, 0, 0), Point(6, 1, 0), Point(6, 2, 0), Point(6, 3, 0), Point(6, 4, 0), Point(6, 5, 0), Point(6, 6, 0), Point(6, 7, 0), Point(6, 8, 0), Point(6, 9, 0), Point(6, 10, 0), Point(6, 11, 0), Point(6, 12, 0)], {7}: [Point(7, 0, 0), Point(7, 1, 0), Point(7, 2, 0), Point(7, 3, 0), Point(7, 4, 0), Point(7, 5, 0), Point(7, 6, 0), Point(7, 7, 0), Point(7, 8, 0), Point(7, 9, 0), Point(7, 10, 0), Point(7, 11, 0), Point(7, 12, 0)], {8}: [Point(8, 0, 0), Point(8, 1, 0), Point(8, 2, 0), Point(8, 3, 0), Point(8, 4, 0), Point(8, 5, 0), Point(8, 6, 0), Point(8, 7, 0), Point(8, 8, 0), Point(8, 9, 0), Point(8, 10, 0), Point(8, 11, 0), Point(8, 12, 0)]))
pt_20 = Point(Tree({1;1;1}: [Point(0, 0, 0), Point(0, 1, 0), Point(0, 2, 0), Point(0, 3, 0), Point(0, 4, 0), Point(0, 5, 0), Point(0, 6, 0), Point(0, 7, 0), Point(0, 8, 0), Point(0, 9, 0), Point(0, 10, 0), Point(0, 11, 0), Point(0, 12, 0)], {1;1;2}: [Point(1, 0, 0), Point(1, 1, 0), Point(1, 2, 0), Point(1, 3, 0), Point(1, 4, 0), Point(1, 5, 0), Point(1, 6, 0), Point(1, 7, 0), Point(1, 8, 0), Point(1, 9, 0), Point(1, 10, 0), Point(1, 11, 0), Point(1, 12, 0)], {1;1;3}: [Point(2, 0, 0), Point(2, 1, 0), Point(2, 2, 0), Point(2, 3, 0), Point(2, 4, 0), Point(2, 5, 0), Point(2, 6, 0), Point(2, 7, 0), Point(2, 8, 0), Point(2, 9, 0), Point(2, 10, 0), Point(2, 11, 0), Point(2, 12, 0)], {1;1;4}: [Point(3, 0, 0), Point(3, 1, 0), Point(3, 2, 0), Point(3, 3, 0), Point(3, 4, 0), Point(3, 5, 0), Point(3, 6, 0), Point(3, 7, 0), Point(3, 8, 0), Point(3, 9, 0), Point(3, 10, 0), Point(3, 11, 0), Point(3, 12, 0)], {1;1;5}: [Point(4, 0, 0), Point(4, 1, 0), Point(4, 2, 0), Point(4, 3, 0), Point(4, 4, 0), Point(4, 5, 0), Point(4, 6, 0), Point(4, 7, 0), Point(4, 8, 0), Point(4, 9, 0), Point(4, 10, 0), Point(4, 11, 0), Point(4, 12, 0)], {1;1;6}: [Point(5, 0, 0), Point(5, 1, 0), Point(5, 2, 0), Point(5, 3, 0), Point(5, 4, 0), Point(5, 5, 0), Point(5, 6, 0), Point(5, 7, 0), Point(5, 8, 0), Point(5, 9, 0), Point(5, 10, 0), Point(5, 11, 0), Point(5, 12, 0)], {1;1;7}: [Point(6, 0, 0), Point(6, 1, 0), Point(6, 2, 0), Point(6, 3, 0), Point(6, 4, 0), Point(6, 5, 0), Point(6, 6, 0), Point(6, 7, 0), Point(6, 8, 0), Point(6, 9, 0), Point(6, 10, 0), Point(6, 11, 0), Point(6, 12, 0)], {1;1;8}: [Point(7, 0, 0), Point(7, 1, 0), Point(7, 2, 0), Point(7, 3, 0), Point(7, 4, 0), Point(7, 5, 0), Point(7, 6, 0), Point(7, 7, 0), Point(7, 8, 0), Point(7, 9, 0), Point(7, 10, 0), Point(7, 11, 0), Point(7, 12, 0)], {1;1;9}: [Point(8, 0, 0), Point(8, 1, 0), Point(8, 2, 0), Point(8, 3, 0), Point(8, 4, 0), Point(8, 5, 0), Point(8, 6, 0), Point(8, 7, 0), Point(8, 8, 0), Point(8, 9, 0), Point(8, 10, 0), Point(8, 11, 0), Point(8, 12, 0)]))
viewer_19 = ParamViewer(pt_19)
# Match Tree
viewer_20 = ParamViewer(pt_20)
match = MatchTree(Tree=pt_20, Guide=pt_19)
viewer_21 = ParamViewer(match)

# ----
# Path Compare
path_2 = ConstructPath(Indices=replace)  # -> flatten(Branch)
panel_45 = Panel(path_2)
compare = PathCompare(Path=path_2, Mask="{0;*;0}")
panel_46 = Panel(compare)

# ----
# Replace Paths
data_18 = Data(Tree({0;0;0}: [Point(0.5, 0.5, 0), Point(0.5, 1.5, 0), Point(0.5, 2.5, 0), Point(0.5, 3.5, 0)], {0;0;1}: [Point(1.5, 0.5, 0), Point(1.5, 1.5, 0), Point(1.5, 2.5, 0), Point(1.5, 3.5, 0)], {0;0;2}: [Point(2.5, 0.5, 0), Point(2.5, 1.5, 0), Point(2.5, 2.5, 0), Point(2.5, 3.5, 0)]))
panel_47 = Panel(data_16)
tstat_2 = TreeStatistics(Tree=data_18)  # -> Paths, Length, Count
panel_48 = Panel(tstat_2.Paths)
item_2 = ListItem(List=tstat_2.Paths, Index=Slider(0, range=0..2), Wrap=True)
tstat_3 = TreeStatistics(Tree=data_16)  # -> Paths, Length, Count
panel_49 = Panel("{0;0;3}")
panel_50 = Panel(tstat_3.Paths)
replace_2 = ReplacePaths(Data=data_18, Search=item_2, Replace="{0;0;1}")
dpath = DeconstructPath(Branch=tstat_3.Paths)
panel_51 = Panel(replace_2)
panel_52 = Panel(dpath)
# Path Mapper
P = Plane([PlaneXY(0, 0, 0), Plane(origin=(13, 12, 0), x=(0.9363291776, 0.3511234416, 0), y=(-0.3511234416, 0.9363291776, 0))])

# ----
# check this out for more information
# https://www.grasshopper3d.com/forum/topics/datatree-selection-rules
# Split Tree
# Integers: *  Any number of integers in a path
# ?  Any single integer
# 6  Any specific integer
# !6  Anything except a specific integer
# < 4  Any number smaller than X.
# <= 8  Any number equal to or smaller than X.
# > 10  Any number larger than X.
# >= 5  Any number larger than or equal to X.
# 
# (2,6,7)  Any one of the specific integers in this group.
# !(2,6,7)  Anything except one of the integers in this group.
# Range: (2 to 20)  Any integer in this range (including both 2 and 20).
# 
# !(2 to 20) Any integer outside this range.
# Sequence: (0,2,...)  Any integer part of this infinite sequence.
# 
# (0,2,...,48)  Any integer part of this finite sequence.
# 
# !(3,5,...)  Any integer not part of this infinite sequence.
# 
# !(7,10,21,...,425)  Any integer not part of this finite sequence
# check this out for more information
# https://www.grasshopper3d.com/forum/topics/relative-items-for-two-data
# Relative Item
# check this video for more information
# https://vimeo.com/78886857
# Advanced Topics in Grasshopper
P_2 = Plane(PlaneXY(0, 0, 0))
P_3 = Plane(PlaneXY(0, 0, 0))
sqgrid = Square(
    Plane=[Plane(origin=(19.48960619, 9.831369346, 0), x=(0.9904882431, -0.1375973844, 0), y=(0.1362494828, 0.9807854373, 0.1396280928)), Plane(origin=(28.12589177, 7.271014581, 0), x=(0.9976303284, -0.06880209162, 0), y=(0.06880209162, 0.9976303284, 0))],
    Size=1,
    ExtentX=5,
    ExtentY=5)  # -> Cells, simplify(Points)
panel_53 = Panel("{?;(0,2,...)}")
panel_54 = Panel("{?;(0 to 4)}")
panel_55 = Panel("{?;(>3)}")
panel_56 = Panel("{?;(1 to 4) and !3}")
panel_57 = Panel("{?;!3}")
panel_58 = Panel("{?;(0,2,...)}[0,2,...]")
panel_59 = Panel("{?;(0,2,3,...,10)}")
panel_60 = Panel("{*}[3]")
sqgrid_2 = Square(Plane=P_2, Size=1, ExtentX="8", ExtentY="12")  # -> Cells, simplify(Points)
sqgrid_3 = Square(Plane=P_3, Size=1, ExtentX="8", ExtentY="12")  # -> Cells, simplify(Points)
viewer_22 = ParamViewer(sqgrid.Points)
split = SplitTree(Data=sqgrid.Points, Masks=flatten("{?;3}"))  # -> Positive, Negative
pt_21 = Point(sqgrid_2.Points)
panel_61 = Panel("""{+1}(+1)
{+1}(-1)
{+1}(0)
{0}(+1)""")
panel_62 = Panel("{+1}[+1]")
pt_22 = Point(sqgrid_3.Points)
points_2 = PointList(Points=sqgrid.Points, Size=Slider(0.6, range=0..10))
relitem = RelativeItem(Tree=pt_21, Offset=panel_61, WrapPaths=Toggle(False), WrapItems=Toggle(False))  # -> ItemA, ItemB
viewer_23 = ParamViewer(split.Negative)
viewer_24 = ParamViewer(split.Positive)
split_2 = SplitTree(Data=pt_22, Masks=flatten("{0,2,...}[>3 and <9]"))  # -> Positive, Negative
ln = Line(StartPoint=relitem.ItemA, EndPoint=relitem.ItemB)
preview = CustomPreview(
    Geometry=split_2.Positive,
    Material={diffuse=RGB(221, 160, 221), emission=RGB(66, 48, 66), shine=0.5, specular=RGB(255, 255, 255), transparency=0})

panel_63 = Panel("""0
30""")
# NOTATION-BASED OPERATIONS
# Data Tree general notation
# { 0;0;0 } [ 0 ]
# curly brackets / semicolon
panel_64 = Panel("branch")
sqgrid_4 = Square(Plane=P, Size=1, ExtentX="8", ExtentY="12")  # -> Cells, simplify(Points)
series = Series(Start=panel_63, Step=1, Count="5")  # -> simplify(Series)
series_2 = Series(Start=0, Step=1, Count="102")
pt_23 = Point(sqgrid_4.Points)
graft_2 = GraftTree(Tree=series, IncludeEmptyLists=True, IncludeNullItems=True)
viewer_25 = ParamViewer(pt_23)
panel_65 = Panel(series_2)
# square brackets
panel_66 = Panel("item")
# check this out for more information
# https://www.grasshopper3d.com/forum/topics/path-mapper-help-1?id=2985220%3ATopic%3A215842&page=1#comments
path_mapper = PathMapper(pt_23, source="{A;B}(i)", target="{A;i}(B)")
path_mapper_2 = PathMapper(graft_2, source="{A;B}", target="{path_index}")
viewer_26 = ParamViewer(graft_2)
path_mapper_3 = PathMapper(panel_65, source="{A;B}(i)", target="(i\5)")
path_mapper_4 = PathMapper(panel_65, source="{A;B}(i)", target="(floor(i/5))")
viewer_27 = ParamViewer(path_mapper)
viewer_28 = ParamViewer(path_mapper_2)
# { 0;0;0 } ( 0 )
# or
# curly brackets / semicolon
panel_67 = Panel("branch")
panel_68 = Panel(path_mapper_4)
panel_69 = Panel(path_mapper_2)
# parentheses
panel_70 = Panel("item")
