# Grasshopper definition 01_a_Mesh Structure + Topology.gh (Grasshopper 1.0.7)
# Copyright: Co-de-iT
# plug-ins: MeshEdit Components, Weaverbird, Kangaroo2 Components

# ---- group: surface to low-poly mesh
# mesh structure and topology
srf = Surface(<surface referenced from the Rhino model>)
mesh_uv = MeshSurface(Surface=srf, UCount="2", VCount="2", Overhang=True, Equalize=False)

# ----
# low-poly to strips
# choose from the list below and see how taopology changes affect strips generation
number_slider = Slider(6, range=0..8)
mesh = Mesh(<mesh referenced from the Rhino model>)
mesh_2 = Mesh(<mesh referenced from the Rhino model>)
mesh_3 = Mesh(<mesh referenced from the Rhino model>)
mesh_4 = Mesh(<mesh referenced from the Rhino model>)
mesh_5 = Mesh(<mesh referenced from the Rhino model>)
mesh_6 = Mesh(<mesh referenced from the Rhino model>)
mesh_7 = Mesh(<mesh referenced from the Rhino model>)
mesh_8 = Mesh(<mesh referenced from the Rhino model>)
mesh_9 = Mesh(<mesh referenced from the Rhino model>)
filter = StreamFilter(
    Gate=number_slider,
    Stream0=mesh_7,
    Stream1=mesh,
    Stream2=mesh_2,
    Stream3=mesh_8,
    Stream4=mesh_3,
    Stream5=mesh_4,
    Stream6=mesh_5,
    Stream7=mesh_6,
    Stream8=mesh_9)
mesh_10 = Mesh(mesh_uv)
demesh = DeconstructMesh(Mesh=mesh_10)  # -> Vertices, Faces, Colours, Normals
mesh_11 = Mesh(filter)

# ---- group: rearrange vertices by face / gets face vertices indexes
deface = DeconstructFace(Face=demesh.Faces)  # -> CornerA, CornerB, CornerC, CornerD

# ----
Y = UnitY(Factor="-500")

# ---- group: normals
amp = Amplitude(Vector=demesh.Normals, Amplitude=Slider(30, range=1..50))
# normals
vdisex = VectorDisplayEx(Point=demesh.Vertices, Vector=amp, Colour=RGB(0, 0, 0), Width=2)

# ----
yz = YZPlane(Origin=demesh.Vertices)

# ---- group: generate indexes for a list of any data
python = GhPythonScript(D=demesh.Vertices)  # -> i; inputs D: list
# ---------- python: Python ----------
__author__ = "Alessio"
__version__ = "2019.10.28"

import rhinoscriptsyntax as rs

indexes = []

for k in range(len(D)):
    indexes.append(k)

i = indexes
# ---------- end python ----------

# ----
wbcatmullclark = WeaverbirdsCatmullClarkSubdivision(MeshCurves=mesh_11, Level=Slider(2, range=1..3), SmoothNakedEdges=Slider(2, range=0..2))
move = Move(Geometry=mesh_10, Motion=Y)  # -> Geometry, Transform

# ---- group: rearrange vertices by face
merge = Merge(Data1=graft(deface.CornerA), Data2=graft(deface.CornerB), Data3=graft(deface.CornerC), Data4=graft(deface.CornerD))
item = ListItem(List=demesh.Vertices, Index=merge, Wrap=True)

# ----
number_slider_2 = Slider(500, range=0..1000)
# faces
faces = Panel(demesh.Faces)
# move te slider to change rotation in the corresponding face (or input directly the face indexes you want to change) and notice how the strip pattern is affected
number_slider_3 = Slider(0, range=0..3)
# vertices
dots = DotDisplay(Point=demesh.Vertices, Colour=ColourSwatch(SwatchColor=RGB(255, 0, 212)), Size="3")
# vertices indices
tag = TextTag3D(
    Location=yz,
    Text=python,
    Size=Slider(15, range=0..20),
    Colour=ColourSwatch(SwatchColor=RGB(255, 255, 255)),
    Justification=9)

# ---- group: show face direction
avr = Average(Input=item)
# Q = quad face (4 vertices)
# T = tri face (3 vertices)
# 
# {A;B;C;D}
# 
# A,B,C,D - index of face vertices (order matters)
scale = Scale(Geometry=item, Center=avr, Factor=0.5)  # -> Geometry, Transform
shift = ShiftList(List=scale.Geometry, Shift=1, Wrap=True)
vec2pt = Vector2Pt(PointA=scale.Geometry, PointB=shift, Unitize=False)  # -> Vector, Length
vdisex_2 = VectorDisplayEx(Point=scale.Geometry, Vector=vec2pt.Vector, Colour=ColourSwatch(SwatchColor=RGB(0, 204, 255)), Width="1")

# ----
X = UnitX(Factor=number_slider_2)
move_2 = Move(Geometry=wbcatmullclark, Motion=X)  # -> Geometry, Transform
mesh_12 = Mesh(move_2.Geometry)
medges = MeshEdges(Mesh=mesh_12)  # -> NakedEdges, InteriorEdges, NonManifoldEdges
move_3 = Move(Geometry=mesh_12, Motion=X)  # -> Geometry, Transform
mesh_13 = Mesh(move_3.Geometry)
preview = CustomPreview(Geometry=[medges.NakedEdges, medges.InteriorEdges], Material=ColourSwatch(SwatchColor=RGB(0, 0, 0)))
turn = MeshTurn(Mesh=mesh_13)
number_slider_4 = Slider(0.1, range=0..1)
stripper = Stripper(Mesh=mesh_13)
stripper_2 = Stripper(Mesh=turn)
X_2 = UnitX(Factor=Slider(500, range=0..1000))
lng = ListLength(List=stripper)
lng_2 = ListLength(List=stripper_2)
wheel = ColourWheel(
    lng,
    ColourGrips_Style=10,
    ColourGrips_Grip=[3.271833651, 2.094395102, 4.188790205, 3.141592654],
    ColourGrips_Lum=[0.4076577994, 0.8560592894],
    ColourGrips_Range=[0.591533094, 0.591533094, 0.591533094, 0.591533094],
    ColourGrips_Sat=[0.3946826674, 0.8346297896])
wheel_2 = ColourWheel(
    lng_2,
    ColourGrips_Style=10,
    ColourGrips_Grip=[0, 2.094395102, 4.188790205, 3.141592654],
    ColourGrips_Lum=[0.4076577994, 0.8560592894],
    ColourGrips_Range=[0.591533094, 0.591533094, 0.591533094, 0.591533094],
    ColourGrips_Sat=[0.3946826674, 0.8346297896])
strthin = StripThinnerer(M=simplify(stripper), o=number_slider_4)  # -> out, Ms, Vvecs; inputs M: Mesh, o: list of Double
# ---------- strthin: C# ----------
                                            /*

  Strip thinnerer
  code (c) Alessio Erioli 2018 - Co-de-iT

  Logic: thinning a mesh strip requires identifying for each vertex its opposite in the short direction
  to do so, it checks whether a vertex and one of his neighbour vertices are connected to the same faces
  then it takes a moving vector towards that vertex and scales it by the offset percentage

  */
    initComp();

    if (M == null) return;
    if (o.Count < 1) return;
    int nV = M.Vertices.Count;
    HashSet<int>[] VFaces = new HashSet<int>[nV];
    Vector3d[] MVecs = new Vector3d[nV];
    int[] vf, vn; // connected faces and neighbours indexes

    // build vertex-connected faces hashset
    for (int i = 0; i < nV; i++){
      VFaces[i] = new HashSet<int>();
      vf = M.Vertices.GetVertexFaces(i);
      for(int j = 0; j < vf.Length; j++){
        VFaces[i].Add(vf[j]);
      }
    }
    // finds neighbour and computes direction
    Vector3d dir;
    int oI = -1;
    for (int i = 0; i < nV; i++){
      if (oI < o.Count - 1) oI++;
      vn = M.Vertices.GetConnectedVertices(i);
      for (int j = 0; j < vn.Length; j++){
        if (VFaces[i].SetEquals(VFaces[vn[j]])){
          dir = Vector3d.Subtract((Vector3d) (Point3d) M.Vertices[vn[j]], (Vector3d) (Point3d) M.Vertices[i]);
          dir *= o[oI] * 0.5;
          MVecs[i] = dir;
          break;
        }
      }

    }

    // update mesh vertices
    for (int i = 0; i < nV; i++){
      M.Vertices[i] = (Point3f) ((Point3d) M.Vertices[i] + MVecs[i]);
    }

    Ms = M;
    Vvecs = MVecs;
# ---------- strthin: C# additional code ----------
  void initComp()
  {
    Component.Name = "Strip Thinnerer";
    Component.NickName = "StrThin";
    Component.Description = "Thins quad mesh strips - offset value 0-1 \n offset as list";
    Component.Params.Input[0].Name = "Mesh";
    Component.Params.Input[0].Description = "Input Mesh";
    Component.Params.Input[1].Name = "offset";
    Component.Params.Input[1].Description = "offset (0-1) as list";
    Component.Params.Output[0].Name = "Mesh strip";
    Component.Params.Output[0].Description = "thinned mesh strip";

  }
# ---------- end strthin ----------
strthin_2 = StripThinnerer(M=simplify(stripper_2), o=number_slider_4)  # -> out, Ms, Vvecs; inputs M: Mesh, o: list of Double; same code as strthin
demesh_2 = DeconstructMesh(Mesh=mesh_10)  # -> Vertices, Faces, Colours, Normals
lng_3 = ListLength(List=demesh_2.Normals)
mcol = MeshColours(Mesh=graft(strthin.Ms), Colours=graft(wheel))  # -> simplify(Mesh)
mcol_2 = MeshColours(Mesh=graft(strthin_2.Ms), Colours=graft(wheel_2))  # -> simplify(Mesh)
random = Random(Range="-100 to 100", Number=lng_3, Seed=2)
X_3 = UnitX(Factor=number_slider_2)
X_4 = UnitX(Factor="300")
multiplication = Multiplication(A=demesh_2.Normals, B=random)
move_4 = Move(Geometry=mcol, Motion=X_3)  # -> Geometry, Transform
medges_2 = MeshEdges(Mesh=mcol_2)  # -> NakedEdges, InteriorEdges, NonManifoldEdges
X_5 = UnitX(Factor="-300")
addition = Addition(A=multiplication, B=X_4)
medges_3 = MeshEdges(Mesh=move_4.Geometry)  # -> NakedEdges, InteriorEdges, NonManifoldEdges
move_5 = Move(Geometry=mesh_10, Motion=X_5)  # -> Geometry, Transform
preview_2 = CustomPreview(Geometry=medges_2.NakedEdges, Material=ColourSwatch(SwatchColor=RGB(0, 0, 0)))
move_6 = Move(Geometry=demesh_2.Vertices, Motion=addition)  # -> Geometry, Transform
preview_3 = CustomPreview(Geometry=medges_3.NakedEdges, Material=ColourSwatch(SwatchColor=RGB(0, 0, 0)))
tri = Triangulate(Mesh=move_5.Geometry)  # -> Mesh, Count
ln = Line(StartPoint=demesh_2.Vertices, EndPoint=move_6.Geometry)
panel = Panel("""10
10""")

# ---- group: construct mesh
conmesh = ConstructMesh(Vertices=move_6.Geometry, Faces=demesh_2.Faces)

# ----
medges_4 = MeshEdges(Mesh=tri.Mesh)  # -> NakedEdges, InteriorEdges, NonManifoldEdges
demesh_3 = DeconstructMesh(Mesh=tri.Mesh)  # -> Vertices, Faces, Colours, Normals
dash = DashPattern(Curve=ln, Pattern=panel)  # -> Dashes, Gaps
panel_2 = Panel(demesh_3.Faces)
panel_3 = Panel("""10
10""")
# TOPOLOGY INVARIANT: Deformed mesh
# 
# Same number of vertices and array of faces, different vertices position.
# 
# In other words:
# 
# . SAME TOPOLOGY
# . DIFFERENT GEOMETRY
medges_5 = MeshEdges(Mesh=conmesh)  # -> NakedEdges, InteriorEdges, NonManifoldEdges
# GEOMETRY INVARIANT: Triangulated mesh
# 
# Same vertices, just different array of faces.
# 
# In other words:
# 
# . SAME GEOMETRY
# . DIFFERENT TOPOLOGY
ln_2 = Line(StartPoint=demesh.Vertices, EndPoint=demesh_3.Vertices)
dash_2 = DashPattern(Curve=ln_2, Pattern=panel_3)  # -> Dashes, Gaps

# ---- group: adjust faces for strip direction
demesh_4 = DeconstructMesh(Mesh=move.Geometry)  # -> Vertices, Faces, Colours, Normals
lng_4 = ListLength(List=demesh_4.Faces)
deface_2 = DeconstructFace(Face=demesh_4.Faces)  # -> CornerA, CornerB, CornerC, CornerD
repeat = RepeatData(Data="0", Length=lng_4)
merge_2 = Merge(
    Data1=graft(deface_2.CornerA),
    Data2=graft(deface_2.CornerB),
    Data3=graft(deface_2.CornerC),
    Data4=graft(deface_2.CornerD))  # -> simplify(Result)
replace = ReplaceItems(List=repeat, Item="1", Indices=number_slider_3, Wrap=False)
before = Panel(demesh_4.Faces)

# ---- group: adjust faces for strip direction / filters duplicate values
c_script = CSharpScript(i=merge_2)  # -> F; inputs i: list of Int32
# ---------- c_script: C# ----------
    List < int> iTemp = new List<int>(i);
    if (i[2] == i[3]) iTemp.RemoveAt(3);

    F = iTemp;
# ---------- end c_script ----------

# ---- group: adjust faces for strip direction (continued)
shift_2 = ShiftList(List=c_script, Shift=graft(replace), Wrap=True)  # -> simplify(List)

# ---- group: adjust faces for strip direction / generate face array from indices
c_script_2 = CSharpScript(i=shift_2)  # -> flatten(F); inputs i: list of Int32
# ---------- c_script_2: C# ----------
    if (i.Count < 3 || i.Count > 4) return;
    String face;
    if (i.Count == 3 || i[2] == i[3])
    {
      face = String.Format("{0}{{{1};{2};{3}}}", "T", i[0], i[1], i[2]);
    }
    else
    {
      face = String.Format("{0}{{{1};{2};{3};{4}}}", "Q", i[0], i[1], i[2], i[3]);
    }
    F = face;
# ---------- end c_script_2 ----------

# ---- group: adjust faces for strip direction (continued)
after = Panel(c_script_2)
conmesh_2 = ConstructMesh(Vertices=demesh_4.Vertices, Faces=c_script_2)

# ----
move_7 = Move(Geometry=conmesh_2, Motion=X_2)  # -> Geometry, Transform
wbcatmullclark_2 = WeaverbirdsCatmullClarkSubdivision(MeshCurves=[move.Geometry, move_7.Geometry], Level="3", SmoothNakedEdges="2")
turn_2 = MeshTurn(Mesh=wbcatmullclark_2)
stripper_3 = Stripper(Mesh=turn_2)
lng_5 = ListLength(List=stripper_3)
wheel_3 = ColourWheel(
    lng_5,
    ColourGrips_Style=10,
    ColourGrips_Grip=[0, 2.094395102, 4.188790205, 3.141592654],
    ColourGrips_Lum=[0.4076577994, 0.8560592894],
    ColourGrips_Range=[0.591533094, 0.591533094, 0.591533094, 0.591533094],
    ColourGrips_Sat=[0.3946826674, 0.8346297896])
mcol_3 = MeshColours(Mesh=graft(stripper_3), Colours=graft(wheel_3))  # -> simplify(Mesh)
medges_6 = MeshEdges(Mesh=mcol_3)  # -> NakedEdges, InteriorEdges, NonManifoldEdges
# GEOMETRY INVARIANT: Changing vertex rotation in faces
# 
# Same vertices, same array of faces, different vertex ORDER.
# 
# In other words:
# 
# . SAME GEOMETRY
# . DIFFERENT TOPOLOGY
preview_4 = CustomPreview(Geometry=medges_6.NakedEdges, Material=ColourSwatch(SwatchColor=RGB(0, 0, 0)))

# ----
# solidify mesh strips
Z = UnitZ(Factor=Slider(400, range=0..1000))
move_8 = Move(Geometry=mesh_13, Motion=Z)  # -> Geometry, Transform
mesh_14 = Mesh(move_8.Geometry)
wboffset = WeaverbirdsOffsetMesh(MeshCurves=mesh_14, Distance=Slider(9.884, range=1..20), OffsetType=0)
merge_3 = Merge(Data1=flatten(mesh_14), Data2=flatten(wboffset))  # -> graft(Result)
X_6 = UnitX(Factor=number_slider_2)
number_slider_5 = Slider(0.15, range=0..1)
move_9 = Move(Geometry=merge_3, Motion=X_6)  # -> Geometry, Transform
turn_3 = MeshTurn(Mesh=merge_3)
stripper_4 = Stripper(Mesh=move_9.Geometry)
stripper_5 = Stripper(Mesh=turn_3)
strthin_3 = StripThinnerer(M=simplify(graft(stripper_5)), o=number_slider_5)  # -> out, Ms, Vvecs; inputs M: Mesh, o: list of Double; same code as strthin
strthin_4 = StripThinnerer(M=simplify(graft(stripper_4)), o=number_slider_5)  # -> out, Ms, Vvecs; inputs M: Mesh, o: list of Double; same code as strthin
pshift = ShiftPaths(Data=strthin_3.Ms, Offset=-1)
pshift_2 = ShiftPaths(Data=strthin_4.Ms, Offset=-1)

# ---- group: bridges strips
strbridge = StripBridger(meshes=pshift)

strbridge_2 = StripBridger(meshes=pshift_2)

# ----
mesh_15 = Mesh(strbridge)
mesh_16 = Mesh(strbridge_2)
mjoin = MeshJoin(Meshes=mesh_15)
medges_7 = MeshEdges(Mesh=[strbridge, strbridge_2])  # -> NakedEdges, InteriorEdges, NonManifoldEdges
mjoin_2 = MeshJoin(Meshes=mesh_16)
weldvertices = MeshWeldVertices(Mesh=mjoin, Tolerance=0.01)  # -> RuntimeMessage, Mesh
weldvertices_2 = MeshWeldVertices(Mesh=mjoin_2, Tolerance=0.01)  # -> RuntimeMessage, Mesh
preview_5 = CustomPreview(Geometry=medges_7.NakedEdges, Material=ColourSwatch(SwatchColor=RGB(255, 255, 255)))
unifynormals = MeshUnifyNormals(Mesh=weldvertices.Mesh)
unifynormals_2 = MeshUnifyNormals(Mesh=weldvertices_2.Mesh)
mesh_17 = Mesh(flatten(unifynormals))
mesh_18 = Mesh(flatten(unifynormals_2))
lng_6 = ListLength(List=mesh_17)
lng_7 = ListLength(List=mesh_18)
wheel_4 = ColourWheel(
    lng_7,
    ColourGrips_Style=10,
    ColourGrips_Grip=[3.271833651, 2.094395102, 4.188790205, 3.141592654],
    ColourGrips_Lum=[0.4076577994, 0.8560592894],
    ColourGrips_Range=[0.591533094, 0.591533094, 0.591533094, 0.591533094],
    ColourGrips_Sat=[0.3946826674, 0.8346297896])
wheel_5 = ColourWheel(
    lng_6,
    ColourGrips_Style=10,
    ColourGrips_Grip=[0, 2.094395102, 4.188790205, 3.141592654],
    ColourGrips_Lum=[0.4076577994, 0.8560592894],
    ColourGrips_Range=[0.591533094, 0.591533094, 0.591533094, 0.591533094],
    ColourGrips_Sat=[0.3946826674, 0.8346297896])
mcol_4 = MeshColours(Mesh=graft(mesh_18), Colours=graft(wheel_4))  # -> simplify(Mesh)
mcol_5 = MeshColours(Mesh=graft(mesh_17), Colours=graft(wheel_5))  # -> simplify(Mesh)

# ==== cluster StripBridger: Generates sides for offset meshes topologically divided in the same strips
meshes = ClusterInput()  # Meshes in strips for start and offset mesh
flip = FlipMatrix(Data=meshes)
mesh = Mesh(flip)
c_script = CSharpScript(M=flip)  # -> simplify(graft(P)); inputs M: Mesh
# ---------- c_script: C# ----------
    P = M.GetNakedEdges();
# ---------- end c_script ----------
path_mapper = PathMapper(c_script, source=["{A;B;C}(i)", "{A;B}(i)"], target=["{A;C}(B)", "{A;i}"])
f_sbpath = SerialBranchPath(T=path_mapper, i=Slider(24, range=0..63))  # -> P, D; inputs T: tree, i: Int32
# ---------- f_sbpath: C# ----------
                                            /*
    froGH - a sparse collection of (in)utilities for Grasshopper

    Serial Branch Path
    code by Alessio Erioli

    froGH by Co-de-iT is licensed under a Creative Commons Attribution 4.0 International License.
    http://creativecommons.org/licenses/by/4.0/

    */

    initComp();


    if (T.BranchCount > 0){
      int ind = i % T.BranchCount;
      P = T.Path(ind);
      D = T.Branches[ind];
    }
# ---------- f_sbpath: C# additional code ----------
  void initComp(){
    Component.Name = "Serial Branch Path";
    Component.NickName = "f_SBPath";
    Component.Description = "Retrieves the data tree path and data for a specific branch serial index";
    Component.Params.Input[0].Name = "Tree";
    Component.Params.Input[0].Description = "the data tree";
    Component.Params.Input[1].Name = "index";
    Component.Params.Input[1].Description = "serial index of branch to sample";
    Component.Params.Output[0].Name = "Path";
    Component.Params.Output[0].Description = "the tree branch path";
    Component.Params.Output[1].Name = "Data";
    Component.Params.Output[1].Description = "the tree branch content";
  }
# ---------- end f_sbpath ----------
item = ListItem(List=path_mapper, Index=0, Wrap=True)  # -> Item, Item1
explode = Explode(Curve=item.Item1, Recursive=True)  # -> Segments, Vertices
explode_2 = Explode(Curve=item.Item, Recursive=True)  # -> Segments, Vertices
cull_i = CullIndex(List=explode_2.Vertices, Indices="-1", Wrap=True)
cull_i_2 = CullIndex(List=explode.Vertices, Indices="-1", Wrap=True)
points = PointList(Points=cull_i)  # disabled
points_2 = PointList(Points=cull_i_2)  # disabled
item_2 = ListItem(List=cull_i, Index=0, Wrap=True)
cp = ClosestPoint(Point=item_2, Cloud=cull_i_2)  # -> ClosestPoint, CPIndex, Distance
shift = ShiftList(List=cull_i_2, Shift=cp.CPIndex, Wrap=True)
item_3 = ListItem(List=cull_i, Index="1", Wrap=True)
cp_2 = ClosestPoint(Point=item_3, Cloud=shift)  # -> ClosestPoint, CPIndex, Distance
rev = ReverseList(List=shift)
equals = Equality(FirstNumber=cp_2.CPIndex, SecondNumber="1")  # -> Equality, Inequality
shift_2 = ShiftList(List=rev, Shift="-1", Wrap=True)
weave = Weave(Pattern=equals.Inequality, Stream0=shift, Stream1=shift_2, NullGaps=False)
f_mbridge = MeshBridge(Pa=cull_i, Pb=weave, S="1", W=Toggle(True))  # -> simplify(M); inputs Pa: list of Point3d, Pb: list of Point3d, S: Int32, W: Boolean
# ---------- f_mbridge: C# ----------
           /*
    froGH - a sparse collection of (in)utilities for Grasshopper

    Mesh Bridge

    code by Alessio Erioli

    froGH by Co-de-iT is licensed under a Creative Commons Attribution 4.0 International License.
    http://creativecommons.org/licenses/by/4.0/

    */

    initComp();

    Mesh mesh = new Mesh();
    Mesh mFace = new Mesh();
    if (Pa.Count != Pb.Count) {
      Print("Pa and Pb MUST have the same number of points");
    }else{
      Point3d[][] pts = new Point3d[S + 1][];
      pts[0] = Pa.ToArray();
      pts[S] = Pb.ToArray();
      for (int i = 1; i < S; i++){
        pts[i] = new Point3d[Pa.Count];
        for (int j = 0; j < Pa.Count; j++){
          Vector3d v = Vector3d.Subtract((Vector3d) Pb[j], (Vector3d) Pa[j]);
          v = Vector3d.Divide(v, S);
          pts[i][j] = Point3d.Add(pts[i - 1][j], v);
        }
      }

      for (int i = 0; i < pts.Length - 1; i++){

        for(int j = 0; j < pts[i].Length; j++){
          mFace = new Mesh();
          int ind = (j + 1) % pts[i].Length;
          mFace.Vertices.Add(pts[i][j]);
          mFace.Vertices.Add(pts[i][ind]);
          mFace.Vertices.Add(pts[i + 1][ind]);
          mFace.Vertices.Add(pts[i + 1][j]);
          mFace.Faces.AddFace(0, 1, 2, 3);
          mesh.Append(mFace);
        }

      }
    }
    if(mesh != null && W) mesh.Weld(0.01);
    M = mesh;
# ---------- f_mbridge: C# additional code ----------
  void initComp(){
    Component.Name = "Mesh Bridge";
    Component.NickName = "f_MBridge";
    Component.Description = "Builds a Mesh Bridge between lists of points";
    Component.Params.Input[0].Name = "Points A";
    Component.Params.Input[0].Description = "the first set of points";
    Component.Params.Input[1].Name = "Points B";
    Component.Params.Input[1].Description = "the second set of points";
    Component.Params.Input[2].Name = "Subdivisions";
    Component.Params.Input[2].Description = "n. of subdivisions";
    Component.Params.Input[3].Name = "Wrap";
    Component.Params.Input[3].Description = "consider points as a closed loop (boolean)";
    Component.Params.Output[0].Name = "Mesh";
    Component.Params.Output[0].Description = "The output Mesh";
  }
# ---------- end f_mbridge ----------
path_mapper_2 = PathMapper(f_mbridge, source=["{A;B}", "{A}"], target=["{A}", "{A}"])
merge = Merge(Data1=simplify(mesh), Data2=path_mapper_2)
thickened_mesh_strips = ClusterOutput(merge)
