# Grasshopper definition 01_b_triangle topology subdiv.gh (Grasshopper 1.0.7)
# Copyright: Co-de-iT
# plug-ins: MeshEdit Components, Weaverbird, Kangaroo2 Components

# File template
# 
# © a3 2019 _ Creative Commons Attribution-NonCommercial-ShareAlike3.0 UnportedLicense.
pipeline = GeometryPipeline(
    GroupByLayer=False,
    GroupByType=False,
    IncludeHidden=True,
    IncludeLocked=True,
    LayerFilter="mesh",
    NameFilter="*",
    SublayerFiltering=True,
    TypeFilter=32)
brep = Brep(<brep referenced from the Rhino model>)
debrep = DeconstructBrep(Brep=brep)  # -> Faces, Edges, Vertices
mesh_uv = MeshSurface(Surface=debrep.Faces, UCount=Slider(2, range=1..5), VCount=Slider(1, range=1..5), Overhang=True, Equalize=False)
mjoin = MeshJoin(Meshes=mesh_uv)
weldvertices = MeshWeldVertices(Mesh=mjoin, Tolerance=0.01)  # -> RuntimeMessage, Mesh
unifynormals = MeshUnifyNormals(Mesh=weldvertices.Mesh)
merge = Merge(Data1=pipeline, Data2=flatten(unifynormals))  # -> graft(Result)
demesh = DeconstructMesh(Mesh=merge)  # -> Vertices, Faces, Colours, Normals
bbox = BoundingBox(Content=merge, Plane=PlaneXY(0, 0, 0))  # -> Box, Box_2
pt = Point(demesh.Vertices)
boxprop = BoxProperties(Box=bbox.Box)  # -> Center, Diagonal, Area, Volume, Degeneracy
avr = Average(Input=demesh.Vertices)
dots = DotDisplay(Point=pt, Colour=ColourSwatch(SwatchColor=RGB(255, 255, 255)), Size=1)
number_slider = Slider(0.3, range=0..1)
number_slider_2 = Slider(100, range=0..200)
multiplication = Multiplication(A=boxprop.Diagonal, B="0.5")
subtraction = Subtraction(A=boxprop.Center, B=multiplication)
scale = Scale(Geometry=merge, Center=avr, Factor=number_slider)  # -> simplify(Geometry), Transform
multiplication_2 = Multiplication(A=boxprop.Diagonal, B=number_slider, C=Slider(1.2, range=1..2))
X = UnitX(Factor=number_slider_2)
panel = Panel("""2
1
3""")
devec = DeconstructVector(Vector=multiplication_2)  # -> XComponent, YComponent, ZComponent
move = Move(Geometry=subtraction, Motion=X)  # -> Geometry, Transform
wbcatmullclark = WeaverbirdsCatmullClarkSubdivision(MeshCurves=scale.Geometry, Level=panel, SmoothNakedEdges="2")  # -> simplify(OutputMeshCurves)
wbcatmullclark_2 = WeaverbirdsCatmullClarkSubdivision(MeshCurves=scale.Geometry, Level=panel, SmoothNakedEdges="0")  # -> simplify(OutputMeshCurves)
wbcatmullclark_3 = WeaverbirdsCatmullClarkSubdivision(MeshCurves=scale.Geometry, Level=panel, SmoothNakedEdges="1")  # -> simplify(OutputMeshCurves)
recgrid = Rectangular(Plane=move.Geometry, SizeX=devec.XComponent, SizeY=devec.YComponent, ExtentX="3", ExtentY="3")  # -> simplify(Cells), Points
path_mapper = PathMapper([wbcatmullclark_2, wbcatmullclark_3, wbcatmullclark], source=["{A}", "{A;B}"], target=["{A}", "{A}"])
pshift = ShiftPaths(Data=recgrid.Cells, Offset=-1)
pt_2 = Point(recgrid.Points)
pcen = PolygonCenter(Polyline=pshift)  # -> CenterV, CenterE, CenterA
orient = Orient(Geometry=path_mapper, Source=avr, Target=pcen.CenterV)  # -> Geometry, Transform
medges = MeshEdges(Mesh=orient.Geometry)  # -> NakedEdges, InteriorEdges, NonManifoldEdges

# ---- group: for baking
mesh = Mesh(orient.Geometry)

# ----
X_2 = UnitX(Factor=number_slider_2)
turn = MeshTurn(Mesh=orient.Geometry)
preview = CustomPreview(Geometry=[medges.InteriorEdges, medges.NakedEdges], Material=ColourSwatch(SwatchColor=RGB(0, 0, 0)))
preview_2 = CustomPreview(Geometry=mesh, Material=ColourSwatch(SwatchColor=RGB(255, 255, 255)))
move_2 = Move(Geometry=turn, Motion=X_2)  # -> Geometry, Transform
stripper = Stripper(Mesh=orient.Geometry)
stripper_2 = Stripper(Mesh=move_2.Geometry)
move_3 = Move(Geometry=stripper, Motion=X_2)  # -> Geometry, Transform
move_4 = Move(Geometry=stripper_2, Motion=X_2)  # -> Geometry, Transform
mesh_2 = Mesh(move_3.Geometry)
mesh_3 = Mesh(move_4.Geometry)
medges_2 = MeshEdges(Mesh=move_3.Geometry)  # -> NakedEdges, InteriorEdges, NonManifoldEdges
medges_3 = MeshEdges(Mesh=move_4.Geometry)  # -> NakedEdges, InteriorEdges, NonManifoldEdges
area = MeshArea(Mesh=mesh_2)  # -> Area, Centroid
area_2 = MeshArea(Mesh=mesh_3)  # -> Area, Centroid
preview_3 = CustomPreview(Geometry=medges_3.NakedEdges, Material=ColourSwatch(SwatchColor=RGB(53, 112, 106)))
preview_4 = CustomPreview(Geometry=medges_2.NakedEdges, Material=ColourSwatch(SwatchColor=RGB(86, 153, 50)))
bnd = Bounds(Numbers=area.Area)
bnd_2 = Bounds(Numbers=area_2.Area)
dedomain = DeconstructDomain(Domain=bnd)  # -> Start, End
dedomain_2 = DeconstructDomain(Domain=bnd_2)  # -> Start, End
gradient = Gradient(
    LowerLimit=dedomain.Start,
    UpperLimit=dedomain.End,
    Parameter=area.Area,
    stops=[0: RGB(0, 98, 0), 0.25: RGB(81, 175, 17), 0.5: RGB(159, 198, 146), 0.75: RGB(170, 235, 41), 1: RGB(221, 255, 53)])
gradient_2 = Gradient(
    LowerLimit=dedomain_2.Start,
    UpperLimit=dedomain_2.End,
    Parameter=area_2.Area,
    stops=[0: RGB(0, 97, 97), 0.25: RGB(18, 176, 176), 0.5: RGB(147, 189, 199), 0.75: RGB(40, 235, 173), 1: RGB(54, 255, 148)])
mcol = MeshColours(Mesh=graft(mesh_2), Colours=graft(gradient))
mcol_2 = MeshColours(Mesh=graft(mesh_3), Colours=graft(gradient_2))
