# Grasshopper definition Util-04_Anemone run, turntable and capture.gh (Grasshopper 1.0.7)
# plug-ins: Anemone, Weaverbird

mesh = Mesh(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)
n_iterations_frames = Slider(150, range=0..200)
# Anemone run, Turntable, and Capture
# 
# generates a turntable animation while Anemone runs and saves frames for video
# 
# © a3 _/TH.esis 2019 _ Creative Commons Attribution-NonCommercial-ShareAlike3.0 UnportedLicense.
start = BooleanToggle(False)
facen = FaceNormals(Mesh=mesh)  # -> Centers, Normals
pt = Point(simplify(graft(facen.Centers)))
cloud = CloudDisplay(Points=flatten(pt), Colours=ColourSwatch(SwatchColor=RGB(255, 255, 255)), Size="0.5", SpriteType=0)
loop_start = LoopStart(Repeat=n_iterations_frames, Trigger=start, Data=pt)  # -> port, Counter, Data; disabled
division = Division(A=loop_start.Counter, B=n_iterations_frames)
item = ListItem(List=loop_start.Data, Index="-1", Wrap=True)
Z = UnitZ(Factor=Slider(-0.25, range=-1..0))
move = Move(Geometry=item, Motion=Z)  # -> Geometry, Transform
wbcatmullclark = WeaverbirdsCatmullClarkSubdivision(MeshCurves=mesh, Level=1, SmoothNakedEdges=2)
meshcp = MeshClosestPoint(Point=move.Geometry, Mesh=wbcatmullclark)  # -> Point, Index, Parameter
merge = Merge(Data1=loop_start.Data, Data2=simplify(meshcp.Point))
running = Running(port=loop_start.port, Exit=False, Data=simplify(merge), TimeOutVal=0, pausedState=False, state="Constant output")
pline = PolyLine(Vertices=running, Closed=False)
preview = CustomPreview(Geometry=pline, Shader=ColourSwatch(SwatchColor=RGB(255, 255, 255)))
num = Number(division)

# ---- group: geometry for turntable
geo = Geometry(mesh)

# ---- group: camera parameters / camera plane
xy = XYPlane(Origin=Point(0, 0, 0))

# ---- group: camera parameters
distance_multiplier = Slider(3.099, range=1..10)
lens_min = Panel("21")
lens_max = Panel("120")
lens = Slider(0, range=0..1)

# ----
direction = ValueList({"CCW": 0, "CW": 1}, selected="CCW")

adjust_start_point = Slider(0.112, range=0..1)
slide_camera_plane_along_z = Slider(0, range=-100..300)
slide_target_plane_along_z = Slider(0, range=-100..100)

activate_camera = BooleanToggle(True)
bbox = BoundingBox(Content=geo, Plane=PlaneXY(0, 0, 0), UnionBox=True)  # -> Box, Box_2
merge_2 = Merge(Data1=lens_min, Data2=lens_max)
boxprop = BoxProperties(Box=bbox.Box)  # -> Center, Diagonal, Area, Volume, Degeneracy
num_2 = Number(merge_2)
devec = DeconstructVector(Vector=boxprop.Diagonal)  # -> XComponent, YComponent, ZComponent
interp = InterpolateData(Data=num_2, Parameter=lens, Interpolation=2)
max = Maximum(A=devec.XComponent, B=devec.YComponent)

# ---- group: compensate lens/distance
expression = Expression(d=max, dm=distance_multiplier, l=interp, lmin=lens_min, lMax=lens_max, Expression="d*dm*(l/((lMax+lmin)*0.5))")

# ----
lens_used = Panel(interp)
pl_origin = PlaneOrigin(Base=xy, Origin=boxprop.Center)
deplane = DeconstructPlane(Plane=pl_origin)  # -> Origin, XAxis, YAxis, ZAxis
amp = Amplitude(Vector=deplane.ZAxis, Amplitude=slide_camera_plane_along_z)
amp_2 = Amplitude(Vector=deplane.ZAxis, Amplitude=slide_target_plane_along_z)
move_2 = Move(Geometry=pl_origin, Motion=amp)  # -> Geometry, Transform
move_3 = Move(Geometry=boxprop.Center, Motion=amp_2)  # -> Geometry, Transform
cir = Circle(Plane=move_2.Geometry, Radius=expression)
seam = Seam(Curve=reparameterize(cir), Seam=adjust_start_point)
flip = FlipCurve(Curve=seam)  # -> Curve, Flag
filter = StreamFilter(Gate=direction, Stream0=seam, Stream1=flip.Curve)
eval = EvaluateCurve(Curve=reparameterize(filter), Parameter=num)  # -> Point, Tangent, Angle
c_script = CSharpScript(location=eval.Point, target=move_3.Geometry, lens=interp, up=deplane.ZAxis, run=activate_camera)  # inputs location: Point3d, target: Point3d, lens: Double, up: Vector3d, run: Boolean
# ---------- c_script: C# usings ----------
using System.IO;
using System.Linq;
using System.Data;
using System.Drawing;
using System.Reflection;
using System.Windows.Forms;
using System.Xml;
using System.Xml.Linq;
using System.Runtime.InteropServices;

using Rhino.DocObjects;
using Rhino.Collections;
using GH_IO;
using GH_IO.Serialization;
# ---------- c_script: C# ----------
    Component.Message = "Set Camera";

    if (run){
      //Get current viewport
      vp = Rhino.RhinoDoc.ActiveDoc.Views.ActiveView.ActiveViewport;
      //Set new camera
      vp.SetCameraLocations(target, location);
      vp.CameraUp = up;
      vp.ChangeToPerspectiveProjection(true, lens);
    }
# ---------- c_script: C# additional code ----------
  //To get and set camera properties
  Rhino.Display.RhinoViewport vp;
# ---------- end c_script ----------
bool = Boolean(start)
list = ValueList({"Viewport": 0, "1920x1080": 1}, selected="1920x1080")
grid = BooleanToggle(False)
axes = BooleanToggle(False)
widget = BooleanToggle(False)
f_pathg = PathGenerator(subDir="Animation")  # -> dir; inputs type: Int32, subDir: String
# ---------- f_pathg: C# ----------
                           /*
    froGH - a sparse collection of (in)utilities for Grasshopper

    Path Generator
    code by Alessio Erioli - value list generation based on code by James Ramsden

    froGH by Co-de-iT is licensed under a Creative Commons Attribution 4.0 International License.
    http://creativecommons.org/licenses/by/4.0/

    */
    initComp();


    String S = "";
    String root = "";
    String end = "\\";
    String eol = Environment.NewLine;

    // __________________ autoList part __________________

    // variable for the list
    Grasshopper.Kernel.Special.GH_ValueList vList;
    // tries to cast input as list
    try{

      // if the list is not the first parameter then change Input[0] to the corresponding value
      vList = (Grasshopper.Kernel.Special.GH_ValueList) Component.Params.Input[0].Sources[0];
      // Print("value list connected");
      // check if the list must be created
      //if (vList.NickName != "dir type"){
      if (!vList.NickName.Equals("dir type")){
        vList.ClearData();
        vList.ListItems.Clear();
        vList.NickName = "dir type";
        var item1 = new Grasshopper.Kernel.Special.GH_ValueListItem("desktop", "0");
        var item2 = new Grasshopper.Kernel.Special.GH_ValueListItem("documents", "1");
        var item3 = new Grasshopper.Kernel.Special.GH_ValueListItem("GH file path", "2");
        var item4 = new Grasshopper.Kernel.Special.GH_ValueListItem("C:", "3");
        vList.ListItems.Add(item1);
        vList.ListItems.Add(item2);
        vList.ListItems.Add(item3);
        vList.ListItems.Add(item4);

        vList.ListItems[0].Value.CastTo(out type);
      }
    }
    catch{
      // handles anything that is not a value list
    }


    switch(type){
      case 0:
        root = Environment.GetFolderPath(Environment.SpecialFolder.Desktop) + end;
        S = "Desktop";
        break;
      case 1:
        root = Environment.GetFolderPath(Environment.SpecialFolder.MyDocuments) + end;
        S = "Documents";
        break;
      case 2:
        GH_Document ghDoc = owner.OnPingDocument();

        if (ghDoc.IsFilePathDefined)
        {
          int nameLen = ghDoc.DisplayName.TrimEnd('*').Length + 3; // +3 accounts for the '.gh' extension
          int fileLen = ghDoc.FilePath.TrimEnd('*').Length;

          //F = ghDoc.DisplayName.TrimEnd('*');
          root = ghDoc.FilePath.Substring(0, fileLen - nameLen);
          //root = gh_d.FilePath;
          S = "GH File path";
        }
        else
        {
          Print("No path defined. Saving to Desktop until then");
          root = Environment.GetFolderPath(Environment.SpecialFolder.Desktop);
          S = "Desktop";
        }
        break;
      case 3:
        root = "C:" + end;
        S = root + end;
        break;
    }
    dir = root + (subDir != null ? (subDir + end) : "");
    Component.Message = S;
# ---------- f_pathg: C# additional code ----------
  void initComp(){
    Component.Name = "Path Generator";
    Component.NickName = "f_PathG";
    Component.Description = "generates a path based on local direcories such as Desktop, Documents, GH file path";
    Component.Params.Input[0].Name = "dir type";
    Component.Params.Input[0].Description = "directory type: 0 desktop, 1 documents, 2 GH file path, 3 C:\nconnect a value list for automatic list generation";
    Component.Params.Input[1].Name = "custom subdir";
    Component.Params.Input[1].Description = "(optional) custom subdirectory";
  }
# ---------- end f_pathg ----------
# View Capture
data = Data(eval.Point)
# To record an animation make sure this object executes last, and that the destination directory already exists.
# 
# Use a variable that updates as a trigger.
c_script_2 = CSharpScript(
    Dir=f_pathg,
    Name="Viewport {0}.png",
    VP="Perspective",
    Capture=bool,
    size=list,
    grid=grid,
    axes=axes,
    widget=widget,
    Trigger=data)  # -> out, A; inputs Dir: String, Name: String, VP: String, Capture: Boolean, size: Int32, grid: Boolean, axes: Boolean, widget: Boolean
# ---------- c_script_2: C# ----------
   /*
  View Capture
  Original code by David Rutten
  Minor adaptations by Alessio Erioli - Co-de-iT - 2020
  
  */
   
    if (!Capture) return;
    if (string.IsNullOrWhiteSpace(Dir)) return;
    if (string.IsNullOrWhiteSpace(Name)) return;

    // Make sure the directory ends with a \
    if (!Dir.EndsWith(System.IO.Path.DirectorySeparatorChar.ToString()))
      Dir += System.IO.Path.DirectorySeparatorChar;

    // Do not create directories, only use existing ones.
    if (!System.IO.Directory.Exists(Dir))
      return;

    // Assume index=0 for the first filename.
    string fileName = Dir + string.Format(Name, 0.ToString("D3"));

    // Try to increment the index until we find a name which doesn't exist yet.
    if (System.IO.File.Exists(fileName))
      for (int i = 1; i < int.MaxValue; i++)
      {
        string localName = Dir + string.Format(Name, i.ToString("D3"));
        if (localName == fileName)
          return;

        if (!System.IO.File.Exists(localName))
        {
          fileName = localName;
          break;
        }
      }

    Size sz = new Size(1920, 1080);

    Rhino.Display.RhinoView view = RhinoDocument.Views.Find(VP, false);
    Bitmap image;
    switch(size)
    {
      case 0:
        image = view.CaptureToBitmap(grid, widget, axes);
        break;
      case 1:
        image = view.CaptureToBitmap(sz, grid, widget, axes);
        break;
      default:
        image = view.CaptureToBitmap(grid, widget, axes);
        break;
    }
    A = image.Width;
    image.Save(fileName);
    image.Dispose();

    A = fileName;
# ---------- end c_script_2 ----------
panel = Panel(c_script_2.A)
