# Grasshopper definition bitmaps in CS.gh (Grasshopper 1.0.7)
# Copyright: Co-de-iT
# plug-ins: MeshEdit Components, Noise 4D

number_slider = Slider(200, range=10..500)
number_slider_2 = Slider(400, range=10..500)
f_ghfilepath = GHFilePathInfo()  # -> F, P
# ---------- f_ghfilepath: C# ----------
                                      /*
    froGH - a sparse collection of (in)utilities for Grasshopper

    GH File and Path info

    code by Alessio Erioli

    froGH by Co-de-iT is licensed under a Creative Commons Attribution 4.0 International License.
    http://creativecommons.org/licenses/by/4.0/

    */

    initComp();

    GH_Document ghDoc = Grasshopper.Instances.ActiveCanvas.Document;

    int nameLen = ghDoc.DisplayName.TrimEnd('*').Length + 3; // +3 accounts for the '.gh' extension
    int fileLen = ghDoc.FilePath.TrimEnd('*').Length;

    F = ghDoc.DisplayName.TrimEnd('*');
    P = ghDoc.FilePath.Substring(0, fileLen - nameLen);
# ---------- f_ghfilepath: C# additional code ----------
  void initComp(){

    Component.Name = "GH File Path Info";
    Component.NickName = "f_GHFilePath";
    Component.Description = "Provides info on current Grasshopper Document file name and path\nUseful for exporting files with the same name as the gh file and in the same directory";
    Component.Params.Output[0].Name = "File Name";
    Component.Params.Output[0].Description = "Current GH file name";
    Component.Params.Output[1].Name = "File Path";
    Component.Params.Output[1].Description = "Current GH file path";
  }
# ---------- end f_ghfilepath ----------
neg = Negative(Value=number_slider_2)
concat = Concatenate(FragmentA=f_ghfilepath.P, FragmentB="the Dude.jpeg")
sqgrid = Square(Plane=PlaneXY(0, 0, 0), Size=1, ExtentX=expr("x-1", number_slider), ExtentY=expr("x-1", number_slider_2))  # -> Cells, flatten(Points)
Y = UnitY(Factor=neg)
# mesh from loaded bitmap
c_script = CSharpScript(path=concat, N=Slider(200, range=10..500), a=Slider(33, range=0..100))  # -> out, M; inputs path: String, N: Int32, a: Double
# ---------- c_script: C# usings ----------
using System.Drawing;
# ---------- c_script: C# ----------
    if (!System.IO.File.Exists(path))
      throw new ArgumentException("File does not exist");

    Bitmap dude = new Bitmap(path);
    Bitmap b = new Bitmap(dude, N, N);

    int nX = b.Width - 1;
    int nY = b.Height - 1;
    Interval dX = new Interval(0, nX);
    Interval dY = new Interval(0, nY);
    Mesh Me = Mesh.CreateFromPlane(Plane.WorldXY, dX, dY, nX, nY);

    Color[] colors = new Color[Me.Vertices.Count];
    for (int i = 0; i < Me.Vertices.Count; i++)
    {
      Point3f vertex = Me.Vertices[i];
      int x = (int) vertex.X;
      int y = (int) vertex.Y;
      colors[i] = b.GetPixel(x, y);
      Me.Vertices.SetVertex(i, vertex.X, vertex.Y, colors[i].GetBrightness() * a);

    }

    
    Me.VertexColors.SetColors(colors);
    Me.Transform(Transform.Rotation(Math.PI, Point3d.Origin));
    //Me.Transform(Transform.Translation(new Vector3d(-200, 0, 0)));

    M = Me;
# ---------- end c_script ----------
# Bitmaps in C#
# 
# © a3 _/TH.esis 2019 _ Creative Commons Attribution-NonCommercial-ShareAlike3.0 UnportedLicense.
# mesh from generated bitmap
c_script_2 = CSharpScript(N=Slider(200, range=10..500), a=Slider(33, range=0..100), f=Slider(0.069, range=0..1), p=Slider(2.421, range=1..5))  # -> out, M; inputs N: Int32, a: Double, f: Double, p: Double
# ---------- c_script_2: C# ----------
    Bitmap b = new Bitmap(N, N);


    for (int i = 0; i < N; i++)
      for (int j = 0; j < N; j++)
        b.SetPixel(i, j, Color.FromArgb(255, (int) (i * 255.0 / N), (int) (j * 255.0 / N), (int) ((N - i) * 255.0) / N));

    int nX = b.Width - 1;
    int nY = b.Height - 1;
    Interval dX = new Interval(0, nX);
    Interval dY = new Interval(0, nY);
    Mesh Me = Mesh.CreateFromPlane(Plane.WorldXY, dX, dY, nX, nY);

    Color[] colors = new Color[Me.Vertices.Count];
    for (int i = 0; i < Me.Vertices.Count; i++)
    {
      Point3f vertex = Me.Vertices[i];
      int x = (int) vertex.X;
      int y = (int) vertex.Y;
      colors[i] = b.GetPixel(x, y);
      Me.Vertices.SetVertex(i, vertex.X, vertex.Y, Math.Sin(i * f * 0.01) * a * Math.Pow(colors[i].R  / 255.0, p));

    }

    Me.VertexColors.SetColors(colors);


    M = Me;
# ---------- end c_script_2 ----------
move = Move(Geometry=sqgrid.Points, Motion=Y)  # -> Geometry, Transform
perlin = PerlinNoise(Values=sqgrid.Points, Time=0, Scale=Slider(0.02, range=0..0.05))
gradient = Gradient(LowerLimit="-1", UpperLimit=1, Parameter=perlin, stops=[0: RGB(0, 0, 0), 1: RGB(255, 255, 255)])
frompoints = MeshFromPoints(Points=move.Geometry, UDirection=number_slider, VDirection=number_slider_2, Colour=gradient)
# NOTE: Mesh should have a matrix type topology (vertex arranged in a UxV manner), but it does not need to be flat
f_ghfilepath_2 = GHFilePathInfo()  # -> F, P; same code as f_ghfilepath
# save .jpg bitmap from mesh
c_script_3 = CSharpScript(M=frompoints, U=number_slider, V=number_slider_2, path=f_ghfilepath_2.P, fileName="noisePic3", save=Button())  # -> out; inputs M: Mesh, U: Int32, V: Int32, path: String, fileName: String, save: Boolean
# ---------- c_script_3: C# usings ----------
using System.Drawing;
using System.Drawing.Imaging;
# ---------- c_script_3: C# ----------
    // from: https://docs.microsoft.com/en-us/dotnet/api/system.drawing.image.save?view=netframework-4.7.2
    
    Bitmap bitmap = BitmapFromMesh(M, U, V);

    ImageCodecInfo myImageCodecInfo;
    Encoder myEncoder;
    EncoderParameter myEncoderParameter;
    EncoderParameters myEncoderParameters;
    String savePath = path + fileName + ".jpg";

    // Get an ImageCodecInfo object that represents the JPEG codec.
    myImageCodecInfo = GetEncoderInfo("image/jpeg");

    // Create an Encoder object based on the GUID

    // for the Quality parameter category.
    myEncoder = Encoder.Quality;

    // Create an EncoderParameters object.

    // An EncoderParameters object has an array of EncoderParameter
    // objects. In this case, there is only one
    // EncoderParameter object in the array.
    myEncoderParameters = new EncoderParameters(1);

    // Save the bitmap as a JPEG file with quality level 100.
    myEncoderParameter = new EncoderParameter(myEncoder, 100L);
    myEncoderParameters.Param[0] = myEncoderParameter;
    if (save)
    {
      if (System.IO.File.Exists(savePath))
        throw new ArgumentException("File already exist, cannot overwrite");
      bitmap.Save(savePath, myImageCodecInfo, myEncoderParameters);
    }
# ---------- c_script_3: C# additional code ----------
  public Bitmap BitmapFromMesh(Mesh M, int X, int Y)
  {
    Bitmap bitmap = new Bitmap(X, Y);

    for (int i = 0; i < X; i++)
      for(int j = 0; j < Y; j++)
        bitmap.SetPixel(i, Y - 1 - j, M.VertexColors[i * Y + j]); // Y-1-j compensates for the y coordinate inversion
    return bitmap;
  }

  public static ImageCodecInfo GetEncoderInfo(String mimeType)
  {
    int j;
    ImageCodecInfo[] encoders;
    encoders = ImageCodecInfo.GetImageEncoders();
    for(j = 0; j < encoders.Length; ++j)
    {
      if(encoders[j].MimeType == mimeType)
        return encoders[j];
    }
    return null;
  }
# ---------- end c_script_3 ----------
panel = Panel(c_script_3)
