# Grasshopper definition CS_00_intro.gh (Grasshopper 1.0.7)
# Copyright: Co-de-iT

# Rhino/GH
# https://developer.rhino3d.com/ - Rhino developer home page
# 
# https://developer.rhino3d.com/api/ - API references
# 
# http://developer.rhino3d.com/guides/rhinocommon/what-is-rhinocommon/
# 
# https://developer.rhino3d.com/api/RhinoCommon - RhinoCommon SDK
# 
# https://developer.rhino3d.com/api/grasshopper - Grasshopper SDK
# C# component
# warning/error messages
# and results of Print() function
# outputs
# inputs
# double-click
# to open editor
# right-click to
# set output name
# 
# zoom in
# to add or remove
# right-click to
# set input name,
# type and structure
# 
# zoom in
# to add or remove
c_script = CSharpScript()  # -> Out, A
# CS_00_intro
# 
# C# - intro definition
# 
# © a3 _/TH.esis 2020 _ Creative Commons Attribution-NonCommercial-ShareAlike3.0 UnportedLicense.
# https://msdn.microsoft.com/en-gb/library/67ef8sbd.aspx - C# programming guide
# not Hello World (but sort of)
panel = Panel("<input your name>")
# sum of 2 numbers
number_slider = Slider(25.915, range=0..100)
# create Point
number_slider_2 = Slider(47.361, range=0..100)
# create Polyline/NURBS curve
number_slider_3 = Slider(0, range=0..100)
pt = Point([Point(-10.44971177, -16.09633362, 0), Point(-38.18687341, 24.18943046, 0), Point(-4.694320715, 66.12353854, 0), Point(62.94356935, 64.88826719, 0), Point(85.96513356, 6.512157948, 0), Point(67.87676168, -34.18667877, 0)])
c_script_2 = CSharpScript(P=pt, deg=Slider(3, range=1..5), periodic=Toggle(False))  # -> out, Pl, C; inputs P: list of Point3d, deg: Int32, periodic: Boolean
# ---------- c_script_2: C# ----------
    Pl = new Polyline(P);
    C = NurbsCurve.Create(periodic, deg, P);
# ---------- end c_script_2 ----------
c_script_3 = CSharpScript(A=number_slider, B=Slider(63.292, range=0..100))  # -> out, S; inputs A: Double, B: Double
# ---------- c_script_3: C# ----------
    S = A + B;

    Print("The sum of A and B is {0}", A+B);
# ---------- end c_script_3 ----------
c_script_4 = CSharpScript(x=number_slider_2, y=Slider(47.361, range=0..100), z=number_slider_3)  # -> out, A; inputs x: Double, y: Double, z: Double
# ---------- c_script_4: C# ----------
    A = new Point3d(x, y, z);
# ---------- end c_script_4 ----------
c_script_5 = CSharpScript(x=panel, y="<input your age>")  # -> out, A
# ---------- c_script_5: C# ----------
    Print("Hello {0}, 'tis a fine day to learn C#!\n\nAnd at the tender age of {1}!", x, y);
# ---------- end c_script_5 ----------
# C#
panel_2 = Panel(c_script_5.out)
panel_3 = Panel(c_script_3.out)
panel_4 = Panel(c_script_3.S)
pt_2 = Point(c_script_4.A)
crv = Curve(c_script_2.Pl)
crv_2 = Curve(c_script_2.C)
