# Grasshopper definition CS_04_1_gradient descent-erosion.gh (Grasshopper 1.0.7)
# Copyright: Co-de-iT
# plug-ins: Weaverbird

number_slider = Slider(40, range=2..100)
srf = Surface(reparameterize(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))
mesh_uv = MeshSurface(Surface=srf, UCount=number_slider, VCount=number_slider, Overhang=True, Equalize=False)
wbloop = WeaverbirdsLoopSubdivision(MeshCurves=mesh_uv, Level=1, SmoothNakedEdges=0)
# CS_04_gradient descent
# 
# gradient desccent algorithm
# 
# © a3 _/TH.esis 2020 _ Creative Commons Attribution-NonCommercial-ShareAlike3.0 UnportedLicense.
number_slider_2 = Slider(50, range=2..100)

demesh = DeconstructMesh(Mesh=mesh_uv)  # -> Vertices, Faces, Colours, Normals
Z = UnitZ(Factor=1)
xprod = CrossProduct(VectorA=demesh.Normals, VectorB=Z, Unitize=False)  # -> Vector, Length
vrot = Rotate(Vector=xprod.Vector, Axis=demesh.Normals, Angle="Pi*0.5")
cluster = Cluster(V=vrot)
vdisex = VectorDisplayEx(Point=demesh.Vertices, Vector=vrot, Colour=cluster, Width=2)

reset = Button()
go = BooleanToggle(False)
# gradient descent + erosion
popgeo = PopulateGeometry(Geometry=wbloop, Count=number_slider_2, Seed="2")

# ---- group: gradient descent
c_script = CSharpScript(
    P=popgeo,
    M=wbloop,
    step=Slider(0.1, range=0..3),
    eInd=Slider(0.08, range=0..1),
    eMax=Slider(1, range=0..5),
    reset=reset,
    go=go)  # -> out, Me, Pos, Trails; inputs P: list of Point3d, M: Mesh, step: Double, eInd: Double, eMax: Double, reset: Boolean, go: Boolean
# ---------- c_script: C# usings ----------
using Rhino.Collections;
# ---------- c_script: C# ----------
    if (reset || er == null)
    {
      er = new ErosionSim(M, P, step);
      pts = new Point3d[P.Count];
      trs = new Polyline[P.Count];

    }


    if (go)
    {
      // updates our Particles (only if they are alive)
      er.maxSpeed = step;
      er.erosionIndex = eInd;
      er.erosionMax = eMax;

      er.update();
      //foreach(Particle a in parts) if (a.alive) a.update(M1, step, eInd, eMax);

      // expiring solution forces the component to update
      Component.ExpireSolution(true);
    }

    // extracts positions and trails
    for(int i = 0; i < er.parts.Count; i++)
    {
      pts[i] = er.parts[i].pos;
      trs[i] = er.parts[i].trail;
    }

    Pos = pts;
    Trails = trs;
    Me = er.extractMesh();
# ---------- c_script: C# additional code ----------
  // persistent variables
  Point3d[] pts;
  Polyline[] trs;
  //Mesh M1;
  //Point3dList p1;
  ErosionSim er;

  public class ErosionSim
  {
    public List<Particle> parts;
    public double erosionIndex;
    public double erosionMax;
    public Point3dList p1;
    public Mesh M;
    public Mesh Morig;
    public double maxSpeed;

    public ErosionSim(Mesh M, List<Point3d> pts, double maxSpeed)
    {
      this.M = M;
      Morig = new Mesh();
      Morig.CopyFrom(M);
      this.maxSpeed = maxSpeed;
      p1 = new Point3dList(M.Vertices.ToPoint3dArray());
      initParts(pts);
    }

    // initialization function
    public void initParts(List<Point3d> P)
    {
      // clears lists
      parts = new List<Particle>();

      // initializes lists
      foreach(Point3d p in P) parts.Add(new Particle(this, p));
    }

    public void update()
    {
      foreach(Particle pa in parts)
        pa.update();
      
      for(int i = 0; i < p1.Count; i++)
        M.Vertices.SetVertex(i, p1[i]);
      
      M.RebuildNormals();
    }

    public Mesh extractMesh()
    {
      return M;
    }

  }



  // Particle class

  public class Particle // in this case public is unnecessary but in the general case it is
  {

    // fields
    public Point3d pos;
    public Vector3d vel;
    public Polyline trail;
    public bool alive;
    public ErosionSim er;

    // constructor (public if we use it from RunScript)
    public Particle(ErosionSim er, Point3d pos){
      this.er = er;
      this.pos = pos;
      vel = Vector3d.Zero;
      trail = new Polyline();
      trail.Add(pos);
      alive = true;
    }

    // methods

    public void update()
    {
      calcVel();
      erode();
      move();
    }

    void calcVel()
    {
      // get closest point to the Mesh
      MeshPoint mP = er.M.ClosestMeshPoint(pos, 0.0);
      // evaluate Mesh normal at that point
      Vector3d mN = er.M.NormalAt(mP);
      // find tangent to mesh (perpendicular vector to normal)
      vel = Vector3d.CrossProduct(mN, Vector3d.ZAxis);
      // rotate 90 degrees
      vel.Rotate(Math.PI * 0.5, mN);
      // unitize
      vel.Unitize();
      // set to max speed (step)
      vel *= er.maxSpeed;
    }

    void erode()
    {
      int vi = er.p1.ClosestIndex(pos);
      if(er.M.Vertices[vi].DistanceTo(er.Morig.Vertices[vi]) < er.erosionMax)
      {
        Vector3d disp = -1 * (Vector3d) er.M.Normals[vi] * er.erosionIndex;
        er.p1[vi] += disp;
      }
    }


    void move()
    {
      // calculates new position
      Point3d newPos = pos + vel;
      newPos = er.M.ClosestPoint(newPos);

      // kills particle if it has reached a pit - update if not
      if (Math.Abs(newPos.Z - pos.Z) < 0.01) alive = false;
      else
      {
        pos = newPos;
        trail.Add(pos);
      }
    }

  }
# ---------- end c_script ----------

# ----
dispatch = Dispatch(List=c_script.Me, DispatchPattern=go)  # -> ListA, ListB
crv = Curve(c_script.Trails)
cir = Circle(Plane=c_script.Pos, Radius=0.25)
wbloop_2 = WeaverbirdsLoopSubdivision(MeshCurves=dispatch.ListB, Level=1, SmoothNakedEdges=1)
preview = CustomPreview(
    Geometry=cir,
    Material={diffuse=RGB(221, 160, 221), emission=RGB(66, 48, 66), shine=0.5, specular=RGB(255, 255, 255), transparency=0})
preview_2 = CustomPreview(Geometry=crv, Material=ColourSwatch(SwatchColor=RGB(209, 209, 209)))
preview_3 = CustomPreview(Geometry=[dispatch.ListA, wbloop_2], Material=ColourSwatch(SwatchColor=RGB(46, 64, 76)))

# ==== cluster Cluster
V = ClusterInput()
vlen = VectorLength(Vector=V)
num = Number(vlen)
bnd = Bounds(Numbers=flatten(num))
dom = ConstructDomain(DomainStart=0, DomainEnd=1)
remap = RemapNumbers(Value=num, Source=bnd, Target=dom)  # -> Mapped, Clipped
gradient = Gradient(LowerLimit=0, UpperLimit=1, Parameter=remap.Mapped, stops=[0.206: RGB(143, 143, 143), 1: RGB(0, 0, 0)])
C = ClusterOutput(gradient)
