# Grasshopper definition AgentBodiesOnMesh.gh (Grasshopper 1.0.7)
# Copyright: Co-de-iT
# plug-ins: FileToScript

cs_file_to_sync = Panel("Planes2Bodies.cs")
cs_file_to_sync_2 = Panel("Align Planes-mesh.cs")
dir_type = ValueList({"desktop": 0, "documents": 1, "GH file path": 2, "C:": 3}, selected="GH file path")
f_ghfilepath = GHFilePathInfo()  # -> F, P
# ---------- f_ghfilepath: C# ----------
                                      /*
    froGH - a sparse collection of (in)utilities for Grasshopper

    GH File and Path info

    code by Alessio Erioli

    froGH by Co-de-iT is licensed under a Creative Commons Attribution 4.0 International License.
    http://creativecommons.org/licenses/by/4.0/

    */

    initComp();

    GH_Document ghDoc = Grasshopper.Instances.ActiveCanvas.Document;

    int nameLen = ghDoc.DisplayName.TrimEnd('*').Length + 3; // +3 accounts for the '.gh' extension
    int fileLen = ghDoc.FilePath.TrimEnd('*').Length;

    F = ghDoc.DisplayName.TrimEnd('*');
    P = ghDoc.FilePath.Substring(0, fileLen - nameLen);
# ---------- f_ghfilepath: C# additional code ----------
  void initComp(){

    Component.Name = "GH File Path Info";
    Component.NickName = "f_GHFilePath";
    Component.Description = "Provides info on current Grasshopper Document file name and path\nUseful for exporting files with the same name as the gh file and in the same directory";
    Component.Params.Output[0].Name = "File Name";
    Component.Params.Output[0].Description = "Current GH file name";
    Component.Params.Output[1].Name = "File Path";
    Component.Params.Output[1].Description = "Current GH file path";
  }
# ---------- end f_ghfilepath ----------
f_pathg = PathGenerator(type=dir_type, subDir=f_ghfilepath.F)  # -> dir; inputs type: Int32, subDir: String
# ---------- f_pathg: C# ----------
                           /*
    froGH - a sparse collection of (in)utilities for Grasshopper

    Path Generator
    code by Alessio Erioli - value list generation based on code by James Ramsden

    froGH by Co-de-iT is licensed under a Creative Commons Attribution 4.0 International License.
    http://creativecommons.org/licenses/by/4.0/

    */
    initComp();


    String S = "";
    String root = "";
    String end = "\\";
    String eol = Environment.NewLine;

    // __________________ autoList part __________________

    // variable for the list
    Grasshopper.Kernel.Special.GH_ValueList vList;
    // tries to cast input as list
    try{

      // if the list is not the first parameter then change Input[0] to the corresponding value
      vList = (Grasshopper.Kernel.Special.GH_ValueList) Component.Params.Input[0].Sources[0];
      // Print("value list connected");
      // check if the list must be created
      //if (vList.NickName != "dir type"){
      if (!vList.NickName.Equals("dir type")){
        vList.ClearData();
        vList.ListItems.Clear();
        vList.NickName = "dir type";
        var item1 = new Grasshopper.Kernel.Special.GH_ValueListItem("desktop", "0");
        var item2 = new Grasshopper.Kernel.Special.GH_ValueListItem("documents", "1");
        var item3 = new Grasshopper.Kernel.Special.GH_ValueListItem("GH file path", "2");
        var item4 = new Grasshopper.Kernel.Special.GH_ValueListItem("C:", "3");
        vList.ListItems.Add(item1);
        vList.ListItems.Add(item2);
        vList.ListItems.Add(item3);
        vList.ListItems.Add(item4);

        vList.ListItems[0].Value.CastTo(out type);
      }
    }
    catch{
      // handles anything that is not a value list
    }


    switch(type){
      case 0:
        root = Environment.GetFolderPath(Environment.SpecialFolder.Desktop) + end;
        S = "Desktop";
        break;
      case 1:
        root = Environment.GetFolderPath(Environment.SpecialFolder.MyDocuments) + end;
        S = "Documents";
        break;
      case 2:
        GH_Document ghDoc = owner.OnPingDocument();

        if (ghDoc.IsFilePathDefined)
        {
          int nameLen = ghDoc.DisplayName.TrimEnd('*').Length + 3; // +3 accounts for the '.gh' extension
          int fileLen = ghDoc.FilePath.TrimEnd('*').Length;

          //F = ghDoc.DisplayName.TrimEnd('*');
          root = ghDoc.FilePath.Substring(0, fileLen - nameLen);
          //root = gh_d.FilePath;
          S = "GH File path";
        }
        else
        {
          Print("No path defined. Saving to Desktop until then");
          root = Environment.GetFolderPath(Environment.SpecialFolder.Desktop);
          S = "Desktop";
        }
        break;
      case 3:
        root = "C:" + end;
        S = root + end;
        break;
    }
    dir = root + (subDir != null ? (subDir + end) : "");
    Component.Message = S;
# ---------- f_pathg: C# additional code ----------
  void initComp(){
    Component.Name = "Path Generator";
    Component.NickName = "f_PathG";
    Component.Description = "generates a path based on local direcories such as Desktop, Documents, GH file path";
    Component.Params.Input[0].Name = "dir type";
    Component.Params.Input[0].Description = "directory type: 0 desktop, 1 documents, 2 GH file path, 3 C:\nconnect a value list for automatic list generation";
    Component.Params.Input[1].Name = "custom subdir";
    Component.Params.Input[1].Description = "(optional) custom subdirectory";
  }
# ---------- end f_pathg ----------
concat = Concatenate(FragmentA=f_pathg, FragmentB=cs_file_to_sync)
panel = Panel(concat)
concat_2 = Concatenate(FragmentA=f_pathg, FragmentB=cs_file_to_sync_2)
panel_2 = Panel(concat_2)
path = FilePath(concat_2)
path_2 = FilePath(concat)
# Agent Bodies
# 
# Populate a Mesh with Agent Bodies interacting to form a coherent organization
# 
# code by Alessio Erioli
# 
# v 0.21
# 
# © a3 _/TH.esis 2020 _ Creative Commons Attribution-NonCommercial-ShareAlike3.0 UnportedLicense.
# . build Ms and Mv with Mesh Base Treatment.gh
# 
# . Use the Orient Planes part to define agent population and orientation on your mesh
# 
# . Use the Bodies part to make bodies interact
# 
# . internalize polylines and use with Isosurfacing_Dendro.gh to obtain an isomesh
n_of_planes = Slider(500, range=10..5000)

# ---- group: Ms
mesh = Mesh(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)

# ---- group: Mv
mesh_2 = Mesh(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)

# ----
popgeo = PopulateGeometry(Geometry=mesh, Count=n_of_planes, Seed=1)

# ---- group: display Mesh Vector field
demesh = DeconstructMesh(Mesh=mesh_2)  # -> Vertices, Faces, Colours, Normals
amp = Amplitude(Vector=demesh.Colours, Amplitude=Slider(0.3, range=0..1))
vdisex = VectorDisplayEx(Point=demesh.Vertices, Vector=amp, Colour=ColourSwatch(SwatchColor=RGB(140, 102, 120)), Width="1")

# ----
meshcp = MeshClosestPoint(Point=popgeo, Mesh=mesh)  # -> Point, Index, Parameter
_3d = BooleanToggle(True)
meval = MeshEval(Mesh=mesh, Parameter=meshcp.Parameter)  # -> Point, Normal, Colour
random_vector = CSharpScript(n=n_of_planes, seed="0", DDD=_3d)  # -> out, V; inputs n: Int32, seed: Int32, DDD: Boolean
# ---------- random_vector: C# usings ----------
using System.IO;
using System.Linq;
using System.Data;
using System.Drawing;
using System.Reflection;
using System.Windows.Forms;
using System.Xml;
using System.Xml.Linq;
using System.Runtime.InteropServices;

using Rhino.DocObjects;
using Rhino.Collections;
using GH_IO;
using GH_IO.Serialization;
# ---------- random_vector: C# ----------
    if(seed == 0) rnd = new Random(); else rnd = new Random(seed);
    List <Vector3d> vectors = new List<Vector3d>();
    Vector3d vec = new Vector3d();
    for (int i = 0; i < n; i++){
      vec.X = rnd.NextDouble() - 0.5;
      vec.Y = rnd.NextDouble() - 0.5;
      vec.Z = DDD ? rnd.NextDouble() - 0.5 : 0;
      vec.Unitize();
      vectors.Add(vec);
    }
    V = vectors;
# ---------- random_vector: C# additional code ----------
  Random rnd;
# ---------- end random_vector ----------
unit = UnitVector(Vector=meval.Normal)
conmesh = ConstructMesh(Vertices=demesh.Vertices, Faces=demesh.Faces)
xprod = CrossProduct(VectorA=random_vector.V, VectorB=unit, Unitize=True)  # -> Vector, Length
go = BooleanToggle(False)
pt = Point(popgeo)
vec = Vector(xprod.Vector)
plane_radius = Slider(0.8, range=0..1)
max_force = Slider(0.5, range=0..1)
reset = Button()

# ---- group: orient planes
# legend: P - points
# V - vectors (initial directions)
# Ms - Mesh with scalar values
# Mv - Mesh with vector values
# pR - plane Radius
# cS - cohesion Strength
# aS - alignment Strength
# sS - separation Strength
# fS field Strength
# meR - Mesh seek Radius
# meS - Mesh Strength
# coS - Color Strength
# mF - maxForce
c_script = CSharpScript(
    reset=reset,
    go=go,
    P=pt,
    V=vec,
    Ms=mesh,
    Mv=mesh_2,
    pR=plane_radius,
    nR=Slider(3.479, range=0..5),
    cS=Slider(0.05, range=0..1),
    aS=Slider(0.133, range=0..1),
    sS=Slider(5, range=0..10),
    fS=Slider(0.071, range=0..1),
    meR=Slider(0.309, range=0..1),
    meS=Slider(0.599, range=0..1),
    coS=Slider(0.1, range=0..10),
    mF=max_force)  # -> out, iter, Planes; inputs reset: Boolean, go: Boolean, P: list of Point3d, V: list of Vector3d, Ms: Mesh, Mv: Mesh, pR: Double, nR: Double, cS: Double, aS: Double, sS: Double, fS: Double, meR: Double, meS: Double, coS: Double, mF: Double
# ---------- c_script: C# usings ----------
 
using System.Threading;
using System.Threading.Tasks;
using System.Drawing;
# ---------- c_script: C# ----------
 

        /*
         align planes with mesh field - C#
         code by Alessio Erioli - (c) Co-de-iT 2019 

         NOTE ON CUSTOM BEHAVIORS
        
         If you feel like implementing your custom behaviors: 
         . hit CTRL+F and search for "DBD2020" - you should find 2 more locations (apart from this line)
         . . one location is in the Update() method of the AgentPlaneSimulationClass - uncomment the line to call the CustomBehavior method
         . . the other location is in the CustomAgentBehavior() method of the AgentPlane class - here is where you can write your code
        
         Keep in mind that you are writing a behavior for the single agent, that then will be executed by all agents in the system
        */
        
        if (P == null || P.Count == 0) return;

        if (reset || aPS == null)
        {
            // passing the essential parameters to the new simulation
            aPS = new AgentPlaneSystem(P, V);
            MEnvironment = Ms; // the environment mesh can be either Ms or Mv (color is ignored)
            MeshRTree = RTreeFromMesh(Ms);
            TensorField = TensorFieldFromMeshes(Ms, Mv); // passing scalar and vector data to the Tensor Field

            // initializing arrays for export
            gP = new GH_Plane[aPS.agentPlanes.Length];

            //initialize iterations counter
            iterationsCount = 0;
        }

        if (go)
        {
            // update parameters
            aPS.PlaneRadius = pR;
            aPS.NeighborhoodRadius = nR;
            aPS.CohesionStrength = cS;
            aPS.AlignmentStrength = aS;
            aPS.SeparationStrength = sS;
            aPS.FieldStrength = fS;
            aPS.MeshSeekRadius = meR;
            aPS.MeshStrength = meS;
            aPS.SeekColorStrength = coS;
            aPS.MaxForce = mF;

            // update system
            aPS.Update();

            iterationsCount++;

            Component.ExpireSolution(true);
        }

        // extract output geometries and information

        Parallel.For(0, aPS.agentPlanes.Length, i =>
        {
            // extract planes
            gP[i] = new GH_Plane(aPS.agentPlanes[i].PlaneOut());

        });

        iter = iterationsCount;
        Planes = gP;
# ---------- c_script: C# additional code ----------
 

    // ............................................................ global variables 
    public GH_Plane[] gP;  // contains planes for geometry output

    public AgentPlaneSystem aPS; // agent planes system

    //        __ static means that the global variable can also be accessed from the classes methods
    //       /
    public static TensorPoint[] TensorField; // field of tensor points - contains scalar and vector data
    public static Mesh MEnvironment; // Mesh used as environment for agents (for position only)
    public static RTree MeshRTree; // RTree for fast Mesh search
    public int iterationsCount; // for iterations count

    // .................................................................... classes 
    // .............................................................................
    // .............................................................................



    // ...................................................... Simulation ..........
    // ............................................................................
    // ............................................................................

    public class AgentPlaneSystem
    {
        // ..........................    fields

        //public double cNS;
        //public double cNT;
        public double PlaneRadius;
        public double NeighborhoodRadius;
        public double CohesionStrength;
        public double AlignmentStrength;
        public double SeparationStrength;
        public double FieldStrength;
        public double MaxForce;
        public double MeshSeekRadius;
        public double MeshStrength;
        public double SeekColorStrength;
        public double MaxSpeed;

        public AgentPlane[] agentPlanes;

        // ..........................    constructor

        public AgentPlaneSystem(List<Point3d> P, List<Vector3d> V, double pR, double cI, double aI, double sI, double fI, double mF)
        {

            this.PlaneRadius = pR;
            this.CohesionStrength = cI;
            this.AlignmentStrength = aI;
            this.SeparationStrength = sI;
            this.FieldStrength = fI;
            this.MaxForce = mF;
            this.MaxSpeed = 0.3;

            // build agent planes array
            agentPlanes = new AgentPlane[P.Count];

            Parallel.For(0, P.Count, i =>
            {
                agentPlanes[i] = new AgentPlane(P[i], V[i], this);
            });

        }

        public AgentPlaneSystem(List<Point3d> P, List<Vector3d> V)
        {
            // build agent planes array
            agentPlanes = new AgentPlane[P.Count];
            this.MaxSpeed = 0.1;

            Parallel.For(0, P.Count, i =>
            {
                agentPlanes[i] = new AgentPlane(P[i], V[i], this);
            });

        }

        // ..........................    methods

        public void Update()
        {

            // . . . . . . . . . . environmental and stigmergic interactions

            // calculate field influence vector for agents
            FieldRTree();

            // . . . . . . . . . . peer-to-peer interaction
            FlockRTree();

            // . . . . . . . . . . custom behavior(s) DBD2020
            // CustomBehavior(); // uncomment this line to call agent custom behavior

            // . . . . . . . . . . update position and direction
            UpdateAgentsDirection();

        }

        public void FieldRTree()
        {
            foreach (AgentPlane ag in agentPlanes)
            {
                // clear neighbour list
                ag.neighbours.Clear();
                ag.neighTens.Clear();

                // calculate field vector from mesh
                // Eventhandler function for RTree search
                EventHandler<RTreeEventArgs> rTreeCallback = (object sender, RTreeEventArgs args) =>
                {
                    ag.neighbours.Add(MEnvironment.Vertices[args.Id]);
                    ag.neighTens.Add(TensorField[args.Id]);
                };

                MeshRTree.Search(new Sphere(MEnvironment.ClosestPoint(ag.O), MeshSeekRadius), rTreeCallback);

                // this resets the acceleration (or desired direction)
                // in case a different update sequence is implemented
                // remember to reset desired before calculating the new iteration
                ag.ResetDesired();

                // Other methods
                ag.SeekMeshNeighbours(); // seek Mesh Neighbor points
                // Interact with scalar field (flee dark areas)
                ag.SeekColor();
                // Compute Alignment
                ag.ComputeFieldAlign(ag.ComputeFieldVector());

            }

        }


        public void FlockRTree()
        {
            // declare RTree
            RTree rTree = new RTree();

            // populate RTree
            for (int i = 0; i < agentPlanes.Length; i++)
                rTree.Insert(agentPlanes[i].O, i);

            // find neighbours for each agent
            foreach (AgentPlane agent in agentPlanes)
            {
                List<AgentPlane> neighbours = new List<AgentPlane>();

                EventHandler<RTreeEventArgs> rTreeCallback =
                    (object sender, RTreeEventArgs args) =>
                    {
                        if (agentPlanes[args.Id] != agent)
                            neighbours.Add(agentPlanes[args.Id]);
                    };

                rTree.Search(new Sphere(agent.O, NeighborhoodRadius), rTreeCallback);

                // compute desired vector for each agent
                agent.ComputeDesiredNeighbours(neighbours);
            }

        }

        public void CustomBehavior()
        {
            foreach (AgentPlane ap in agentPlanes)
                ap.CustomAgentBehaviour();

        }

        public void UpdateAgentsDirection()
        {
            // update positions and velocities in parallel
            Parallel.For(0, agentPlanes.Length, i =>
            {
                agentPlanes[i].UpdateDirectionAndPosition();

            });

        }

    }


    // ........................................................... Agent ..........
    // ............................................................................
    // ............................................................................
    /// <summary>
    /// this class contains the Agent Plane definition
    /// </summary>
    public class AgentPlane
    {

        // fields
        public Point3d O;
        public Vector3d X, Y, Z;
        public Vector3d desiredDirection; // desired direction - influenced by environmental field and nearby agents' directions
        public Vector3d desiredPosition; // desired position - influenced by environmental movement constraints (es. surface) and neighbour agents
        public AgentPlaneSystem agentSim;
        public List<Point3d> neighbours;
        public List<TensorPoint> neighTens;

        // constructor
        public AgentPlane(Point3d O, Vector3d dirX, AgentPlaneSystem agentSim)
        {
            this.O = O;
            dirX.Unitize();
            this.X = dirX;
            this.agentSim = agentSim;
            neighbours = new List<Point3d>();
            neighTens = new List<TensorPoint>();
        }
        // methods

        public void UpdateDirectionAndPosition()
        {
            // update position

            Vector3d posUpdate = desiredPosition * agentSim.MaxForce;

            if (posUpdate.Length > agentSim.MaxSpeed)
            {
                posUpdate.Unitize();
                posUpdate *= agentSim.MaxSpeed;
            }
            O += posUpdate;
            // update direction
            X = X * (1 - agentSim.MaxForce) + agentSim.MaxForce * desiredDirection;
            X.Unitize();

        }

        public void ResetDesired()
        {
            desiredDirection = Vector3d.Zero;
            desiredPosition = Vector3d.Zero;
        }

        public void ComputeDesiredNeighbours(List<AgentPlane> neighbours)
        {

            // neighbours interaction
            if (neighbours.Count > 0)
            {

                // ............................ alignment behavior

                // align direction with neighbours
                Vector3d align = Vector3d.Zero;

                foreach (AgentPlane neighbour in neighbours)
                    align += neighbour.X;

                align /= neighbours.Count;

                // updates desired direction
                // multiplies alignment vector by alignment intensity factor
                desiredDirection += agentSim.AlignmentStrength * align;

                // ............................ cohesion behavior
                Vector3d cohesion = Vector3d.Zero;
                foreach (AgentPlane neighbour in neighbours)
                    cohesion += (Vector3d)Point3d.Subtract(neighbour.O, O);

                cohesion /= neighbours.Count;

                // updates desired position
                // multiplies cohesion vector by cohesion intensity factor
                desiredPosition += agentSim.CohesionStrength * cohesion;


                // ............................ separation behavior
                Vector3d separation = Vector3d.Zero;
                int sepCount = 0;
                double sepDistSq = agentSim.PlaneRadius * agentSim.PlaneRadius;
                double distSq;
                foreach (AgentPlane neighbour in neighbours)
                {
                    distSq = O.DistanceToSquared(neighbour.O);
                    if (distSq < sepDistSq)
                    {
                        // separation vector is bigger when closer to another agent
                        separation += (Vector3d)Point3d.Subtract(O, neighbour.O) * (sepDistSq - distSq);
                        sepCount++;
                    }
                }

                if (sepCount > 0)
                    separation /= sepCount;

                // updates desired position
                // multiplies separation vector by separation intensity factor
                desiredPosition += agentSim.SeparationStrength * separation;

            }

        }

        // CUSTOM AGENT BEHAVIOR DBD2020
        public void CustomAgentBehaviour()
        {
            // . . . . . . . insert your custom agent behavior here


            //
        }


        public Vector3d ComputeFieldVector()
        {
            Vector3d fieldVector = Vector3d.Zero;
            if (neighTens.Count > 0)
            {
                foreach (TensorPoint nT in neighTens)
                    fieldVector += nT.vector;

                fieldVector /= neighTens.Count;
            }
            else fieldVector = X;

            return fieldVector;
        }
        public void ComputeFieldAlign(Vector3d fieldVector)
        {
            desiredDirection += fieldVector * agentSim.FieldStrength;
        }

        public void SeekPoint(Point3d target, double intensity)
        {
            Vector3d seek = target - O;
            desiredPosition += seek * intensity;
        }

        //public void SeekMeshClosestPt(Mesh M)
        //{
        //    Point3d mP = M.ClosestPoint(position + velocity * 1.5);
        //    SeekPoint(mP, Agents.MeshStrength);
        //}

        public void SeekMeshNeighbours()
        {
            if (neighbours.Count > 0)
            {

                Point3d average = new Point3d();

                foreach (Point3d n in neighbours)
                    average += n;

                average /= neighbours.Count;

                SeekPoint(average, agentSim.MeshStrength);
            }
        }

        public void SeekColor()
        {

            if (neighTens.Count > 0)
            {
                double bri;
                double MaxBri = -1.0;
                int MaxInd = -1;

                // find point with max intensity
                for (int i = 0; i < neighTens.Count; i++)
                {
                    bri = neighTens[i].scalar; // brightness is 0-1 and RGB 0-255
                    if (bri > MaxBri)
                    {
                        MaxBri = bri;
                        MaxInd = i;
                    }
                }

                if (MaxBri < 0.2) // move away from extra-dark areas - if you modify this value remember 0.2 was the default
                {
                    Vector3d seek = (neighTens[MaxInd].position - O) * 0.08 + neighTens[MaxInd].vector * 0.92;
                    desiredPosition += seek * agentSim.SeekColorStrength;
                }

            }
        }

        public Plane PlaneOut()
        {
            Vector3d oV = new Vector3d(O);
            oV.Unitize();

            Vector3d nV = MEnvironment.NormalAt(MEnvironment.ClosestMeshPoint(O, 100));
            this.Y = Vector3d.CrossProduct(X, nV);
            Vector3d newX = Vector3d.CrossProduct(nV, this.Y);
            return new Plane(O, newX, Y);
        }

    }

    public class TensorPoint
    {
        public Point3d position;
        public Vector3d vector;
        public double scalar;

        public TensorPoint(Point3d position, Vector3d vector, double scalar)
        {
            this.position = position;
            this.vector = vector;
            this.scalar = scalar;
        }
    }

    public RTree RTreeFromMesh(Mesh M)
    {
        return RTree.CreateFromPointArray(M.Vertices.ToPoint3dArray());
    }

    /// <summary>
    /// This method builds a TensorPoint array from two colored Meshes, one TensorPoint for each Mesh vertex.
    /// </summary>
    /// <remarks>
    /// The Mesh colors are converted into 0 to 1 range from brightness for the scalar field and
    /// to a -1.0 to 1.0 range for Vector X, Y, Z coordinate from 0-255 RGB values respectively.
    /// MScalar and MVector must have the same number of vertices (M.Vertices.Count) and indexed identically
    /// The best strategy is to build MScalar and MVector from the same mesh, just assigning different colors:
    /// . a grayscale pattern for MScalar
    /// . an RBG pattern for MVector
    /// </remarks>
    /// <param name="MScalar">Colored Mesh for scalar field</param>
    /// <param name="MVector">Colored Mesh for Vector field</param>
    /// <returns>An array of TensorPoint, its Length equal to the number of vertices in each Mesh and with corresponding indexes.</returns>
    public TensorPoint[] TensorFieldFromMeshes(Mesh MScalar, Mesh MVector)
    {
        TensorPoint[] MeshField = new TensorPoint[MScalar.Vertices.Count];
        TensorPoint tp;


        for (int i = 0; i < MScalar.Vertices.Count; i++)
        {
            tp = new TensorPoint(MScalar.Vertices[i], VectorFromColor(MVector.VertexColors[i]), MScalar.VertexColors[i].GetBrightness());
            MeshField[i] = tp;
        }

        return MeshField;
    }


    // .................................................................. Utilities 
    // .............................................................................
    // 

    /// <summary>
    /// This function converts a 0-255 RGB color into a -1 to 1 Vector3d
    /// </summary>
    /// <param name="col"></param>
    /// <returns>Vector3d in a -1 to 1 range</returns>
    public Vector3d VectorFromColor(Color col)
    {
        Vector3d vCol = new Vector3d();

        vCol = new Vector3d(
          Map(col.R, 0.0, 255.0, -1.0, 1.0),
          Map(col.G, 0.0, 255.0, -1.0, 1.0),
          Map(col.B, 0.0, 255.0, -1.0, 1.0)
          );
        return vCol;
    }

    /// <summary>
    /// This function converts a -1 to 1 Vector3d into a 0-255 RGB color
    /// </summary>
    /// <param name="v"></param>
    /// <returns>GH_Colour in 0-255 range</returns>
    public GH_Colour VectorToColor(Vector3d v)
    {
        v.Unitize();
        int red = (int)Math.Floor(Map((float)v.X, -1f, 1f, 0f, 255f));
        int green = (int)Math.Floor(Map((float)v.Y, -1f, 1f, 0f, 255f));
        int blue = (int)Math.Floor(Map((float)v.Z, -1f, 1f, 0f, 255f));
        return new GH_Colour(Color.FromArgb(red, green, blue));
    }

    /// <summary>
    /// This Function maps a value from a source domain to a destination domain
    /// </summary>
    /// <param name="val">the value</param>
    /// <param name="fromMin">low value of source domain</param>
    /// <param name="fromMax">high value of source domain</param>
    /// <param name="toMin">low value of destination domain</param>
    /// <param name="toMax">high value of destination domain</param>
    /// <returns>the remapped value</returns>
    public double Map(double val, double fromMin, double fromMax, double toMin, double toMax)
    {
        return toMin + (val - fromMin) * (toMax - toMin) / (fromMax - fromMin);
    }
# ---------- end c_script ----------

# ----
ftsv2 = FileToScriptV2(File=path)
generic_messages = Panel(c_script.out)
iterations = Panel(c_script.iter)

# ---- group: movement
ln = Line(StartPoint=pt, EndPoint=c_script.Planes)

# ---- group: planes
pln = Plane(c_script.Planes)

# ---- group: display agent movement vector
vdisex_2 = VectorDisplayEx(Point=pt, Vector=ln, Colour=ColourSwatch(SwatchColor=RGB(255, 0, 0)), Width="1")

# ---- group: display planes orientation arrows
deplane = DeconstructPlane(Plane=c_script.Planes)  # -> Origin, XAxis, YAxis, ZAxis
amp_2 = Amplitude(Vector=deplane.XAxis, Amplitude=Slider(0.979, range=0..1))
vdisex_3 = VectorDisplayEx(Point=deplane.Origin, Vector=amp_2, Colour=RGB(0, 0, 0), Width="1")

# ---- group: display planes as colored meshes
cluster = Cluster(plane=c_script.Planes, plane_radius=plane_radius)
swatch = ColourSwatch(SwatchColor=RGBA(255, 255, 255, 97))
col = Colour(deplane.XAxis)
mcol = MeshColours(Mesh=graft(cluster), Colours=graft(col))

# ---- group: direction analysis mesh
mjoin = MeshJoin(Meshes=flatten(mcol))

# ---- group: push planes into agent bodies part
dam = DataDam(DataA=pln, BufferDelay=10000000, BufferMode=0)

# ----
scale_factor = Slider(2, range=0..3)

# ---- group: body type B
crv = Curve([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])

# ---- group: body type A
crv_2 = Curve([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])

# ----
scale = Scale(Geometry=crv_2, Center=Point(0, 0, 0), Factor=scale_factor)  # -> Geometry, Transform
reset_2 = Button()
go_2 = BooleanToggle(False)
number_slider = Slider(3.314, range=0..5)
pln_2 = Plane(dam)
cir = Circle(Plane=PlaneXY(0, 0, 0), Radius=number_slider)

# ---- group: search radius
crv_3 = Curve(cir)

# ----
orient = Orient(Geometry=scale.Geometry, Source=PlaneXY(0, 0, 0), Target=graft(pln_2))  # -> Geometry, Transform

# ---- group: agent bodies
# legend: sR - agent search radius
# body - body shape (see instructions)
c_script_2 = CSharpScript(reset=reset_2, go=go_2, Pl=pln_2, sR=number_slider, body=scale.Geometry)  # -> out, iter, Bodies, Planes, TipPoints; inputs reset: Boolean, go: Boolean, Pl: list of Plane, sR: Double, body: list of Polyline
# ---------- c_script_2: C# usings ----------
 
using System.Threading;
using System.Threading.Tasks;
using System.Collections.Concurrent;
using System.Drawing;
# ---------- c_script_2: C# ----------
 

        /*
          agent bodies interaction - C#
          code by Alessio Erioli - (c) Co-de-iT 2019 
        */

        // . . . . . . . . . . . . . . . . . . . . . . . . return on null data
        if (Pl == null || body == null) return;

        // variables for data extraction
        DataTree<Polyline> outBodies = new DataTree<Polyline>();
        GH_Plane[] outPlanes = new GH_Plane[Pl.Count];
        List<GH_Point> tipPoints = new List<GH_Point>();

        // . . . . . . . . . . . . . . . . . . . . . . . . initialize system
        if (reset || aBS == null)
        {
            aBS = new AgentBodySystem(Pl, body, sR);
            iterationsCount = 0;
        }


        if (go)
        {
            for (int i = 0; i < 10; i++)
            {
                // update System
                aBS.Update();

                // update iteration counter
                iterationsCount++;
            }
            Component.ExpireSolution(true);
        }


        // . . . . . . . . . . . . . . . . . . . . . . . . extract geometries and data

        for (int i = 0; i < aBS.Agents.Length; i++)
        {
            outBodies.AddRange(aBS.Agents[i].ExtractBody(), new GH_Path(i));
            outPlanes[i] = new GH_Plane(aBS.Agents[i].agentPlane);
            for (int j = 0; j < aBS.Agents[i].body.Tips.Count; j++)
                tipPoints.Add(new GH_Point(aBS.Agents[i].body.Tips[j].pos));
        }

        iter = iterationsCount;
        Bodies = outBodies;
        Planes = outPlanes;
        TipPoints = tipPoints;
# ---------- c_script_2: C# additional code ----------
 

    // global variables
    public AgentBodySystem aBS;
    public int iterationsCount;

    // .................................................................... classes 
    // .............................................................................
    // .............................................................................

    // ...................................................... Simulation ..........
    // ............................................................................
    // ............................................................................
    public class AgentBodySystem
    {
        public AgentBody[] Agents;
        RTree agentsRTree;
        public double searchRadius;
        public double globalDeviation;
        public double deviationThreshold;

        public AgentBodySystem(List<Plane> Pl, List<Polyline> body, double searchRadius)
        {
            Agents = new AgentBody[Pl.Count];
            agentsRTree = new RTree();
            this.searchRadius = searchRadius;
            deviationThreshold = 0.01; // to be implemented in the future (stop when global deviation under this threshold)

            // . . . . . . . . . . . . . . . . . . . . . . . . build agents array & RTree
            // since agents are fixed it can be built in advance
            for (int i = 0; i < Pl.Count; i++)
            {
                Agents[i] = new AgentBody(Pl[i], body);
                agentsRTree.Insert(Agents[i].agentPlane.Origin, i);
            }

            // . . . . . . . . . . . . . . . . . . . . . . . . . . . build neighbours map
            FindNeighbours(this.searchRadius);
            foreach (AgentBody ab in Agents)
                ab.FindTipNeighbour();
        }

        public AgentBodySystem() { }

        public void Update()
        {
            globalDeviation = 0f;

            Parallel.ForEach(Agents, ab =>
            {
                ab.Update();
            });

            // call tips UpdatePosition and UpdateDirection
            Parallel.ForEach(Agents, ab =>
            {
                foreach (Tip t in ab.body.Tips) t.Update();
            });

            // rebuild bodies
            Parallel.ForEach(Agents, ab =>
            {
                ab.RebuildBody();
            });
        }

        public void FindNeighbours(double searchRadius)
        {

            foreach (AgentBody ab in Agents)
            {
                EventHandler<RTreeEventArgs> rTreeCallback = (object sender, RTreeEventArgs args) =>
                {
                    if (Agents[args.Id] != ab)
                        ab.Neighbours.Add(Agents[args.Id]);

                };

                agentsRTree.Search(new Sphere(ab.body.O, searchRadius), rTreeCallback);
            }
        }
    }

    // ...................................................... Agent Body ..........
    // ............................................................................
    // ............................................................................

    public class AgentBody
    {
        public Plane agentPlane;
        public Body body;
        public List<AgentBody> Neighbours;
        public AgentBodySystem ABS;

        public AgentBody(Plane agentPlane, List<Polyline> polylines)
        {
            // define agent body and orient it
            this.agentPlane = agentPlane;
            body = new Body(polylines);
            OrientBody(Plane.WorldXY, this.agentPlane);

            Neighbours = new List<AgentBody>(); // this list will be filled later by the simulation
        }

        public void OrientBody(Plane oldPlane, Plane newPlane)
        {
            var x = Transform.PlaneToPlane(oldPlane, newPlane);

            body.O.Transform(x);

            for (int i = 0; i < body.Arms.Count; i++)
            {
                body.Arms[i].Transform(x);
                body.Tips[i].pos = body.Arms[i][body.Arms[i].Count - 1];
                body.Tips[i].prev = body.Arms[i][body.Arms[i].Count - 2];
            }

        }

        public void RebuildBody()
        {
            for (int i = 0; i < body.Arms.Count; i++)
            {
                body.Arms[i][body.Arms[i].Count - 1] = body.Tips[i].pos;
            }

        }

        public void Update()
        {
            //TipsCohesion();
            TipsCohesionFixed();
        }

        public void FindTipNeighbour()
        {

            double dSqPos, dSqPrev;
            double anglePos, anglePrev;
            double minD;
            foreach (Tip tip in body.Tips)
            {
                minD = 1.0f; //Double.MaxValue; // max Search Radius (squared)
                foreach (AgentBody nearAg in Neighbours)
                {
                    foreach (Tip neighTip in nearAg.body.Tips)
                    {
                        // calculate angles
                        anglePos = Vector3d.VectorAngle(tip.pos - tip.prev, neighTip.pos - tip.pos);
                        anglePrev = Vector3d.VectorAngle(tip.pos - tip.prev, neighTip.prev - tip.pos);
                        if (anglePos < anglePrev && anglePos < tip.angleOfVis)
                        {
                            dSqPos = tip.pos.DistanceToSquared(neighTip.pos);
                            if (dSqPos < minD)
                            {
                                minD = dSqPos;
                                tip.neighbour = neighTip;
                            }
                        }
                        else if (anglePrev < tip.angleOfVis)
                        {
                            dSqPrev = tip.pos.DistanceToSquared(neighTip.prev);
                            if (dSqPrev < minD)
                            {
                                minD = dSqPrev;
                                tip.neighbour = neighTip;
                            }
                        }
                        // calculate distance to prev
                        //dSqPos = tip.pos.DistanceToSquared(neighTip.pos);
                        //dSqPrev = tip.pos.DistanceToSquared(neighTip.prev);
                        //if (dSqPos < minD || dSqPrev < minD)
                        //{
                        //    minD = dSqPos<dSqPrev? dSqPos:dSqPrev;
                        //    tip.neighbour = neighTip;
                        //}
                    }
                }
            }


        }

        //public void TipsCohesion()
        //{
        //    List<Tip> nearTips = new List<Tip>();

        //    // search neighbour agents and add tips to neighbours tips list (do it at every iteration since tips can move)
        //    foreach (AgentBody nearAg in Neighbours)
        //        nearTips.AddRange(nearAg.body.Tips);

        //    // call tips ComputeDesired
        //    foreach (Tip t in body.Tips) t.ComputeDesiredToPrev(nearTips);
        //}

        public void TipsCohesionFixed()
        {
            foreach (Tip t in body.Tips) t.ComputeDesiredToFixed();
        }


        public void UpdateArms()
        {

        }

        public List<Polyline> ExtractBody()
        {
            return body.Arms;
        }

    }

    // ............................................................ Body ..........
    // ............................................................................
    // ............................................................................
    public class Body
    {
        public List<Polyline> Arms;
        public List<Tip> Tips;
        public Point3d O;
        public Body(List<Polyline> polylines)
        {
            // ATTENTION - typical reference type mistake - shallow vs deep copies
            // this is a shallow copy, so it references always the same PolyLine list!
            //Arms = new List<Polyline>(polylines); 

            // this makes a deep copy - CORRECT
            Arms = new List<Polyline>();
            foreach (Polyline p in polylines)
                Arms.Add(p.Duplicate());

            O = Arms[0][0];

            Tips = new List<Tip>();
            Point3d prev;
            int armIndex = 0;
            foreach (Polyline arm in Arms)
            {
                if (arm.Count < 3) prev = O; else prev = arm[arm.Count - 2];
                Tips.Add(new Tip(this, arm[arm.Count - 1], prev, armIndex));
            }
        }
    }

    // ............................................................. Tip ..........
    // ............................................................................
    // ............................................................................
    public class Tip
    {
        public Body body;
        public Point3d pos;
        public Point3d prev;
        public Vector3d dir;
        public Vector3d desired;
        public Tip neighbour;
        public int armIndex;
        public double maxLen;
        public double cR;
        public double cI;
        public double angleOfVis;

        public Tip(Body body, Point3d pos, Point3d prev, int armIndex, double cR, double cI, double angleOfVis)
        {
            this.body = body;
            this.pos = pos;
            this.prev = prev;
            this.armIndex = armIndex;
            this.dir = pos - prev;
            this.maxLen = dir.Length * 2.0f;
            this.cR = cR;
            this.cI = cI;
            this.angleOfVis = angleOfVis;
            desired = Vector3d.Zero;
        }

        // constructor chaining example
        public Tip(Body body, Point3d pos, Point3d prev, int armIndex) : this(body, pos, prev, armIndex, 1.0f, 0.05f, Math.PI * 0.3) { }

        public void ComputeDesiredToTip(List<Tip> neighbourTips)
        {
            // reset desired vector
            desired = Vector3d.Zero;
            // if neighbour tips list is zero or null return
            if (neighbourTips == null || neighbourTips.Count == 0) return;

            Vector3d cohesion = Vector3d.Zero;
            double nTipCount = 0.0;
            double distSq, angle;
            Vector3d toNTip;
            // search neighbour tips list
            foreach (Tip nTip in neighbourTips)
            {
                distSq = pos.DistanceToSquared(nTip.pos);
                //  if tip in radius 
                if (distSq < cR)
                {
                    //   then if tip in angle of vision
                    toNTip = nTip.pos - pos;
                    angle = Vector3d.VectorAngle(dir, toNTip);
                    if (angle < angleOfVis)
                    {
                        //  add to cohesion vector and increase counter
                        cohesion += toNTip;
                        nTipCount++;
                    }
                }
            }
            // if found tips number > 0
            if (nTipCount > 0)
            {
                // average cohesion vector
                cohesion /= nTipCount;
                // desired is cohesion
                desired = cohesion;
            }

        }

        public void ComputeDesiredToPrev(List<Tip> neighbourTips)
        {
            // reset desired vector
            desired = Vector3d.Zero;
            // if neighbour tips list is zero or null return
            if (neighbourTips == null || neighbourTips.Count == 0) return;

            Vector3d cohesion = Vector3d.Zero;
            double nTipCount = 0.0;
            double distSq, angle;
            Vector3d toNTip;
            // search neighbour tips list

            foreach (Tip nTip in neighbourTips)
            {
                distSq = pos.DistanceToSquared(nTip.prev);
                //  if prev in radius 
                if (distSq < cR)
                {
                    //   then if tip in angle of vision
                    toNTip = nTip.prev - pos;
                    angle = Vector3d.VectorAngle(dir, toNTip);
                    if (angle < angleOfVis)
                    {
                        //     add to cohesion vector and increase counter
                        cohesion += toNTip;
                        nTipCount++;
                    }
                }
            }
            // if found tips number > 0
            if (nTipCount > 0)
            {
                // average cohesion vector
                cohesion /= nTipCount;
                // desired is cohesion
                desired = cohesion;
            }

        }

        public void ComputeDesiredToFixed()
        {
            // reset desired vector
            desired = Vector3d.Zero;
            // if neighbour tips list is zero or null return
            if (neighbour == null) return;

            desired = neighbour.prev - pos;

        }

        public void UpdatePosition()
        {
            pos += desired * cI;
            // limit tip position to a max reach
            Vector3d toTip = pos - prev;
            if (toTip.Length > maxLen)
            {
                toTip = Limit(toTip, maxLen);
                pos = prev + toTip;
            }
        }

        //public void UpdatePositionOld()
        //{
        //    pos += desired * cI;
        //    // limit tip position to a max reach
        //    Vector3d toTip = pos - body.O;
        //    if (toTip.SquareLength > 1f)
        //    {
        //        toTip = Limit(toTip, 1f);
        //        pos = body.O + toTip;
        //    }
        //}

        public void UpdateDirection()
        {
            dir = pos - prev;
        }

        public void Update()
        {
            UpdatePosition();
            UpdateDirection();
        }
    }

    // .................................................................. Utilities 
    // .............................................................................

    public static Vector3d Limit(Vector3d v, double length)
    {
        Vector3d rv = new Vector3d(v);
        double len = rv.Length;
        if (len > length)
        {
            rv.Unitize();
            rv *= length;
        }
        return rv;
    }
# ---------- end c_script_2 ----------

# ----
ftsv2_2 = FileToScriptV2(File=path_2)

# ---- group: initial orientation
crv_4 = Curve(orient.Geometry)

# ----
iterations_2 = Panel(c_script_2.iter)
end = EndPoints(Curve=c_script_2.Bodies)  # -> Start, End
end_2 = EndPoints(Curve=crv_4)  # -> Start, End

# ---- group: show tips deviation
ln_2 = Line(StartPoint=end_2.End, EndPoint=end.End)
vdisex_4 = VectorDisplayEx(Point=end_2.End, Vector=ln_2, Colour=ColourSwatch(SwatchColor=RGB(255, 255, 255)), Width="1")

# ---- group: copy, internalize and use for Dendro Post processing
# output geometries
crv_5 = Curve(c_script_2.Bodies)

# ----
pln_3 = Plane(c_script_2.Planes)
pt_2 = Point(c_script_2.TipPoints)

# ==== cluster Cluster
plane = ClusterInput()
plane_radius = ClusterInput()

# ---- group: create a mesh quad face
panel = Panel("""{-1,-1,0}
{1,-1,0}
{1,1,0}
{-1,1,0}""")
conmesh = ConstructMesh(Vertices=panel, Faces={A=0, B=1, C=2, D=3})
scale = Scale(Geometry=conmesh, Center=Point(0, 0, 0), Factor=plane_radius)  # -> Geometry, Transform

# ----
orient = Orient(Geometry=scale.Geometry, Source=PlaneXY(0, 0, 0), Target=plane)  # -> Geometry, Transform
mesh_plane = ClusterOutput(orient.Geometry)
