# Grasshopper definition AgentBodiesVolumetric.gh (Grasshopper 1.0.7)
# Copyright: Co-de-iT
# plug-ins: CurlNoise, FileToScript

cs_file_to_sync = Panel("Align Planes.cs")
cs_file_to_sync_2 = Panel("Planes2Bodies.cs")
dir_type = ValueList({"desktop": 0, "documents": 1, "GH file path": 2, "C:": 3}, selected="GH file path")
f_ghfilepath = GHFilePathInfo()  # -> F, P
# ---------- f_ghfilepath: C# ----------
                                      /*
    froGH - a sparse collection of (in)utilities for Grasshopper

    GH File and Path info

    code by Alessio Erioli

    froGH by Co-de-iT is licensed under a Creative Commons Attribution 4.0 International License.
    http://creativecommons.org/licenses/by/4.0/

    */

    initComp();

    GH_Document ghDoc = Grasshopper.Instances.ActiveCanvas.Document;

    int nameLen = ghDoc.DisplayName.TrimEnd('*').Length + 3; // +3 accounts for the '.gh' extension
    int fileLen = ghDoc.FilePath.TrimEnd('*').Length;

    F = ghDoc.DisplayName.TrimEnd('*');
    P = ghDoc.FilePath.Substring(0, fileLen - nameLen);
# ---------- f_ghfilepath: C# additional code ----------
  void initComp(){

    Component.Name = "GH File Path Info";
    Component.NickName = "f_GHFilePath";
    Component.Description = "Provides info on current Grasshopper Document file name and path\nUseful for exporting files with the same name as the gh file and in the same directory";
    Component.Params.Output[0].Name = "File Name";
    Component.Params.Output[0].Description = "Current GH file name";
    Component.Params.Output[1].Name = "File Path";
    Component.Params.Output[1].Description = "Current GH file path";
  }
# ---------- end f_ghfilepath ----------
f_pathg = PathGenerator(type=dir_type, subDir=f_ghfilepath.F)  # -> dir; inputs type: Int32, subDir: String
# ---------- f_pathg: C# ----------
                           /*
    froGH - a sparse collection of (in)utilities for Grasshopper

    Path Generator
    code by Alessio Erioli - value list generation based on code by James Ramsden

    froGH by Co-de-iT is licensed under a Creative Commons Attribution 4.0 International License.
    http://creativecommons.org/licenses/by/4.0/

    */
    initComp();


    String S = "";
    String root = "";
    String end = "\\";
    String eol = Environment.NewLine;

    // __________________ autoList part __________________

    // variable for the list
    Grasshopper.Kernel.Special.GH_ValueList vList;
    // tries to cast input as list
    try{

      // if the list is not the first parameter then change Input[0] to the corresponding value
      vList = (Grasshopper.Kernel.Special.GH_ValueList) Component.Params.Input[0].Sources[0];
      // Print("value list connected");
      // check if the list must be created
      //if (vList.NickName != "dir type"){
      if (!vList.NickName.Equals("dir type")){
        vList.ClearData();
        vList.ListItems.Clear();
        vList.NickName = "dir type";
        var item1 = new Grasshopper.Kernel.Special.GH_ValueListItem("desktop", "0");
        var item2 = new Grasshopper.Kernel.Special.GH_ValueListItem("documents", "1");
        var item3 = new Grasshopper.Kernel.Special.GH_ValueListItem("GH file path", "2");
        var item4 = new Grasshopper.Kernel.Special.GH_ValueListItem("C:", "3");
        vList.ListItems.Add(item1);
        vList.ListItems.Add(item2);
        vList.ListItems.Add(item3);
        vList.ListItems.Add(item4);

        vList.ListItems[0].Value.CastTo(out type);
      }
    }
    catch{
      // handles anything that is not a value list
    }


    switch(type){
      case 0:
        root = Environment.GetFolderPath(Environment.SpecialFolder.Desktop) + end;
        S = "Desktop";
        break;
      case 1:
        root = Environment.GetFolderPath(Environment.SpecialFolder.MyDocuments) + end;
        S = "Documents";
        break;
      case 2:
        GH_Document ghDoc = owner.OnPingDocument();

        if (ghDoc.IsFilePathDefined)
        {
          int nameLen = ghDoc.DisplayName.TrimEnd('*').Length + 3; // +3 accounts for the '.gh' extension
          int fileLen = ghDoc.FilePath.TrimEnd('*').Length;

          //F = ghDoc.DisplayName.TrimEnd('*');
          root = ghDoc.FilePath.Substring(0, fileLen - nameLen);
          //root = gh_d.FilePath;
          S = "GH File path";
        }
        else
        {
          Print("No path defined. Saving to Desktop until then");
          root = Environment.GetFolderPath(Environment.SpecialFolder.Desktop);
          S = "Desktop";
        }
        break;
      case 3:
        root = "C:" + end;
        S = root + end;
        break;
    }
    dir = root + (subDir != null ? (subDir + end) : "");
    Component.Message = S;
# ---------- f_pathg: C# additional code ----------
  void initComp(){
    Component.Name = "Path Generator";
    Component.NickName = "f_PathG";
    Component.Description = "generates a path based on local direcories such as Desktop, Documents, GH file path";
    Component.Params.Input[0].Name = "dir type";
    Component.Params.Input[0].Description = "directory type: 0 desktop, 1 documents, 2 GH file path, 3 C:\nconnect a value list for automatic list generation";
    Component.Params.Input[1].Name = "custom subdir";
    Component.Params.Input[1].Description = "(optional) custom subdirectory";
  }
# ---------- end f_pathg ----------
concat = Concatenate(FragmentA=f_pathg, FragmentB=cs_file_to_sync)
concat_2 = Concatenate(FragmentA=f_pathg, FragmentB=cs_file_to_sync_2)
# Agent Bodies Volumetric
# 
# Agent Bodies in a 3D volume, interacting with a scalar Simplex Noise and vector Curl Noise fields.
# 
# code by Alessio Erioli
# 
# v 0.2
# 
# © a3 _/TH.esis 2020 _ Creative Commons Attribution-NonCommercial-ShareAlike3.0 UnportedLicense.
path = FilePath(concat)
path_2 = FilePath(concat_2)

# ---- group: volume
box = Box({Plane=Plane(origin=(0, 0, 0), x=(0, 1, 0), y=(1, 0, 0)), X=Domain(0, 10), Y=Domain(0, 10), Z=Domain(-10, 0)})

# ----
n_of_planes = Slider(3000, range=10..5000)
_3d = BooleanToggle(True)

# ---- group: volumetric grid
c_script = CSharpScript(B=box, n=Slider(40, range=0..100))  # -> A; inputs B: Brep, n: Int32
# ---------- c_script: C# ----------
    BoundingBox b1 = B.GetBoundingBox(false);

    DataTree<Point3d> pts = new DataTree<Point3d>();
    GH_Path path;

    double step = 1.0 / (double) n;

    for (int i = 0; i < n + 1; i++)
      for (int j = 0; j < n + 1; j++)
      {
        path = new GH_Path(i, j);
        for (int k = 0; k < n + 1; k++)
          pts.Add(b1.PointAt(i * step, j * step, k * step));
      }

    A = pts;
# ---------- end c_script ----------

# ----
random_vector = CSharpScript(n=n_of_planes, seed=Slider(0, range=0..100), DDD=_3d)  # -> out, V; inputs n: Int32, seed: Int32, DDD: Boolean
# ---------- random_vector: C# usings ----------
using System.IO;
using System.Linq;
using System.Data;
using System.Drawing;
using System.Reflection;
using System.Windows.Forms;
using System.Xml;
using System.Xml.Linq;
using System.Runtime.InteropServices;

using Rhino.DocObjects;
using Rhino.Collections;
using GH_IO;
using GH_IO.Serialization;
# ---------- random_vector: C# ----------
    if(seed == 0) rnd = new Random(); else rnd = new Random(seed);
    List <Vector3d> vectors = new List<Vector3d>();
    Vector3d vec = new Vector3d();
    for (int i = 0; i < n; i++){
      vec.X = rnd.NextDouble() - 0.5;
      vec.Y = rnd.NextDouble() - 0.5;
      vec.Z = DDD ? rnd.NextDouble() - 0.5 : 0;
      vec.Unitize();
      vectors.Add(vec);
    }
    V = vectors;
# ---------- random_vector: C# additional code ----------
  Random rnd;
# ---------- end random_vector ----------
pop3d = Populate3D(Region=box, Count=n_of_planes, Seed=1)
plane_radius = Slider(0.25, range=0..1)
sr_multiplier = Slider(5, range=0..5)
cint = Slider(0.05, range=0..1)
aint = Slider(0.5, range=0..1)
sint = Slider(10, range=0..10)
fieldint = Slider(0.5, range=0..1)
max_force = Slider(0.4, range=0..1)

# ---- group: curl noise parameters
number_slider = Slider(0.121, range=0..1)
number_slider_2 = Slider(0.6, range=0..1)

# ---- group: simplex noise parameters
number_slider_3 = Slider(0.18, range=0..1)
number_slider_4 = Slider(0, range=0..10)

# ---- group: Simplex noise calculations
c_script_2 = CSharpScript(
    P=c_script,
    scale=number_slider_3,
    time=number_slider_4,
    Reference="C:\Users\Alessio\AppData\Roaming\Grasshopper\Libraries\Noises.dll")  # -> Sn; inputs P: list of Point3d, scale: Double, time: Double
# ---------- c_script_2: C# usings ----------
using Noises;
using System.Threading.Tasks;
# ---------- c_script_2: C# ----------
    float[] NoiseVal = new float[P.Count];

    Parallel.For(0, P.Count, i =>
      {
      NoiseVal[i] = Noise.Generate((float) (P[i].X * scale + time), (float) (P[i].Y * scale + time), (float) (P[i].Z * scale + time));
      });

    Sn = NoiseVal;
# ---------- end c_script_2 ----------

# ----
number_slider_5 = Slider(-0.1, range=-1..1)
number_slider_6 = Slider(0.3, range=0..1)
multiplication = Multiplication(A=plane_radius, B=sr_multiplier)
plane_radius_2 = Slider(0.25, range=0..1)
max_force_2 = Slider(0.4, range=0..1)
reset = Button()
go = Button()
debug = BooleanToggle(False)
vec = Vector(random_vector.V)
pt = Point(pop3d)

# ---- group: Symmetric Interval around value
c_script_3 = CSharpScript(val=number_slider_5, tol=number_slider_6)  # -> I; inputs val: Double, tol: Double
# ---------- c_script_3: C# ----------
    I = new Interval(val - tol, val + tol);
# ---------- end c_script_3 ----------

# ----
inc = Includes(Value=c_script_2, Domain=c_script_3)  # -> Includes, Deviation
# P - points
# V - vectors (initial directions)
# cNs - curl noise scale
# cNT - curl noise time
# pR - plane Radius
# cI - cohesion Intensity
# aI - alignment Intensity
# sI - separation Intensity
# fI field Intensity
# mF - maxForce
trt = TheRealToggle(t=go)  # -> T; inputs t: Boolean
# ---------- trt: C# ----------
    InitComp();

    if(t) r = !r;

    Component.Message = r.ToString();

    T = r;
# ---------- trt: C# additional code ----------
  bool r = false;
  public void InitComp()
  {
    Component.Name = "The Real Toggle";
    Component.NickName = "TRT";
    Component.Description = "Permanent toggle - use a button to change boolean value.\nJust because I hate double clicks.";
  }
# ---------- end trt ----------
multiplication_2 = Multiplication(A=plane_radius_2, B=Slider(5, range=0..5))
display = ValueList({"full grid": 0, "isovalue range": 1}, selected="isovalue range")
cull = CullPattern(List=c_script, CullPattern=inc.Includes)

# ---- group: orient planes
c_script_4 = CSharpScript(
    reset=reset,
    go=trt,
    debug=debug,
    P=pt,
    V=vec,
    curlNoiseScale=number_slider,
    curlNoiseTime=number_slider_2,
    perlNoiseScale=number_slider_3,
    perlNoiseTime=number_slider_4,
    isoValue=number_slider_5,
    isoValueTol=number_slider_6,
    planeRadius=plane_radius_2,
    searchRadius=multiplication_2,
    cInt=Slider(0.05, range=0..1),
    aInt=Slider(0.5, range=0..1),
    sInt=Slider(10, range=0..10),
    fieldInt=Slider(0.05, range=0..1),
    isoVInt=Slider(0.5, range=0..1),
    maxForce=max_force_2,
    Reference="C:\Users\Alessio\AppData\Roaming\Grasshopper\Libraries\Noises.dll")  # -> out, Planes, neigh; inputs reset: Boolean, go: Boolean, debug: Boolean, P: list of Point3d, V: list of Vector3d, curlNoiseScale: Double, curlNoiseTime: Double, perlNoiseScale: Double, perlNoiseTime: Double, isoValue: Double, isoValueTol: Double, planeRadius: Double, searchRadius: Double, cInt: Double, aInt: Double, sInt: Double, fieldInt: Double, isoVInt: Double, maxForce: Double
# ---------- c_script_4: C# usings ----------
 

using System.Threading.Tasks;
using System.Collections.Concurrent;
using System.Drawing;
using Noises;
# ---------- c_script_4: C# ----------
 

        // align planes with field/neighbours - C#
        // code by Alessio Erioli - (c) Co-de-iT 2019 


        if (P == null || P.Count == 0) return;

        if (reset || aPS == null)
        {
            // passing the essential parameters to the new simulation
            aPS = new AgentPlaneSimulation(P, V);

        }

        // update parameters
        aPS.curlNoiseScale = curlNoiseScale;
        aPS.curlNoiseTime = curlNoiseTime;
        aPS.perlNoiseScale = perlNoiseScale;
        aPS.perlNoiseTime = perlNoiseTime;
        aPS.isoValue = isoValue;
        aPS.isoValueTol = isoValueTol;
        aPS.planeRadius = planeRadius;
        aPS.searchRadius = searchRadius;
        aPS.cohesionIntensity = cInt;
        aPS.alignmentIntensity = aInt;
        aPS.separationIntensity = sInt;
        aPS.fieldIntensity = fieldInt;
        aPS.isoValIntensity = isoVInt;
        aPS.maxForce = maxForce;

        if (go)
        {
            // run simulation
            aPS.Run();
            Component.ExpireSolution(true);
        }

        // extract output geometries
        Planes = aPS.OutPlanes();
        if (debug) neigh = aPS.NeighOut();
# ---------- c_script_4: C# additional code ----------
 

    // ............................................................ global variables 
    // global variables
    public AgentPlaneSimulation aPS;

    // .................................................................... classes 
    // .............................................................................
    // .............................................................................



    // ...................................................... Simulation ..........
    // ............................................................................
    // ............................................................................

    public class AgentPlaneSimulation
    {
        // ..........................    fields

        public double curlNoiseScale;
        public double curlNoiseTime;
        public double perlNoiseScale;
        public double perlNoiseTime;
        public double isoValue;
        public double isoValueTol;
        public double planeRadius;
        public double searchRadius;
        public double cohesionIntensity;
        public double alignmentIntensity;
        public double separationIntensity;
        public double fieldIntensity;
        public double isoValIntensity;
        public double maxForce;
        
        public AgentPlane[] agentPlanes;

        // ..........................    constructor

        public AgentPlaneSimulation(List<Point3d> P, List<Vector3d> V)
        {
            // build agent planes array
            Build(P.ToArray(), V.ToArray());
        }

        // ..........................    methods

        public void Build(Point3d[] P, Vector3d[] V)
        {
            // build agent planes array
            agentPlanes = new AgentPlane[P.Length];

            if (V == null || V.Length < P.Length)
                V = RandomVectors(P.Length);

            Parallel.For(0, P.Length, i =>
            {
                agentPlanes[i] = new AgentPlane(P[i], V[i], this);
            });

        }

        public void Run()
        {
            UpdateAgents();
        }

        public void UpdateAgents()
        {

            // . . . . . . . . . . environmental and stigmergic interactions


            // calculate field influence vector for agents

            Parallel.For(0, agentPlanes.Length, i =>
             {
                 // curl noise vector
                 Vector3d cNV;
                 cNV = CurlNoise.CurlNoiseVector(agentPlanes[i].O, curlNoiseScale, curlNoiseTime, true);
                 cNV.Unitize();

                 // this resets the acceleration (or desired direction)
                 // in case a different update sequence is implemented
                 // remember to reset desired before calculating the new iteration
                 agentPlanes[i].ResetDesireds();
                 agentPlanes[i].ComputeFieldAlign(cNV);
                 agentPlanes[i].ComputeDesiredIsoValue((float)isoValue, perlNoiseScale, perlNoiseTime);

             });

            // . . . . . . . . . . peer-to-peer interaction
            FlockRTree();

            // . . . . . . . . . . update position and direction
            UpdateAgentsDirection();

        }

        //public void UpdateAgents_OLD()
        //{
        // calculate curl noise vector for agents

        //Vector3d[] curlNoiseVector = new Vector3d[agentPlanes.Length];

        // parallel loop version 1
        //var p = Partitioner.Create(0, agentPlanes.Length);

        //Parallel.ForEach(p, (range, loopState) =>
        //{
        //    for (int i = range.Item1; i < range.Item2; i++)
        //    {
        //        CurlNoise(agentPlanes[i].O, cNS, cNT, true, out curlNoiseVector[i]);
        //        curlNoiseVector[i].Unitize();
        //        agentPlanes[i].ResetDesired();
        //        agentPlanes[i].AlignWithField(curlNoiseVector[i], fI);
        //    }
        //});


        // parallel loop version 2
        //Parallel.For(0, agentPlanes.Length, i =>
        //{
        //    CurlNoise(agentPlanes[i].O, cNS, cNT, true, out curlNoiseVector[i]);
        //    curlNoiseVector[i].Unitize();
        //    agentPlanes[i].Align(curlNoiseVector[i], mF);
        //});
        //}

        public void FlockRTree()
        {

            // declare RTree
            RTree rTree = new RTree();

            // populate RTree
            for (int i = 0; i < agentPlanes.Length; i++)
                rTree.Insert(agentPlanes[i].O, i);

            // find neighbours for each agent plane
            foreach (AgentPlane agent in agentPlanes)
            {
                agent.neighbours.Clear();

                EventHandler<RTreeEventArgs> rTreeCallback =
                    (object sender, RTreeEventArgs args) =>
                    {
                        if (agentPlanes[args.Id] != agent)
                            agent.neighbours.Add(agentPlanes[args.Id]);
                    };

                rTree.Search(new Sphere(agent.O, searchRadius), rTreeCallback);
            }

            // compute desired vector for each agent
            Parallel.ForEach(agentPlanes, agent =>
             {
                 agent.ComputeDesiredNeighbours();
             });

        }

        public void UpdateAgentsDirection()
        {
            var part = Partitioner.Create(0, agentPlanes.Length);
            Parallel.ForEach(part, (range, loopstate) =>
            {
                for (int i = range.Item1; i < range.Item2; i++)
                {
                    // update at max Force
                    agentPlanes[i].Update(maxForce);
                }
            });
        }

        /// <summary>
        /// Output Planes
        /// </summary>
        /// <returns></returns>
        public GH_Plane[] OutPlanes()
        {
            GH_Plane[] gP = new GH_Plane[agentPlanes.Length];
            Parallel.For(0, agentPlanes.Length, i =>
            {
                gP[i] = new GH_Plane(agentPlanes[i].PlaneOut());

            });
            return gP;
        }

        public DataTree<GH_Point> NeighOut()
        {
            DataTree<GH_Point> neighPts = new DataTree<GH_Point>();
            for (int i = 0; i < agentPlanes.Length; i++)
                for (int j = 0; j < agentPlanes[i].neighbours.Count; j++)
                {
                    neighPts.Add(new GH_Point(agentPlanes[i].neighbours[j].O), new GH_Path(i));

                }
            return neighPts;
        }

    }


    // ........................................................... Agent ..........
    // ............................................................................
    // ............................................................................
    public class AgentPlane
    {

        // fields
        public Point3d O;
        public Vector3d X, Y, Z;
        public Vector3d desDir; // desired direction - influenced by environmental field and neighbour agents' directions
        public Vector3d desPos; // desired position - influenced by environmental movement constraints (es. surface) and neighbour agents
        public AgentPlaneSimulation agentSim;
        public List<AgentPlane> neighbours;
        public float currentFieldVal;
        public Point3d[] SearchIcosahedron =
        {
            new Point3d( 0, 0, 1),
            new Point3d(0.894427, 0, 0.447214),
            new Point3d(0.276393, 0.850651, 0.447214),
            new Point3d( -0.723607, 0.525731, 0.447214),
            new Point3d( -0.723607, -0.525731, 0.447214),
            new Point3d( 0.276393, -0.850651, 0.447214),
            new Point3d( 0.723607, 0.525731, -0.447214),
            new Point3d( -0.276393, 0.850651, -0.447214),
            new Point3d( -0.894427, 0, -0.447214),
            new Point3d( -0.276393, -0.850651, -0.447214),
            new Point3d( 0.723607, -0.525731, -0.447214),
            new Point3d( 0, 0, -1)};

        // constructor
        public AgentPlane(Point3d O, Vector3d dirX, AgentPlaneSimulation agentSim)
        {
            this.O = O;
            dirX.Unitize();
            this.X = dirX;
            this.agentSim = agentSim;
            neighbours = new List<AgentPlane>();
        }
        // methods

        public void Update(double maxForce)
        {
            // update position
            O += desPos * maxForce;
            // update direction
            X = X * (1 - maxForce) + maxForce * desDir;
            X.Unitize();
        }

        public void ResetDesireds()
        {
            desDir = Vector3d.Zero;
            desPos = Vector3d.Zero;
        }

        public void ComputeDesiredNeighbours()
        {

            // neighbours interaction
            if (neighbours.Count != 0)
            {
                // define flocking vectors
                Vector3d align = Vector3d.Zero;
                Vector3d cohesion = Vector3d.Zero;
                Vector3d separation = Vector3d.Zero;
                Vector3d pointer = Vector3d.Zero;
                int sepCount = 0;
                double sepDistSq = 4 * agentSim.planeRadius * agentSim.planeRadius; // the square of 2*plane radius
                double distSq;

                // neighbours calculations
                foreach (AgentPlane neighbour in neighbours)
                {
                    align += neighbour.X;
                    pointer = (Vector3d)Point3d.Subtract(neighbour.O, O);
                    cohesion += pointer;
                    distSq = O.DistanceToSquared(neighbour.O);
                    if (distSq < sepDistSq)
                    {
                        // separation vector is bigger when closer to another agent
                        separation += -pointer * (sepDistSq - distSq);
                        sepCount++;
                    }
                }

                // ............................ alignment behavior
                align /= neighbours.Count;

                // updates desired direction
                // multiplies alignment vector by alignment intensity factor
                desDir += agentSim.alignmentIntensity * align;

                // ............................ cohesion behavior
                cohesion /= neighbours.Count;

                // updates desired position
                // multiplies cohesion vector by cohesion intensity factor
                desPos += agentSim.cohesionIntensity * cohesion;


                // ............................ separation behavior
                if (sepCount > 0)
                    separation /= sepCount;

                // updates desired position
                // multiplies separation vector by separation intensity factor
                desPos += agentSim.separationIntensity * separation;

            }

        }

        public void ComputeDesiredIsoValue(float isoValue, double perlNoiseScale, double perlNoiseTime)
        {
            float fieldVal, diff, minDiff; // prepare variables

            currentFieldVal = Noise.Generate((float)(O.X * perlNoiseScale + perlNoiseTime),
                (float)(O.Y * perlNoiseScale + perlNoiseTime),
                (float)(O.Z * perlNoiseScale + perlNoiseTime));// field value at current positions

            minDiff = Math.Abs(currentFieldVal - isoValue); // update current distance from iso value

            Point3d target = O;// if no value is within the difference range, the target is the actual position

            if (minDiff > agentSim.isoValueTol)
            {
                for (int i = 0; i < SearchIcosahedron.Length; i++)
                {
                    Point3d sample = O + SearchIcosahedron[i] * agentSim.planeRadius;
                    fieldVal = Noise.Generate((float)(sample.X * perlNoiseScale + perlNoiseTime),
                        (float)(sample.Y * perlNoiseScale + perlNoiseTime),
                        (float)(sample.Z * perlNoiseScale + perlNoiseTime));
                    diff = Math.Abs(fieldVal - isoValue);
                    if (diff < minDiff)
                    {
                        minDiff = diff;
                        target = sample;
                    }
                }
            }

            desPos += (target - O) * agentSim.isoValIntensity;
        }

        public void ComputeFieldAlign(Vector3d fieldVector)
        {
            desDir += fieldVector * agentSim.fieldIntensity;
        }

        public void AlignWithVector(Vector3d vector, double intensity)
        {
            X = X * (1 - intensity) + vector * intensity;
            X.Unitize();
        }

        public Plane PlaneOut()
        {
            Vector3d oV = new Vector3d(O);
            oV.Unitize();
            this.Y = Vector3d.CrossProduct(X, oV);
            return new Plane(O, X, Y);
        }

        public GH_Mesh MeshOut(double rad)
        {
            Plane pl = PlaneOut();
            Transform x = Transform.PlaneToPlane(Plane.WorldXY, pl);

            Mesh m = new Mesh();
            Point3d[] verts = new Point3d[] { new Point3d(-1, -1, 0), new Point3d(1, -1, 0), new Point3d(1, 1, 0), new Point3d(-1, 1, 0) };
            m.Vertices.AddVertices(verts);
            m.Faces.AddFace(0, 1, 2, 3);
            m.Scale(rad);
            m.Transform(x);
            m.Normals.ComputeNormals();

            GH_Mesh m1 = new GH_Mesh(m);
            return m1;
        }
    }

    // .................................................................. Utilities 
    #region Utilities

    public float Remap(float val, float from1, float to1, float from2, float to2)
    {
        return (val - from1) / (to1 - from1) * (to2 - from2) + from2;
    }

    public GH_Colour Vec2Col(Vector3d v)
    {
        v.Unitize();
        int red = (int)Math.Floor(Remap((float)v.X, -1f, 1f, 0f, 255f));
        int green = (int)Math.Floor(Remap((float)v.Y, -1f, 1f, 0f, 255f));
        int blue = (int)Math.Floor(Remap((float)v.Z, -1f, 1f, 0f, 255f));
        return new GH_Colour(Color.FromArgb(red, green, blue));
    }

    public static Vector3d VectorAmp(Vector3d v, double Amplitude)
    {
        v.Unitize();
        return (v * Amplitude);
    }

    public static Vector3d RandomVector(int seed)
    {
        Vector3d r = Vector3d.Zero;
        Random rnd = new Random(seed);
        r = new Vector3d((rnd.NextDouble() * 2) - 1, (rnd.NextDouble() * 2) - 1, (rnd.NextDouble() * 2) - 1);
        return r;
    }

    public static Vector3d[] RandomVectors(int length)
    {
        Vector3d[] randomVectors = new Vector3d[length];
        Parallel.For(0, length, i =>
        {
            randomVectors[i] = RandomVector(i);
        });

        return randomVectors;
    }
    #endregion
# ---------- end c_script_4 ----------

# ----
number_slider_7 = Slider(10, range=5..10)
ftsv2 = FileToScriptV2(File=path)
filter = StreamFilter(Gate=display, Stream0=c_script, Stream1=cull)

# ---- group: Simplex Noise display
gradient = Gradient(LowerLimit="-1", UpperLimit=1, Parameter=c_script_2, stops=[0: RGB(0, 0, 0), 1: RGB(255, 255, 255)])
gate = StreamGate(Stream=filter, Gate=display)  # -> Target0, Target1
preview = CustomPreview(Geometry=gate.Target0, Material=gradient)  # disabled
cloud = CloudDisplay(Points=gate.Target1, Colours=ColourSwatch(SwatchColor=RGB(0, 255, 242)), Size="0.1", SpriteType=0)  # disabled

# ----
generic_messages = Panel(c_script_4.out)
msphere = MeshSphere(Base=c_script_4.Planes, Radius=plane_radius_2, UCount=number_slider_7, VCount=number_slider_7)  # disabled

# ---- group: Curl noise display
curl = CurlNoise(Points=filter, Scale=number_slider, Offset=number_slider_2, _3D="true")  # -> CurlVector, Colour
amp = Amplitude(Vector=curl.CurlVector, Amplitude=Slider(0.25, range=0..1))
vdisex = VectorDisplayEx(Point=filter, Vector=amp, Colour=curl.Colour, Width="1")  # disabled

# ----
deplane = DeconstructPlane(Plane=c_script_4.Planes)  # -> Origin, XAxis, YAxis, ZAxis
mjoin = MeshJoin(Meshes=msphere)  # disabled

# ---- group: debug display
filter_2 = StreamFilter(Gate=debug, Stream1=c_script_4.neigh)  # disabled
pt_2 = Point(filter_2)  # disabled
ln = Line(StartPoint=graft(c_script_4.Planes), EndPoint=pt_2)  # -> simplify(Line); disabled
panel = Panel("0")  # disabled
branch = TreeBranch(Tree=ln, Path=panel, MaintainPaths=True)  # disabled
item = ListItem(List=c_script_4.Planes, Index=panel, Wrap=True)  # disabled
cir = Circle(Plane=item, Radius=multiplication_2)  # disabled

# ----
amp_2 = Amplitude(Vector=deplane.XAxis, Amplitude=Slider(0.25, range=0..1))

# ---- group: Preview Planes
swatch = ColourSwatch(SwatchColor=RGB(255, 255, 255))
cluster = Cluster(plane=c_script_4.Planes, plane_radius=plane_radius_2)
preview_2 = CustomPreview(Geometry=cluster, Material=swatch)

# ----
preview_3 = CustomPreview(Geometry=mjoin, Material=swatch)  # disabled
vdisex_2 = VectorDisplayEx(Point=deplane.Origin, Vector=amp_2, Colour=deplane.XAxis, Width="1")
dam = DataDam(DataA=c_script_4.Planes, BufferDelay=10000000, BufferMode=0)
scale_factor = Slider(1.5, range=0..3)

# ---- group: body type B
crv = Curve([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])

# ---- group: body type A
crv_2 = Curve([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])

# ----
number_slider_8 = Slider(1.5, range=0..5)
scale = Scale(Geometry=crv_2, Center=Point(0, 0, 0), Factor=scale_factor)  # -> Geometry, Transform
reset_2 = Button()
go_2 = BooleanToggle(False)
pln = Plane(dam)
cir_2 = Circle(Plane=PlaneXY(0, 0, 0), Radius=number_slider_8)

# ---- group: search radius
crv_3 = Curve(cir_2)

# ----
orient = Orient(Geometry=scale.Geometry, Source=PlaneXY(0, 0, 0), Target=graft(pln))  # -> Geometry, Transform

# ---- group: agent bodies
# legend: sR - agent search radius
# body - body shape (see instructions)
c_script_5 = CSharpScript(reset=reset_2, go=go_2, Pl=pln, sR=number_slider_8, body=scale.Geometry)  # -> out, iter, Bodies, Planes, TipPoints; inputs reset: Boolean, go: Boolean, Pl: list of Plane, sR: Double, body: list of Polyline
# ---------- c_script_5: C# usings ----------
 
using System.Threading;
using System.Threading.Tasks;
using System.Collections.Concurrent;
using System.Drawing;
# ---------- c_script_5: C# ----------
 

        /*
          agent bodies interaction - C#
          code by Alessio Erioli - (c) Co-de-iT 2019 
        */

        // . . . . . . . . . . . . . . . . . . . . . . . . return on null data
        if (Pl == null || body == null) return;

        // variables for data extraction
        DataTree<Polyline> outBodies = new DataTree<Polyline>();
        GH_Plane[] outPlanes = new GH_Plane[Pl.Count];
        List<GH_Point> tipPoints = new List<GH_Point>();

        // . . . . . . . . . . . . . . . . . . . . . . . . initialize system
        if (reset || aBS == null)
        {
            aBS = new AgentBodySystem(Pl, body, sR);
            iterationsCount = 0;
        }


        if (go)
        {
            for (int i = 0; i < 10; i++)
            {
                // update System
                aBS.Update();

                // update iteration counter
                iterationsCount++;
            }
            Component.ExpireSolution(true);
        }


        // . . . . . . . . . . . . . . . . . . . . . . . . extract geometries and data

        for (int i = 0; i < aBS.Agents.Length; i++)
        {
            outBodies.AddRange(aBS.Agents[i].ExtractBody(), new GH_Path(i));
            outPlanes[i] = new GH_Plane(aBS.Agents[i].agentPlane);
            for (int j = 0; j < aBS.Agents[i].body.Tips.Count; j++)
                tipPoints.Add(new GH_Point(aBS.Agents[i].body.Tips[j].pos));
        }

        iter = iterationsCount;
        Bodies = outBodies;
        Planes = outPlanes;
        TipPoints = tipPoints;
# ---------- c_script_5: C# additional code ----------
 

    // global variables
    public AgentBodySystem aBS;
    public int iterationsCount;

    // .................................................................... classes 
    // .............................................................................
    // .............................................................................

    // ...................................................... Simulation ..........
    // ............................................................................
    // ............................................................................
    public class AgentBodySystem
    {
        public AgentBody[] Agents;
        RTree agentsRTree;
        public double searchRadius;
        public double globalDeviation;
        public double deviationThreshold;

        public AgentBodySystem(List<Plane> Pl, List<Polyline> body, double searchRadius)
        {
            Agents = new AgentBody[Pl.Count];
            agentsRTree = new RTree();
            this.searchRadius = searchRadius;
            deviationThreshold = 0.01; // to be implemented in the future (stop when global deviation under this threshold)

            // . . . . . . . . . . . . . . . . . . . . . . . . build agents array & RTree
            // since agents are fixed it can be built in advance
            for (int i = 0; i < Pl.Count; i++)
            {
                Agents[i] = new AgentBody(Pl[i], body);
                agentsRTree.Insert(Agents[i].agentPlane.Origin, i);
            }

            // . . . . . . . . . . . . . . . . . . . . . . . . . . . build neighbours map
            FindNeighbours(this.searchRadius);
            foreach (AgentBody ab in Agents)
                ab.FindTipNeighbour();
        }

        public AgentBodySystem() { }

        public void Update()
        {
            globalDeviation = 0f;

            Parallel.ForEach(Agents, ab =>
            {
                ab.Update();
            });

            // call tips UpdatePosition and UpdateDirection
            Parallel.ForEach(Agents, ab =>
            {
                foreach (Tip t in ab.body.Tips) t.Update();
            });

            // rebuild bodies
            Parallel.ForEach(Agents, ab =>
            {
                ab.RebuildBody();
            });
        }

        public void FindNeighbours(double searchRadius)
        {

            foreach (AgentBody ab in Agents)
            {
                EventHandler<RTreeEventArgs> rTreeCallback = (object sender, RTreeEventArgs args) =>
                {
                    if (Agents[args.Id] != ab)
                        ab.Neighbours.Add(Agents[args.Id]);

                };

                agentsRTree.Search(new Sphere(ab.body.O, searchRadius), rTreeCallback);
            }
        }
    }

    // ...................................................... Agent Body ..........
    // ............................................................................
    // ............................................................................

    public class AgentBody
    {
        public Plane agentPlane;
        public Body body;
        public List<AgentBody> Neighbours;
        public AgentBodySystem ABS;

        public AgentBody(Plane agentPlane, List<Polyline> polylines)
        {
            // define agent body and orient it
            this.agentPlane = agentPlane;
            body = new Body(polylines);
            OrientBody(Plane.WorldXY, this.agentPlane);

            Neighbours = new List<AgentBody>(); // this list will be filled later by the simulation
        }

        public void OrientBody(Plane oldPlane, Plane newPlane)
        {
            var x = Transform.PlaneToPlane(oldPlane, newPlane);

            body.O.Transform(x);

            for (int i = 0; i < body.Arms.Count; i++)
            {
                body.Arms[i].Transform(x);
                body.Tips[i].pos = body.Arms[i][body.Arms[i].Count - 1];
                body.Tips[i].prev = body.Arms[i][body.Arms[i].Count - 2];
            }

        }

        public void RebuildBody()
        {
            for (int i = 0; i < body.Arms.Count; i++)
            {
                body.Arms[i][body.Arms[i].Count - 1] = body.Tips[i].pos;
            }

        }

        public void Update()
        {
            //TipsCohesion();
            TipsCohesionFixed();
        }

        public void FindTipNeighbour()
        {

            double dSqPos, dSqPrev;
            double anglePos, anglePrev;
            double minD;
            foreach (Tip tip in body.Tips)
            {
                minD = 1.0f; //Double.MaxValue; // max Search Radius (squared)
                foreach (AgentBody nearAg in Neighbours)
                {
                    foreach (Tip neighTip in nearAg.body.Tips)
                    {
                        // calculate angles
                        anglePos = Vector3d.VectorAngle(tip.pos - tip.prev, neighTip.pos - tip.pos);
                        anglePrev = Vector3d.VectorAngle(tip.pos - tip.prev, neighTip.prev - tip.pos);
                        if (anglePos < anglePrev && anglePos < tip.angleOfVis)
                        {
                            dSqPos = tip.pos.DistanceToSquared(neighTip.pos);
                            if (dSqPos < minD)
                            {
                                minD = dSqPos;
                                tip.neighbour = neighTip;
                            }
                        }
                        else if (anglePrev < tip.angleOfVis)
                        {
                            dSqPrev = tip.pos.DistanceToSquared(neighTip.prev);
                            if (dSqPrev < minD)
                            {
                                minD = dSqPrev;
                                tip.neighbour = neighTip;
                            }
                        }
                        // calculate distance to prev
                        //dSqPos = tip.pos.DistanceToSquared(neighTip.pos);
                        //dSqPrev = tip.pos.DistanceToSquared(neighTip.prev);
                        //if (dSqPos < minD || dSqPrev < minD)
                        //{
                        //    minD = dSqPos<dSqPrev? dSqPos:dSqPrev;
                        //    tip.neighbour = neighTip;
                        //}
                    }
                }
            }


        }

        //public void TipsCohesion()
        //{
        //    List<Tip> nearTips = new List<Tip>();

        //    // search neighbour agents and add tips to neighbours tips list (do it at every iteration since tips can move)
        //    foreach (AgentBody nearAg in Neighbours)
        //        nearTips.AddRange(nearAg.body.Tips);

        //    // call tips ComputeDesired
        //    foreach (Tip t in body.Tips) t.ComputeDesiredToPrev(nearTips);
        //}

        public void TipsCohesionFixed()
        {
            foreach (Tip t in body.Tips) t.ComputeDesiredToFixed();
        }


        public void UpdateArms()
        {

        }

        public List<Polyline> ExtractBody()
        {
            return body.Arms;
        }

    }

    // ............................................................ Body ..........
    // ............................................................................
    // ............................................................................
    public class Body
    {
        public List<Polyline> Arms;
        public List<Tip> Tips;
        public Point3d O;
        public Body(List<Polyline> polylines)
        {
            // ATTENTION - typical reference type mistake - shallow vs deep copies
            // this is a shallow copy, so it references always the same PolyLine list!
            //Arms = new List<Polyline>(polylines); 

            // this makes a deep copy - CORRECT
            Arms = new List<Polyline>();
            foreach (Polyline p in polylines)
                Arms.Add(p.Duplicate());

            O = Arms[0][0];

            Tips = new List<Tip>();
            Point3d prev;
            int armIndex = 0;
            foreach (Polyline arm in Arms)
            {
                if (arm.Count < 3) prev = O; else prev = arm[arm.Count - 2];
                Tips.Add(new Tip(this, arm[arm.Count - 1], prev, armIndex));
            }
        }
    }

    // ............................................................. Tip ..........
    // ............................................................................
    // ............................................................................
    public class Tip
    {
        public Body body;
        public Point3d pos;
        public Point3d prev;
        public Vector3d dir;
        public Vector3d desired;
        public Tip neighbour;
        public int armIndex;
        public double maxLen;
        public double cR;
        public double cI;
        public double angleOfVis;

        public Tip(Body body, Point3d pos, Point3d prev, int armIndex, double cR, double cI, double angleOfVis)
        {
            this.body = body;
            this.pos = pos;
            this.prev = prev;
            this.armIndex = armIndex;
            this.dir = pos - prev;
            this.maxLen = dir.Length * 2.0f;
            this.cR = cR;
            this.cI = cI;
            this.angleOfVis = angleOfVis;
            desired = Vector3d.Zero;
        }

        // constructor chaining example
        public Tip(Body body, Point3d pos, Point3d prev, int armIndex) : this(body, pos, prev, armIndex, 1.0f, 0.05f, Math.PI * 0.3) { }

        public void ComputeDesiredToTip(List<Tip> neighbourTips)
        {
            // reset desired vector
            desired = Vector3d.Zero;
            // if neighbour tips list is zero or null return
            if (neighbourTips == null || neighbourTips.Count == 0) return;

            Vector3d cohesion = Vector3d.Zero;
            double nTipCount = 0.0;
            double distSq, angle;
            Vector3d toNTip;
            // search neighbour tips list
            foreach (Tip nTip in neighbourTips)
            {
                distSq = pos.DistanceToSquared(nTip.pos);
                //  if tip in radius 
                if (distSq < cR)
                {
                    //   then if tip in angle of vision
                    toNTip = nTip.pos - pos;
                    angle = Vector3d.VectorAngle(dir, toNTip);
                    if (angle < angleOfVis)
                    {
                        //  add to cohesion vector and increase counter
                        cohesion += toNTip;
                        nTipCount++;
                    }
                }
            }
            // if found tips number > 0
            if (nTipCount > 0)
            {
                // average cohesion vector
                cohesion /= nTipCount;
                // desired is cohesion
                desired = cohesion;
            }

        }

        public void ComputeDesiredToPrev(List<Tip> neighbourTips)
        {
            // reset desired vector
            desired = Vector3d.Zero;
            // if neighbour tips list is zero or null return
            if (neighbourTips == null || neighbourTips.Count == 0) return;

            Vector3d cohesion = Vector3d.Zero;
            double nTipCount = 0.0;
            double distSq, angle;
            Vector3d toNTip;
            // search neighbour tips list

            foreach (Tip nTip in neighbourTips)
            {
                distSq = pos.DistanceToSquared(nTip.prev);
                //  if prev in radius 
                if (distSq < cR)
                {
                    //   then if tip in angle of vision
                    toNTip = nTip.prev - pos;
                    angle = Vector3d.VectorAngle(dir, toNTip);
                    if (angle < angleOfVis)
                    {
                        //     add to cohesion vector and increase counter
                        cohesion += toNTip;
                        nTipCount++;
                    }
                }
            }
            // if found tips number > 0
            if (nTipCount > 0)
            {
                // average cohesion vector
                cohesion /= nTipCount;
                // desired is cohesion
                desired = cohesion;
            }

        }

        public void ComputeDesiredToFixed()
        {
            // reset desired vector
            desired = Vector3d.Zero;
            // if neighbour tips list is zero or null return
            if (neighbour == null) return;

            desired = neighbour.prev - pos;

        }

        public void UpdatePosition()
        {
            pos += desired * cI;
            // limit tip position to a max reach
            Vector3d toTip = pos - prev;
            if (toTip.Length > maxLen)
            {
                toTip = Limit(toTip, maxLen);
                pos = prev + toTip;
            }
        }

        //public void UpdatePositionOld()
        //{
        //    pos += desired * cI;
        //    // limit tip position to a max reach
        //    Vector3d toTip = pos - body.O;
        //    if (toTip.SquareLength > 1f)
        //    {
        //        toTip = Limit(toTip, 1f);
        //        pos = body.O + toTip;
        //    }
        //}

        public void UpdateDirection()
        {
            dir = pos - prev;
        }

        public void Update()
        {
            UpdatePosition();
            UpdateDirection();
        }
    }

    // .................................................................. Utilities 
    // .............................................................................

    public static Vector3d Limit(Vector3d v, double length)
    {
        Vector3d rv = new Vector3d(v);
        double len = rv.Length;
        if (len > length)
        {
            rv.Unitize();
            rv *= length;
        }
        return rv;
    }
# ---------- end c_script_5 ----------

# ----
ftsv2_2 = FileToScriptV2(File=path_2)

# ---- group: initial orientation
crv_4 = Curve(orient.Geometry)

# ----
iterations = Panel(c_script_5.iter)
end = EndPoints(Curve=c_script_5.Bodies)  # -> Start, End
end_2 = EndPoints(Curve=crv_4)  # -> Start, End

# ---- group: show tips deviation
ln_2 = Line(StartPoint=end_2.End, EndPoint=end.End)
vdisex_3 = VectorDisplayEx(Point=end_2.End, Vector=ln_2, Colour=ColourSwatch(SwatchColor=RGB(255, 255, 255)), Width="1")

# ----
pln_2 = Plane(c_script_5.Planes)
pt_3 = Point(c_script_5.TipPoints)

# ---- group: copy, internalize and use for Dendro Post processing
# output geometries
crv_5 = Curve(c_script_5.Bodies)

# ----
curl_2 = CurlNoise(Points=c_script_4.Planes, Scale=number_slider, Offset=number_slider_2, _3D="true")  # -> CurlVector, Colour; disabled

# ---- group: curl noise for comparison
vec_2 = Vector(curl_2.CurlVector)  # disabled

# ----
angle = Angle(VectorA=deplane.XAxis, VectorB=vec_2)  # -> Angle, Reflex; disabled

# ---- group: alignment check
alignment_control = QuickGraph(angle.Angle, SortOrder=0)  # disabled

# ----
unit = UnitVector(Vector=vec_2)  # disabled
amp_3 = Amplitude(Vector=vec_2, Amplitude=Slider(0.25, range=0..1))  # disabled
vdisex_4 = VectorDisplayEx(Point=deplane.Origin, Vector=amp_3, Colour=unit, Width="1")  # disabled

# ==== cluster Cluster
plane_radius = ClusterInput()
plane = ClusterInput()

# ---- group: create a mesh quad face
panel = Panel("""{-1,-1,0}
{1,-1,0}
{1,1,0}
{-1,1,0}""")
conmesh = ConstructMesh(Vertices=panel, Faces={A=0, B=1, C=2, D=3})
scale = Scale(Geometry=conmesh, Center=Point(0, 0, 0), Factor=plane_radius)  # -> Geometry, Transform

# ----
orient = Orient(Geometry=scale.Geometry, Source=PlaneXY(0, 0, 0), Target=plane)  # -> Geometry, Transform
mesh_plane = ClusterOutput(orient.Geometry)
