# Grasshopper definition GradientDescent.gh (Grasshopper 1.0.7)
# Copyright: Co-de-iT
# plug-ins: FileToScript, Anemone, Bifocals, Weaverbird

f_ghfilepath = GHFilePathInfo()  # -> F, P
# ---------- f_ghfilepath: C# ----------
                                      /*
    froGH - a sparse collection of (in)utilities for Grasshopper

    GH File and Path info

    code by Alessio Erioli

    froGH by Co-de-iT is licensed under a Creative Commons Attribution 4.0 International License.
    http://creativecommons.org/licenses/by/4.0/

    */

    initComp();

    GH_Document ghDoc = Grasshopper.Instances.ActiveCanvas.Document;

    int nameLen = ghDoc.DisplayName.TrimEnd('*').Length + 3; // +3 accounts for the '.gh' extension
    int fileLen = ghDoc.FilePath.TrimEnd('*').Length;

    F = ghDoc.DisplayName.TrimEnd('*');
    P = ghDoc.FilePath.Substring(0, fileLen - nameLen);
# ---------- f_ghfilepath: C# additional code ----------
  void initComp(){

    Component.Name = "GH File Path Info";
    Component.NickName = "f_GHFilePath";
    Component.Description = "Provides info on current Grasshopper Document file name and path\nUseful for exporting files with the same name as the gh file and in the same directory";
    Component.Params.Output[0].Name = "File Name";
    Component.Params.Output[0].Description = "Current GH file name";
    Component.Params.Output[1].Name = "File Path";
    Component.Params.Output[1].Description = "Current GH file path";
  }
# ---------- end f_ghfilepath ----------
srf = Surface(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)
panel = Panel(f_ghfilepath.F)
panel_2 = Panel(f_ghfilepath.P)
mesh_uv = MeshSurface(Surface=srf, UCount=Slider(68, range=5..100), VCount=Slider(61, range=5..100), Overhang=True, Equalize=False)
panel_3 = Panel("C:\Users\Alessio\Desktop\GradientDescent\GradientDescent\GradientDescent.cs")
concat = Concatenate(FragmentA=f_ghfilepath.P, FragmentB=f_ghfilepath.F, FragmentC="\", FragmentD=f_ghfilepath.F, FragmentE=".cs")
popgeo = PopulateGeometry(Geometry=mesh_uv, Count=Slider(100, range=5..100), Seed=1)  # -> graft(Population)
panel_4 = Panel(concat)
# <Title>
# 
# <description>
# 
# © a3 _/TH.esis 2020 _ Creative Commons Attribution-NonCommercial-ShareAlike3.0 UnportedLicense.
loop_start = LoopStart(Repeat=Slider(132, range=0..200), Trigger=Button(), Data=simplify(popgeo))  # -> port, Counter, Data; disabled
tri = Triangulate(Mesh=mesh_uv)  # -> Mesh, Count
meshcp = MeshClosestPoint(Point=loop_start.Data, Mesh=mesh_uv)  # -> Point, Index, Parameter
number_slider = Slider(0.19, range=0..1)
pt = Point(flatten(popgeo))
button = Button()
toggle = BooleanToggle(False)
path = FilePath(concat)
meval = MeshEval(Mesh=mesh_uv, Parameter=meshcp.Parameter)  # -> Point, Normal, Colour

# ---- group: Gradient Descent
c_script = CSharpScript(P=pt, M=mesh_uv, step=number_slider, go=toggle, reset=button)  # -> out, Pos, Trails; inputs P: list of Point3d, M: Mesh, step: Double, go: Boolean, reset: Boolean; disabled
# ---------- c_script: C# ----------
        // reset or initialization
        if (reset || GD == null || P.Count != GD.parts.Count) GD = new GradientDescent(M, P);

        if (go)
        {
            // update live variables
            GD.step = step;

            // update System
            GD.Update();

            // expire solution
            Component.ExpireSolution(true);
        }
        // data extraction for output
        pts = new Point3d[P.Count];
        trs = new Polyline[P.Count];

        for(int i=0; i< GD.parts.Count; i++)
        {
            pts[i] = GD.parts[i].pos;
            if (GD.parts[i].trail.IsValid) trs[i] = GD.parts[i].trail;
            else trs[i] = null;
        }

        Pos = pts;
        Trails = trs;
# ---------- c_script: C# additional code ----------
 

    // global variables
    public GradientDescent GD;
    public Point3d[] pts;
    public Polyline[] trs;

    // simulation classes
    public class GradientDescent
    {
        // fields
        public List<Particle> parts;
        public Mesh M;
        public double step;

        // constructor
        public GradientDescent(Mesh M, List<Point3d> P)
        {
            this.M = M;
            parts = new List<Particle>();
            foreach (Point3d p in P) parts.Add(new Particle(this, p));
        }

        // methods
        public void Update()
        {
            foreach (Particle pa in parts) pa.Update();
        }
    }

    public class Particle
    {
        // fields
        public Point3d pos;
        public Vector3d vel;
        public Polyline trail;
        public bool alive;
        public GradientDescent GraDesc;

        // constructor
        public Particle(GradientDescent GraDesc, Point3d pos)
        {
            this.GraDesc = GraDesc;
            this.pos = pos;
            vel = Vector3d.Zero;
            trail = new Polyline();
            trail.Add(new Point3d(pos));
            alive = true;
        }

        // methods

        public void Update()
        {
            CalcVel();
            Move();
        }

        void CalcVel()
        {
            // get closest point to the Mesh
            MeshPoint mP = GraDesc.M.ClosestMeshPoint(pos, 0.0);
            // evaluate Mesh normal at that point
            Vector3d mN = GraDesc.M.NormalAt(mP);
            // find tangent to Mesh (cross product of normal and Z)
            vel = Vector3d.CrossProduct(mN, Vector3d.ZAxis);
            // rotate 90 degrees
            vel.Rotate(Math.PI * 0.5, mN); //
            // unitize and set to step value
            vel.Unitize();
            vel *= GraDesc.step;
        }

        void Move()
        {
            // compute new position
            Point3d newPos = pos + vel;
            newPos = GraDesc.M.ClosestPoint(newPos);

            // check if alive condition stands
            if (Math.Abs(newPos.Z - pos.Z) < 0.01) alive = false;
            else
            {
                pos = newPos;
                trail.Add(pos);
            }
        }
    }
# ---------- end c_script ----------

# ----
c_script_2 = CSharpScript(
    P=pt,
    M=tri.Mesh,
    step=number_slider,
    eInd=Slider(0.098, range=0..1),
    eMax=Slider(0.882, range=0..3),
    go=toggle,
    reset=button)  # -> out, Me, Pos, Trails; inputs P: list of Point3d, M: Mesh, step: Double, eInd: Double, eMax: Double, go: Boolean, reset: Boolean
# ---------- c_script_2: C# usings ----------
using Rhino.Collections;
# ---------- c_script_2: C# ----------
        // reset or initialization
        if (reset || erosion == null || P.Count != erosion.parts.Count) erosion = new ErosionSim(M, P);

        if (go)
        {
            // update live variables
            erosion.step = step;
            erosion.erosionIndex = eInd;
            erosion.erosionMax = eMax;

            // update System
            erosion.Update();

            // expire solution
            Component.ExpireSolution(true);
        }
        // data extraction for output
        pts = new Point3d[P.Count];
        trs = new Polyline[P.Count];

        for (int i = 0; i < erosion.parts.Count; i++)
        {
            pts[i] = erosion.parts[i].pos;
            if (erosion.parts[i].trail.IsValid) trs[i] = erosion.parts[i].trail;
            else trs[i] = null;
        }

        Me = erosion.extractMesh();
        Pos = pts;
        Trails = trs;
# ---------- c_script_2: C# additional code ----------
 

    // global variables
    public ErosionSim erosion;
    public Point3d[] pts;
    public Polyline[] trs;

    // simulation classes
    public class ErosionSim
    {
        // fields
        public List<Particle> parts;
        public Mesh M;
        public Mesh Morig;
        public Point3dList vertexList;
        public double step;
        public double erosionIndex;
        public double erosionMax;

        // constructor
        public ErosionSim(Mesh M, List<Point3d> P)
        {
            this.M = M;
            Morig = new Mesh();
            Morig.CopyFrom(M);
            vertexList = new Point3dList(M.Vertices.ToPoint3dArray());
            parts = new List<Particle>();
            foreach (Point3d p in P) parts.Add(new Particle(this, p));
        }

        // methods
        public void Update()
        {
            foreach (Particle pa in parts)
                if (pa.alive) pa.Update();

            for (int i = 0; i < vertexList.Count; i++)
                M.Vertices.SetVertex(i, vertexList[i]);

            M.RebuildNormals();
        }

        public Mesh extractMesh()
        {
            return M;
        }
    }

    public class Particle
    {
        // fields
        public Point3d pos;
        public Vector3d vel;
        public Polyline trail;
        public bool alive;
        public ErosionSim er;

        // constructor
        public Particle(ErosionSim er, Point3d pos)
        {
            this.er = er;
            this.pos = pos;
            vel = Vector3d.Zero;
            trail = new Polyline();
            trail.Add(new Point3d(pos));
            alive = true;
        }

        // methods

        public void Update()
        {
            CalcVel();
            Erode2();
            Move();
        }

        void Erode()
        {
            // find closest Mesh vertex to particle
            int vi = er.vertexList.ClosestIndex(pos);
            // if vertex displacement < erosionMax move vertex
            if (er.M.Vertices[vi].DistanceTo(er.Morig.Vertices[vi]) < er.erosionMax)
            {
                Vector3d disp = -1 * (Vector3d)er.M.Normals[vi] * er.erosionIndex;
                er.vertexList[vi] += disp;
            }
        }

        void Erode2()
        {
            // find closest Mesh vertex to particle
            int vi = er.vertexList.ClosestIndex(pos);
            // find vertex neighbours indexes
            int[] vNeigh = er.M.Vertices.GetConnectedVertices(vi);

            // if vertex displacement < erosionMax move vertex
            if (er.M.Vertices[vi].DistanceTo(er.Morig.Vertices[vi]) < er.erosionMax)
            {
                Vector3d disp = -1 * (Vector3d)er.M.Normals[vi] * er.erosionIndex;
                er.vertexList[vi] += disp;
                // apply displacement to nieghbours
                for (int i = 0; i < vNeigh.Length; i++)
                    er.vertexList[vNeigh[i]] += disp * 0.25;
            }
        }

        void CalcVel()
        {
            // get closest point to the Mesh
            MeshPoint mP = er.M.ClosestMeshPoint(pos, 0.0);
            // evaluate Mesh normal at that point
            Vector3d mN = er.M.NormalAt(mP);
            // find tangent to Mesh (cross product of normal and Z)
            vel = Vector3d.CrossProduct(mN, Vector3d.ZAxis);
            // rotate 90 degrees
            vel.Rotate(Math.PI * 0.5, mN); //
            // unitize and set to step value
            vel.Unitize();
            vel *= er.step;
        }

        void Move()
        {
            // compute new position
            Point3d newPos = pos + vel;
            newPos = er.M.ClosestPoint(newPos);

            // check if alive condition stands
            if (Math.Abs(newPos.Z - pos.Z) < 0.01) alive = false;
            else
            {
                pos = newPos;
                trail.Add(pos);
            }
        }
    }
# ---------- end c_script_2 ----------
Z = UnitZ(Factor=1)
ftsv2 = FileToScriptV2(File=path)
xprod = CrossProduct(VectorA=meval.Normal, VectorB=Z, Unitize=True)  # -> Vector, Length
mesh = Mesh(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)
pt_2 = Point(c_script_2.Pos)
preview = CustomPreview(
    Geometry=c_script_2.Trails,
    Material={diffuse=RGB(221, 160, 221), emission=RGB(66, 48, 66), shine=0.5, specular=RGB(255, 255, 255), transparency=0})
vrot = Rotate(Vector=xprod.Vector, Axis=meval.Normal, Angle="Pi * 0.5")
swatch = ColourSwatch(SwatchColor=RGB(255, 255, 255))
wbloop = WeaverbirdsLoopSubdivision(MeshCurves=mesh, Level=1, SmoothNakedEdges=0)
number_slider_2 = Slider(0.416, range=0..1)
preview_2 = CustomPreview(
    Geometry=wbloop,
    Material={diffuse=RGB(0, 0, 0), emission=RGB(0, 0, 0), shine=0.85, specular=RGB(217, 217, 217), transparency=0})
neg = Negative(Value=number_slider_2)
vdisex = VectorDisplayEx(Point=meval.Point, Vector=vrot, Colour=RGB(0, 0, 0), Width=2)
Z_2 = UnitZ(Factor=neg)
amp = Amplitude(Vector=vrot, Amplitude=number_slider_2)
move = Move(Geometry=loop_start.Data, Motion=amp)  # -> Geometry, Transform
meshcp_2 = MeshClosestPoint(Point=move.Geometry, Mesh=mesh_uv)  # -> Point, Index, Parameter
loop_end = LoopEnd(
    port=loop_start.port,
    Exit=False,
    Data=simplify(meshcp_2.Point),
    TimeOutVal=0,
    pausedState=False,
    state="Constant output")
