# Grasshopper definition MTSerialization.gh (Grasshopper 1.0.7)
# Copyright: Co-de-iT
# plug-ins: FileToScript

f_ghfilepath = GHFilePathInfo()  # -> F, P
# ---------- f_ghfilepath: C# ----------
                                      /*
    froGH - a sparse collection of (in)utilities for Grasshopper

    GH File and Path info

    code by Alessio Erioli

    froGH by Co-de-iT is licensed under a Creative Commons Attribution 4.0 International License.
    http://creativecommons.org/licenses/by/4.0/

    */

    initComp();

    GH_Document ghDoc = Grasshopper.Instances.ActiveCanvas.Document;

    int nameLen = ghDoc.DisplayName.TrimEnd('*').Length + 3; // +3 accounts for the '.gh' extension
    int fileLen = ghDoc.FilePath.TrimEnd('*').Length;

    F = ghDoc.DisplayName.TrimEnd('*');
    P = ghDoc.FilePath.Substring(0, fileLen - nameLen);
# ---------- f_ghfilepath: C# additional code ----------
  void initComp(){

    Component.Name = "GH File Path Info";
    Component.NickName = "f_GHFilePath";
    Component.Description = "Provides info on current Grasshopper Document file name and path\nUseful for exporting files with the same name as the gh file and in the same directory";
    Component.Params.Output[0].Name = "File Name";
    Component.Params.Output[0].Description = "Current GH file name";
    Component.Params.Output[1].Name = "File Path";
    Component.Params.Output[1].Description = "Current GH file path";
  }
# ---------- end f_ghfilepath ----------
panel = Panel(f_ghfilepath.F)
panel_2 = Panel(f_ghfilepath.P)
concat = Concatenate(FragmentA=f_ghfilepath.P, FragmentB=f_ghfilepath.F, FragmentC="\", FragmentD=f_ghfilepath.F, FragmentE=".cs")
panel_3 = Panel(concat)
path = FilePath(concat)
reset = Button()
go = BooleanToggle(False)
ghtype = BooleanToggle(True)
# <Title>
# 
# <description>
# 
# © a3 _/TH.esis 2020 _ Creative Commons Attribution-NonCommercial-ShareAlike3.0 UnportedLicense.
pt = Point(Point(13.94033715, 17.51361179, 2.867400257))
c_script = CSharpScript(
    P0=pt,
    n=Slider(64, range=10..100),
    freq=Slider(0.184, range=0..1),
    amp=Slider(2.067, range=0..5),
    speed=Slider(0.352, range=0..1),
    reset=reset,
    go=go,
    GHType=ghtype,
    Reference="C:\Users\Alessio\AppData\Roaming\Grasshopper\Libraries\Noises.dll")  # -> out, P; inputs P0: Point3d, n: Int32, freq: Double, amp: Double, speed: Double, reset: Boolean, go: Boolean, GHType: Boolean
# ---------- c_script: C# usings ----------
using System.Threading.Tasks;
using Noises;
# ---------- c_script: C# ----------
        if (reset || ptsArray == null || ptsArray.Length != n * n)
        {
            ptsArray = initPts(n);
            c = 0;
        }


        //for(int i=0; i< ptsArray.Length; i++)
        //{
        //    double dd = ptsArray[i].DistanceToSquared(P0);
        //    ptsArray[i].Z = Math.Cos(dd * ptsArray[i].X * freq * 0.01 + c * speed) *
        //        Math.Sin(dd * ptsArray[i].Y * freq * 0.01 + c * speed * 0.43) * amp;
        //}

        // Parallel.For(from, to, Action);

        // i => { some action with i}

        /*
         void Func(int i)
         {
         someaction with i
         }
         
         */

        Parallel.For(0, ptsArray.Length, i =>
        //for(int i=0; i< ptsArray.Length; i++)
        {
            double dd = ptsArray[i].DistanceToSquared(P0) * 0.0001;
            ptsArray[i].Z = Noise.Generate((float) (ptsArray[i].X * freq * dd + c * speed * 0.1), 
                (float) (ptsArray[i].Y * freq * dd + c* speed * 0.1)) * amp;
            //ptsArray[i].Z = Math.Cos(dd * ptsArray[i].X * freq * 0.01 + c * speed) *
            //    Math.Sin(dd * ptsArray[i].Y * freq * 0.01 + c * speed * 0.43) * amp;
        }
        );

        if (go)
        {
            c++;
            Component.ExpireSolution(true);
        }

        if (GHType)
        {
            GH_Point[] ptOut = new GH_Point[ptsArray.Length];
            for (int i = 0; i < ptsArray.Length; i++)
                ptOut[i] = new GH_Point(ptsArray[i]);
            P = ptOut;
        }
        else P = ptsArray;
# ---------- c_script: C# additional code ----------
 
    Point3d[] ptsArray;
    int c;

    Point3d[] initPts(int n)
    {
        Point3d[] ptsArray = new Point3d[n * n];

        for (int i = 0; i < n; i++)
            for (int j = 0; j < n; j++)
                ptsArray[i * n + j] = new Point3d(i, j, 0);
        return ptsArray;
    }
# ---------- end c_script ----------
# Rhinocommon_Type
# Rhinocommon_Type
# Rhinocommon_Type
# GH_Type
# GH_Type
# GH_Type
# GH_Type
# Property
# Field
# Method()
# Constructor()
# ...
# Rhinocommon_Type
# Serialization/Deserialization: GH has its own data formats, mainly for transmission and display purposes. They work as "wrapper" classes around Rhinocommon classes.
# 
# Inside a component, data must be cast form GH_Type to a proper Rhinocommon type, and at the end of the algortim, the Rhinocommon data in output must be cast back into appropriate GH_Types.
# 
# This process might take up a lot of computing time as the number of elements to convert increases.
# 
# To cut this time off, there are two helpful strategies:
# 
# . in input: keep the data type to object or System.Object and perform the casting inside the component
# . in output: try to output as much as possible GH_Types directly
ftsv2 = FileToScriptV2(File=path)
